# Grasshopper definition tg-carrie-shapediver-10.gh (Grasshopper 1.0.8)
# plug-ins: BitmapComponent, ShapeDiverForGrasshopper

# ---- group: ignore
override_value = Slider(8.09, range=0..10)

# ----
preset = ValueList({"DEFAULT", "TEST", "CNC_9.5_CURL", "CNC_11.2", "CNC_11.2_LEFT-LOOP", "CNC_11.2_EMBED-DIA", "CNC_11.2_CURL", "CNC_11.2_CURL_EMBED-DIA", "CNC_11.2_CURL_MID-LOOPS", "LC_6", "LC_6_CURL", "LC_6_LEFT-LOOP", "LC_7.5", "LC_7.5_CURL", "LC_7.5_SQUASHED", "LC_9.5_EMBED-DIA", "LC_9.5_EMBED-SQR", "LC_9.5_CURL", "LC_9.5_CURL_EMBED-SQR", "LC_9.5_CURL_ADD-SQR", "LC_9.5_CURL_MID-LOOPS", "LC_11.2", "LC_11.2_CURL", "LC_11.2_ADD-SQR", "CNC_9.5"}, selected="LC_6")

# ---- group: hide
base_font_name = Panel("TG-CARRIE")
font_variant = Panel("")
slot_combo_first = Panel("Ba,Bb,Bc,Bd,Be,Bg,Bh,Bi,Bf,Bk,Bl,Bo,Bp,Bq,Bt,Bu,Bw,Ca,Cb,Cd,Cc,Ce,Cf,Cg,Ch,Ci,Ck,Cl,Co,Cp,Cq,Ct,Cu,Cw,Da,Db,Dc,Dd,De,Df,Dg,Dh,Di,Dk,Dl,Do,Dp,Dq,Dt,Du,Dw,Ea,Eb,Ec,Ed,Ee,Ef,Eg,Eh,Ei,Ek,El,Eo,Ep,Eq,Et,Eu,Ew,Fa,Fb,Fc,Fd,Fe,Fh,Ff,Fg,Fi,Fj,Fk,Fl,Fm,Fn,Fo,Fp,Fq,Fr,Fs,Ft,Fu,Fv,Fw,Fx,Fy,Fz,Ga,Gb,Gc,Gd,Ge,Gf,Gg,Gh,Gi,Gk,Gl,Go,Gp,Gq,Gt,Gu,Gw,Na,Nc,Nd,Ne,Ng,Nb,Nf,Nh,Nk,Nl,No,Np,Nq,Nt,Nu,Nw,Pa,Pb,Pc,Pd,Pe,Pf,Pg,Ph,Pk,Pl,Pm,Pn,Po,Pp,Pq,Pr,Ps,Pu,Pv,Pw,Px,Py,Pz,Sa,Sb,Sc,Sd,Se,Sf,Sg,Sh,Sk,Sl,So,Sp,Sq,Su,Sw,Ta,Tb,Tc,Td,Te,Tf,Tg,Th,Ti,Tk,Tl,To,Tp,Tq,Tt,Tu,Tw,Va,Vb,Vc,Vd,Ve,Vf,Vg,Vh,Vk,Vl,Vo,Vp,Vq,Vs,Vu,Vv,Vw,Wa,Wb,Wc,Wd,We,Wf,Wg,Wh,Wk,Wl,Wo,Wp,Wq,Wu,Ww,Ya,Yb,Yc,Yd,Ye,Yf,Yg,Yh,Yk,Yl,Yo,Yp,Yq,Yr,Ys,Yu,Yw,Si,St,Bt,Ct,Et,Ht,It,Jt,Kt,Lt,Pt,Rt,Ut,Vt,Wt,Yt,Gy,Gx,Gz,Hi,j9,.0,.1,.2,.3,.4,.5,.6,.7,.8,.9,fi,Gs,Ns,ti,dt,ft,Kb,Kh,Kk,Kf,Kl,T♥,&J,Fÿ,Pÿ,Gÿ,Bł,Cł,Dł,Eł,Gł,Hł,Kł,Lł,Nł,Pł,Tł,Ył,Bø,Cø,Dø,Eø,Fø,Gø,Nø,Pø,Sø,Tø,Vø,Wø,Yø")
slot_combo_second = Panel("Ba,Bb,Bc,Bd,Be,Bg,Bh,Bi,Bf,Bk,Bl,Bo,Bp,Bq,Bt,Bu,Bw,Ca,Cb,Cd,Cc,Ce,Cf,Cg,Ch,Ci,Ck,Cl,Co,Cp,Cq,Ct,Cu,Cw,Da,Db,Dc,Dd,De,Df,Dg,Dh,Di,Dk,Dl,Do,Dp,Dq,Dt,Du,Dw,Ea,Eb,Ec,Ed,Ee,Ef,Eg,Eh,Ei,Ek,El,Eo,Ep,Eq,Et,Eu,Ew,Fa,Fb,Fc,Fd,Fe,Fh,Ff,Fg,Fi,Fj,Fk,Fl,Fm,Fn,Fo,Fp,Fq,Fr,Fs,Ft,Fu,Fv,Fw,Fx,Fy,Fz,Ga,Gb,Gc,Gd,Ge,Gf,Gg,Gh,Gi,Gk,Gl,Go,Gp,Gq,Gt,Gu,Gw,Na,Nc,Nd,Ne,Ng,Nb,Nf,Nh,Nk,Nl,No,Np,Nq,Nt,Nu,Nw,Pa,Pb,Pc,Pd,Pe,Pf,Pg,Ph,Pk,Pl,Pm,Pn,Po,Pp,Pq,Pr,Ps,Pu,Pv,Pw,Px,Py,Pz,Sa,Sb,Sc,Sd,Se,Sf,Sg,Sh,Sk,Sl,So,Sp,Sq,Su,Sw,Ta,Tb,Tc,Td,Te,Tf,Tg,Th,Ti,Tk,Tl,To,Tp,Tq,Tt,Tu,Tw,Va,Vb,Vc,Vd,Ve,Vf,Vg,Vh,Vk,Vl,Vo,Vp,Vq,Vs,Vu,Vv,Vw,Wa,Wb,Wc,Wd,We,Wf,Wg,Wh,Wk,Wl,Wo,Wp,Wq,Wu,Ww,Ya,Yb,Yc,Yd,Ye,Yf,Yg,Yh,Yk,Yl,Yo,Yp,Yq,Yr,Ys,Yu,Yw,Si,St,Bt,Ct,Et,Ht,It,Jt,Kt,Lt,Pt,Rt,Ut,Vt,Wt,Yt,Gy,Gx,Gz,Hi,j9,.0,.1,.2,.3,.4,.5,.6,.7,.8,.9,fi,Gs,Ns,ti,dt,ft,Kb,Kh,Kk,Kf,Kl,T♥,&J,Fÿ,Pÿ,Gÿ,Bł,Cł,Dł,Eł,Gł,Hł,Kł,Lł,Nł,Pł,Tł,Ył,Bø,Cø,Dø,Eø,Fø,Gø,Nø,Pø,Sø,Tø,Vø,Wø,Yø")
addition_schemes = Panel("""Loops Top (2.5mm)
Finite Stone Addition
Loops Mid (2.5mm)
Loop Left (3mm)""")
kerning_groups = Panel("""a=àáâãäåæăąǻǽ
c=çćĉċč
e=èéêëēĕėęě
d=ðďđþ
o=òóôõöōŏőœ
u=ùúûüũūŭůűų
y=ỳýŷÿ
n=ñńņňŋ
g=ĝğġģ
l=ĺļľŀ
w=ẁẃẅŵ
s=śŝşšș
r=ŕŗř
t=ţťŧț
z=żž
h=ĥħ
j=ĵ
k=ķ
A=ÀÁÂÃÄÅÆĂĄǺǼ
C=ÇĆĈĊČ
E=ÈÉÊËĒĔĖĘĚ
I=ÌÍÎÏĨĪĬĮ
D=ÐĎĐÞ
O=ÒÓÔÕÖØŌŎŐŒǾ
U=ÙÚÛÜŨŪŬŮŰŲ
Y=ỲÝŶŸ
N=ÑŃŅŇŊ
G=ĜĞĠĢ
L=ĹĻĽĿŁ
W=ẀẂẄŴ
S=ŚŜŞŠȘ
R=ŔŖŘ
T=ŢŤŦȚ
Z=ŻŽ
H=ĤĦ
J=Ĵ
K=Ķ""")
feature_pool = Panel("""Curled Last Letter
Embedded Stone
Offset Slots""")
sizes_artcam_to_rhino = Panel("""6    = 8.3
7.5  = 10.3
9.5  = 13
11.2 = 15.3""")
slot_extensions = Slider(0.3, range=0.001..2)
offset_distance = Slider(0.12, range=0.001..2)
text_split = TextSplit(Text=slot_combo_second, Separators=",")
text_split_2 = TextSplit(Text=slot_combo_first, Separators=",")
finites_alternatives = Panel("ò,ó,ö,ø,o,s,b,O,t")
alternatives_second_1 = Panel("Dr,Gr,Gs,Ns,Nr,Tr,Ts,Wr,Sr,Br,&s,♥r,♥s,a',c',e',g',i',j',m',n',o',p',q',r',s',u',v',w',x',y',z',ÿ'")
curled_letters = Panel("a,b,c,d,e,f,g,h,i,j,k,l,m,n,o,p,q,r,s,t,u,v,w,x,y,z")
alternatives_first_1 = Panel("dt,fb,fh,ff,fk,fl,pf,fp,qf,tf,ft,xf,zg,mh,ht,hu,xh,zh,Jf,Jj,Jp,qj,Kb,Kf,Kh,Kk,Kl,Kt,xk,Lb,Lc,Lf,Lh,Li,Lí,Lı,Lì,Lï,Lk,Ll,nl,Lp,Lt,Lu,Lw,xl,zl,nk,qp,zp,tb,tl,lt,tt,xt,xu,Xb,xb,xe,Xf,xg,Xh,Xk,Xl,xp,Xt,xw,zt,zw,zj,nt,ni,Aj,An,Am,Ar,As,Av,Ax,Ay,Az,Hb,Hf,Hh,Hk,Hl,Hp,Ht,Ib,If,Ih,Ii,Ij,Ik,Il,Ip,It,Jb,Jh,Ji,Jk,Jl,La,Ld,Le,Lg,Lh,Lo,Lr,Mt,Nj,Nm,Nn,Nv,Nx,Ny,Nz,Qj,Qm,Qn,Qr,Qs,Qv,Qx,Qy,Qz,Rj,Rm,Rn,Rr,Rs,Rv,Rx,Ry,Rz,Tj,Tm,Tn,Tx,Ty,Tz,Vj,Vm,Vn,Vx,Vy,Vz,Wj,Wm,Wn,Wv,Wx,Wy,Wz,Ws,Yj,Ym,Yn,Yv,Yx,Yy,Yz,Zm,Zn,Zv,Zr,Zy,Zz,Zs,Zx,jt,tk,tp,yj,zf,Vr,f&,t&,H♥,'a,'c,'e,'g,'i,'j,'m,'n,'o,'p,'q,'r,'s,'u,'v,'w,'x,'y,'z,a9,b1,b2,b3,b4,b5,b6,b7,b9,d5,f0,f1,h1,h9,o5,t2,&m,&n,&r,&s,&v,&y,&z,-9,Là,Lá,Lä,Lå,Lò,Ló,Lö,Lø,Jì,Jí,Jï,Lù,Lú,Lü,hù,hú,hü,xù,xú,xü,Lè,Lé,Lë,Lê,xè,xé,xë,xê,AL,AC,AD,AE,AG,AQ,ID,IG,II,IQ,IU,IW,JD,JG,JL,JQ,JX,JY,KD,KF,KI,KJ,KL,LA,LI,LJ,LK,LL,LM,LN,LO,LQ,LS,LX,ME,MG,OG,aD,aQ,cC,cD,cG,cI,cU,cV,cW,eC,eD,eG,eV,jC,lC,pC,pD,pG,qI,qJ,qV,tQ,tX,vD,vL,vQ,vY,wL,wQ,xC,xD,xG,xY,Aÿ,Nÿ,Qÿ,Rÿ,Zÿ,ÿj,&ÿ")
main = Script(
    PRESET=preset,
    FONT=base_font_name,
    VARIANT=font_variant,
    ADDITION_SCHEMES=addition_schemes,
    FEATURE_POOL=feature_pool,
    SIZES=sizes_artcam_to_rhino)  # -> out, font_art_size, font_rhino_size, port, curled_last_letter, first_letter_embedded_stone, offset_slots, port_2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; inputs FONT: String, VARIANT: String, ADDITION_SCHEMES: list of String, FEATURE_POOL: list of String, SIZES: list of String
# ---------- main: Python ----------
def add_preset(preset_name, 
    font_size, 
    defined_features,
    stone_type,
    loop_scheme_index,
    add_stone_scheme_index
    ):

    preset_map[preset_name] = {}
    print("f", font_size)
    preset_map[preset_name]["font_size"] = font_size if font_size in available_sizes else "0"
    preset_map[preset_name]["stone_type"] = stone_type
    preset_map[preset_name]["loop_scheme_index"] = loop_scheme_index
    preset_map[preset_name]["add_stone_scheme_index"] = add_stone_scheme_index

    preset_map[preset_name]["features"] = {}
    for feature in FEATURE_POOL:
        included = False if not feature in defined_features else True

        preset_map[preset_name]["features"][feature] = included

def get_size_map():
    size_map = {}

    for line in SIZES:
        str_sizes = line.split("=")
        art_size = str_sizes[0].strip()
        rhi_size = str_sizes[1].strip()
        size_map[art_size] = rhi_size

    return size_map


size_map = get_size_map()
available_sizes = list(size_map.keys())
print("\nAVAILABLE SIZES: ", available_sizes)
preset_map = {}

# ===============================================================================
# PRESETS
# ===============================================================================
add_preset(
    preset_name="DEFAULT", 
    font_size= "6",
    defined_features = [],
    stone_type = None,
    loop_scheme_index = 0,
    add_stone_scheme_index = None,
    )

add_preset(
    preset_name="TEST", 
    font_size= "11.2",
    defined_features = [],
    stone_type = None,
    loop_scheme_index = 0,
    add_stone_scheme_index = None,
    )

#region CNC
add_preset(
    preset_name="CNC_9.5", 
    font_size= "9.5",
    defined_features = [],
    stone_type = None,
    loop_scheme_index = 0,
    add_stone_scheme_index = None,
    )

add_preset(
    preset_name="CNC_9.5_CURL", 
    font_size= "9.5",
    defined_features = ["Curled Last Letter"],
    stone_type = None,
    loop_scheme_index = 0,
    add_stone_scheme_index = None,
    )

add_preset(
    preset_name="CNC_11.2", 
    font_size= "11.2",
    defined_features = [],
    stone_type = None,
    loop_scheme_index = 0,
    add_stone_scheme_index = None,
    )

add_preset(
    preset_name="CNC_11.2_LEFT-LOOP", 
    font_size= "11.2",
    defined_features = [],
    stone_type = None,
    loop_scheme_index = 3,
    add_stone_scheme_index = None,
    )


add_preset(
    preset_name="CNC_11.2_EMBED-DIA", 
    font_size= "11.2",
    defined_features = ["Embedded Stone"],
    stone_type = "DIAMOND",
    loop_scheme_index = 0,
    add_stone_scheme_index = None,
    )

add_preset(
    preset_name="CNC_11.2_CURL", 
    font_size= "11.2",
    defined_features = ["Curled Last Letter"],
    stone_type = None,
    loop_scheme_index = 0,
    add_stone_scheme_index = None,
    )

add_preset(
    preset_name="CNC_11.2_CURL_EMBED-DIA", 
    font_size= "11.2",
    defined_features = ["Curled Last Letter", "Embedded Stone"],
    stone_type = "DIAMOND",
    loop_scheme_index = 0,
    add_stone_scheme_index = None,
    )

add_preset(
    preset_name="CNC_11.2_CURL_MID-LOOPS", 
    font_size= "11.2",
    defined_features = ["Curled Last Letter"],
    stone_type = None,
    loop_scheme_index = 2,
    add_stone_scheme_index = None,
    )
#endregion

#region LC
add_preset(
    preset_name="LC_6", 
    font_size= "6",
    defined_features = ["Offset Slots"],
    stone_type = None,
    loop_scheme_index = 0,
    add_stone_scheme_index = None,
    )

add_preset(
    preset_name="LC_6_CURL", 
    font_size= "6",
    defined_features = ["Offset Slots", "Curled Last Letter"],
    stone_type = None,
    loop_scheme_index = 0,
    add_stone_scheme_index = None,
    )

add_preset(
    preset_name="LC_6_LEFT-LOOP", 
    font_size= "6",
    defined_features = ["Offset Slots"],
    stone_type = None,
    loop_scheme_index = 3,
    add_stone_scheme_index = None,
    )

add_preset(
    preset_name="LC_7.5", 
    font_size= "7.5",
    defined_features = ["Offset Slots"],
    stone_type = None,
    loop_scheme_index = 0,
    add_stone_scheme_index = None,
    )

add_preset(
    preset_name="LC_7.5_CURL", 
    font_size= "7.5",
    defined_features = ["Offset Slots", "Curled Last Letter"],
    stone_type = None,
    loop_scheme_index = 0,
    add_stone_scheme_index = None,
    )

add_preset(
    preset_name="LC_7.5_SQUASHED", 
    font_size= "7.5",
    defined_features = ["Offset Slots"],
    stone_type = None,
    loop_scheme_index = 0,
    add_stone_scheme_index = None,
    )


add_preset(
    preset_name="LC_9.5_EMBED-DIA", 
    font_size= "9.5",
    defined_features = ["Offset Slots", "Embedded Stone"],
    stone_type = "DIAMOND",
    loop_scheme_index = 0,
    add_stone_scheme_index = None,
    )

add_preset(
    preset_name="LC_9.5_EMBED-SQR", 
    font_size= "9.5",
    defined_features = ["Offset Slots", "Embedded Stone"],
    stone_type = "SQUARE",
    loop_scheme_index = 0,
    add_stone_scheme_index = None,
    )

add_preset(
    preset_name="LC_9.5_CURL", 
    font_size= "9.5",
    defined_features = ["Offset Slots", "Curled Last Letter"],
    stone_type = None,
    loop_scheme_index = 0,
    add_stone_scheme_index = None,
    )


add_preset(
    preset_name="LC_9.5_CURL_EMBED-SQR", 
    font_size= "9.5",
    defined_features = ["Offset Slots", "Embedded Stone", "Curled Last Letter"],
    stone_type = "SQUARE",
    loop_scheme_index = 0,
    add_stone_scheme_index = None,
    )

add_preset(
    preset_name="LC_9.5_CURL_ADD-SQR", 
    font_size= "9.5",
    defined_features = ["Offset Slots", "Curled Last Letter"],
    stone_type = "SQUARE",
    loop_scheme_index = 0,
    add_stone_scheme_index = 1,
    )

add_preset(
    preset_name="LC_9.5_CURL_MID-LOOPS", 
    font_size= "9.5",
    defined_features = ["Offset Slots", "Curled Last Letter"],
    stone_type = None,
    loop_scheme_index = 2,
    add_stone_scheme_index = None,
    )


add_preset(
    preset_name="LC_11.2", 
    font_size= "11.2",
    defined_features = ["Offset Slots"],
    stone_type = None,
    loop_scheme_index = 0,
    add_stone_scheme_index = None,
    )

add_preset(
    preset_name="LC_11.2_CURL", 
    font_size= "11.2",
    defined_features = ["Offset Slots", "Curled Last Letter"],
    stone_type = None,
    loop_scheme_index = 0,
    add_stone_scheme_index = None,
    )

add_preset(
    preset_name="LC_11.2_ADD-SQR",
    font_size= "11.2",
    defined_features = ["Offset Slots"],
    stone_type = "SQUARE",
    loop_scheme_index = 0,
    add_stone_scheme_index = 1,
    )



#endregion

# ===============================================================================
# CURRENT PRESET
# ===============================================================================

current_preset = preset_map[PRESET]

font_art_size = current_preset["font_size"]
font_rhino_size = size_map[font_art_size]

curled_last_letter = current_preset["features"]["Curled Last Letter"]
first_letter_embedded_stone = current_preset["features"]["Embedded Stone"]
offset_slots = current_preset["features"]["Offset Slots"]

stone_type = current_preset["stone_type"]
loop_scheme_index = current_preset["loop_scheme_index"]
add_stone_scheme_index = current_preset["add_stone_scheme_index"]
# ---------- end main ----------
missing_glyph_width = Slider(5, range=0.001..50)
finites = TextSplit(Text=finites_alternatives, Separators=",")
alternatives_s = TextSplit(Text=alternatives_second_1, Separators=",")
alternatives_f = TextSplit(Text=alternatives_first_1, Separators=",")
curled = TextSplit(Text=curled_letters, Separators=",")
missing_glyph = Geometry([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])

# ----
finite_stone_addition_json = Text("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")
loops_top_2_5mm_json = Text("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")
loops_mid_2_5mm_json = Text("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")
loop_left_3mm_json = Text("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")

loop_2_5_mm = Geometry([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])
loop_2_5_mm_2 = Geometry([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])
stone_socket = Geometry([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])
loop_3_mm = Geometry([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])

pivot = Point(Point(-0.001367726116, -1.198283957, 0))
pivot_2 = Point(Point(-0.001367726116, -1.198283957, 0))
pivot_3 = Point(Point(-0.001367726116, -1.198283957, 0))
pivot_4 = Point(Point(-0.9416121665, 0.007583721396, 0))

entwine = Entwine(
    Branch00=loops_top_2_5mm_json,
    Branch01=finite_stone_addition_json,
    Branch02=loops_mid_2_5mm_json,
    Branch03=loop_left_3mm_json,
    FlattenInputs=True)
entwine_2 = Entwine(Branch00=pivot, Branch01=pivot_4, Branch02=pivot_2, Branch03=pivot_3, FlattenInputs=True)
entwine_3 = Entwine(Branch00=loop_2_5_mm, Branch01=stone_socket, Branch02=loop_2_5_mm_2, Branch03=loop_3_mm, FlattenInputs=True)
add_stone_scheme_index = Panel(main.add_stone_scheme_index)
loop_scheme_index = Panel(main.loop_scheme_index)
addition_components_filter = Script(scheme_index=loop_scheme_index, JSONS=entwine, GEOS=entwine_3, PIVOTS=entwine_2)  # -> out, simplify(addition_json), simplify(addition_geo), simplify(addition_pivot); inputs JSONS: tree of String, GEOS: tree of GeometryBase, PIVOTS: tree of Point3d
# ---------- addition_components_filter: Python ----------
addition_json = None
addition_geo = []
addition_pivot = None

out = []


# ------------------------------------------------------------
# HELPERS
# ------------------------------------------------------------

def get_branch(tree, index):
    if tree is None:
        return []

    if index is None:
        return []

    try:
        index = int(index)
    except:
        return []

    if index < 0:
        return []

    if index >= tree.BranchCount:
        return []

    return list(tree.Branch(index))


def first_or_none(items):
    if not items:
        return None

    return items[0]


# ------------------------------------------------------------
# ADDITION SCHEME
# ------------------------------------------------------------

print("scheme index: ", scheme_index)

addition_json_branch = get_branch(
    JSONS,
    scheme_index
)

addition_geo_branch = get_branch(
    GEOS,
    scheme_index
)

addition_pivot_branch = get_branch(
    PIVOTS,
    scheme_index
)


addition_json = first_or_none(
    addition_json_branch
)

addition_geo = addition_geo_branch

addition_pivot = first_or_none(
    addition_pivot_branch
)
# ---------- end addition_components_filter ----------
addition_components_filter_2 = Script(scheme_index=add_stone_scheme_index, JSONS=entwine, GEOS=entwine_3, PIVOTS=entwine_2)  # -> out, simplify(addition_json), simplify(addition_geo), simplify(addition_pivot); inputs JSONS: tree of String, GEOS: tree of GeometryBase, PIVOTS: tree of Point3d; same code as addition_components_filter

# ---- group: ignore
slots_json = Text("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")

font_json = Text("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")

# ---- group: INSCRIPTIONS
inscription_1 = DirectTextInput(maxlength=9, text="Anna")
inscription_2 = DirectTextInput(maxlength=9, text="James")
inscription_3 = DirectTextInput(maxlength=9)
inscription_5 = DirectTextInput(maxlength=9)
inscription_4 = DirectTextInput(maxlength=9)

# ----
panel = Panel([inscription_1, inscription_2, inscription_3, inscription_4, inscription_5])
inscriptions = Script(inscriptions=panel, PRESET=preset, stone_type=main.stone_type, loop_scheme_index=main.loop_scheme_index)  # -> out, count, multi_loop_flag, single_loop_flag, stone_type, text1, text2, text3, text4, text5; inputs inscriptions: list of String, PRESET: String, stone_type: String, loop_scheme_index: Int32
# ---------- inscriptions: Python ----------
# Clean inscriptions
inscriptions = [s.strip() for s in inscriptions if s.strip()]

# Always capitalize first letter
def cap_first_let(text):
    if not text:
        return ""
    
    lets = [l for l in text]
    lets[0] = lets[0].upper()
    result = ''.join(lets)
    return result

inscriptions = [cap_first_let(s) for s in inscriptions]

count = len(inscriptions)

text1 = inscriptions[0] if count > 0 else ""
text2 = inscriptions[1] if count > 1 else ""
text3 = inscriptions[2] if count > 2 else ""
text4 = inscriptions[3] if count > 3 else ""
text5 = inscriptions[4] if count > 4 else ""


# ==============================
# NECKLACE TYPE
# ==============================
if "LEFT" in PRESET or "RIGHT" in PRESET:
    single_loop_flag = True
    multi_loop_flag = False
else:
    single_loop_flag = False
    multi_loop_flag = True


# ==============================
# 3D STONE TYPE
# ==============================
if stone_type == "DIAMOND":
    stone_type = 1
elif stone_type == "SQUARE":
    stone_type = 2
else:
    stone_type = 0
# ---------- end inscriptions ----------
text_2 = Panel(inscriptions.text2)
text_4 = Panel(inscriptions.text4)
text_5 = Panel(inscriptions.text5)
text_3 = Panel(inscriptions.text3)
text_1 = Panel(inscriptions.text1)
text_length = TextLength(Text=text_2)
text_length_2 = TextLength(Text=text_3)
text_length_3 = TextLength(Text=text_5)
text_length_4 = TextLength(Text=text_1)
text_length_5 = TextLength(Text=text_4)
inscription = INSCRIPTION(
    enable=text_length_4,
    text=text_1,
    curl_at_the_end=main.curled_last_letter,
    stone_on_first_letter=main.first_letter_embedded_stone,
    offset_slot=main.offset_slots,
    jsontext=font_json,
    height=main.font_rhino_size,
    alternativesfirst=alternatives_f,
    alternativessecond=alternatives_s,
    finites=finites,
    curled=curled,
    overridevalue=override_value,
    kerninggroups=kerning_groups,
    missingwidth=missing_glyph_width,
    missingcurve=missing_glyph,
    fontjson=font_json,
    height_2=main.font_rhino_size,
    stone_type=main.stone_type,
    slotjson=slots_json,
    combosfirst=text_split_2,
    combossecond=text_split,
    extension=slot_extensions,
    offsetdistance=offset_distance,
    loop_json=addition_components_filter.addition_json,
    loop_geo=addition_components_filter.addition_geo,
    loop_pivot=addition_components_filter.addition_pivot,
    stone_json=addition_components_filter_2.addition_json,
    stone_geo=addition_components_filter_2.addition_geo,
    stone_pivot=addition_components_filter_2.addition_pivot)  # -> inner_2, outer_2, glyph_slots_2, offset_slots_2, offset_letter_slots_2, loops_3, stones_2, breps, glyphnames, loops_info_2
inscription_6 = INSCRIPTION(
    enable=text_length,
    text=text_2,
    curl_at_the_end=main.curled_last_letter,
    stone_on_first_letter=main.first_letter_embedded_stone,
    offset_slot=main.offset_slots,
    jsontext=font_json,
    height=main.font_rhino_size,
    alternativesfirst=alternatives_f,
    alternativessecond=alternatives_s,
    finites=finites,
    curled=curled,
    overridevalue=override_value,
    kerninggroups=kerning_groups,
    missingwidth=missing_glyph_width,
    missingcurve=missing_glyph,
    fontjson=font_json,
    height_2=main.font_rhino_size,
    stone_type=main.stone_type,
    slotjson=slots_json,
    combosfirst=text_split_2,
    combossecond=text_split,
    extension=slot_extensions,
    offsetdistance=offset_distance,
    loop_json=addition_components_filter.addition_json,
    loop_geo=addition_components_filter.addition_geo,
    loop_pivot=addition_components_filter.addition_pivot,
    stone_json=addition_components_filter_2.addition_json,
    stone_geo=addition_components_filter_2.addition_geo,
    stone_pivot=addition_components_filter_2.addition_pivot)  # -> inner_2, outer_2, glyph_slots_2, offset_slots_2, offset_letter_slots_2, loops_3, stones_2, breps, glyphnames, loops_info_2
inscription_7 = INSCRIPTION(
    enable=text_length_5,
    text=text_4,
    curl_at_the_end=main.curled_last_letter,
    stone_on_first_letter=main.first_letter_embedded_stone,
    offset_slot=main.offset_slots,
    jsontext=font_json,
    height=main.font_rhino_size,
    alternativesfirst=alternatives_f,
    alternativessecond=alternatives_s,
    finites=finites,
    curled=curled,
    overridevalue=override_value,
    kerninggroups=kerning_groups,
    missingwidth=missing_glyph_width,
    missingcurve=missing_glyph,
    fontjson=font_json,
    height_2=main.font_rhino_size,
    stone_type=main.stone_type,
    slotjson=slots_json,
    combosfirst=text_split_2,
    combossecond=text_split,
    extension=slot_extensions,
    offsetdistance=offset_distance,
    loop_json=addition_components_filter.addition_json,
    loop_geo=addition_components_filter.addition_geo,
    loop_pivot=addition_components_filter.addition_pivot,
    stone_json=addition_components_filter_2.addition_json,
    stone_geo=addition_components_filter_2.addition_geo,
    stone_pivot=addition_components_filter_2.addition_pivot)  # -> inner_2, outer_2, glyph_slots_2, offset_slots_2, offset_letter_slots_2, loops_3, stones_2, breps, glyphnames, loops_info_2
inscription_8 = INSCRIPTION(
    enable=text_length_2,
    text=text_3,
    curl_at_the_end=main.curled_last_letter,
    stone_on_first_letter=main.first_letter_embedded_stone,
    offset_slot=main.offset_slots,
    jsontext=font_json,
    height=main.font_rhino_size,
    alternativesfirst=alternatives_f,
    alternativessecond=alternatives_s,
    finites=finites,
    curled=curled,
    overridevalue=override_value,
    kerninggroups=kerning_groups,
    missingwidth=missing_glyph_width,
    missingcurve=missing_glyph,
    fontjson=font_json,
    height_2=main.font_rhino_size,
    stone_type=main.stone_type,
    slotjson=slots_json,
    combosfirst=text_split_2,
    combossecond=text_split,
    extension=slot_extensions,
    offsetdistance=offset_distance,
    loop_json=addition_components_filter.addition_json,
    loop_geo=addition_components_filter.addition_geo,
    loop_pivot=addition_components_filter.addition_pivot,
    stone_json=addition_components_filter_2.addition_json,
    stone_geo=addition_components_filter_2.addition_geo,
    stone_pivot=addition_components_filter_2.addition_pivot)  # -> inner_2, outer_2, glyph_slots_2, offset_slots_2, offset_letter_slots_2, loops_3, stones_2, breps, glyphnames, loops_info_2
inscription_9 = INSCRIPTION(
    enable=text_length_3,
    text=text_5,
    curl_at_the_end=main.curled_last_letter,
    stone_on_first_letter=main.first_letter_embedded_stone,
    offset_slot=main.offset_slots,
    jsontext=font_json,
    height=main.font_rhino_size,
    alternativesfirst=alternatives_f,
    alternativessecond=alternatives_s,
    finites=finites,
    curled=curled,
    overridevalue=override_value,
    kerninggroups=kerning_groups,
    missingwidth=missing_glyph_width,
    missingcurve=missing_glyph,
    fontjson=font_json,
    height_2=main.font_rhino_size,
    stone_type=main.stone_type,
    slotjson=slots_json,
    combosfirst=text_split_2,
    combossecond=text_split,
    extension=slot_extensions,
    offsetdistance=offset_distance,
    loop_json=addition_components_filter.addition_json,
    loop_geo=addition_components_filter.addition_geo,
    loop_pivot=addition_components_filter.addition_pivot,
    stone_json=addition_components_filter_2.addition_json,
    stone_geo=addition_components_filter_2.addition_geo,
    stone_pivot=addition_components_filter_2.addition_pivot)  # -> inner_2, outer_2, glyph_slots_2, offset_slots_2, offset_letter_slots_2, loops_3, stones_2, breps, glyphnames, loops_info_2

# ---- group: 3D PARAMETERS
flat_inscriptions = BooleanToggle(False)
enable_3d_chain = BooleanToggle(True)
_3d_preview = BooleanToggle(True)

# ----
_3d_preview_2 = GetBoolean(_3d_preview, AtLeast=1, AtMost=1, FalseValue="False", TreeAccess=False, TrueValue="True")
flat_inscriptions_2 = GetBoolean(flat_inscriptions, AtLeast=1, AtMost=1, FalseValue="False", TreeAccess=False, TrueValue="True")
_3d_preview_3 = _3DPREVIEW(
    enable=_3d_preview_2,
    flat=flat_inscriptions_2,
    inner_crvs=inscription.inner_2,
    outline_crv=inscription.outer_2,
    offset_slots=inscription.offset_slots_2,
    offset_letter_slots=inscription.offset_letter_slots_2,
    loop=inscription.loops_3,
    stones=inscription.stones_2)  # -> _3d_preview_3, left_connection_2, right_connection_2
_3d_preview_4 = _3DPREVIEW(
    enable=_3d_preview_2,
    flat=flat_inscriptions_2,
    inner_crvs=inscription_6.inner_2,
    outline_crv=inscription_6.outer_2,
    offset_slots=inscription_6.offset_slots_2,
    offset_letter_slots=inscription_6.offset_letter_slots_2,
    loop=inscription_6.loops_3,
    stones=inscription_6.stones_2)  # -> _3d_preview_3, left_connection_2, right_connection_2
_3d_preview_5 = _3DPREVIEW(
    enable=_3d_preview_2,
    flat=flat_inscriptions_2,
    inner_crvs=inscription_8.inner_2,
    outline_crv=inscription_8.outer_2,
    offset_slots=inscription_8.offset_slots_2,
    offset_letter_slots=inscription_8.offset_letter_slots_2,
    loop=inscription_8.loops_3,
    stones=inscription_8.stones_2)  # -> _3d_preview_3, left_connection_2, right_connection_2
_3d_preview_6 = _3DPREVIEW(
    enable=_3d_preview_2,
    flat=flat_inscriptions_2,
    inner_crvs=inscription_7.inner_2,
    outline_crv=inscription_7.outer_2,
    offset_slots=inscription_7.offset_slots_2,
    offset_letter_slots=inscription_7.offset_letter_slots_2,
    loop=inscription_7.loops_3,
    stones=inscription_7.stones_2)  # -> _3d_preview_3, left_connection_2, right_connection_2
_3d_preview_7 = _3DPREVIEW(
    enable=_3d_preview_2,
    flat=flat_inscriptions_2,
    inner_crvs=inscription_9.inner_2,
    outline_crv=inscription_9.outer_2,
    offset_slots=inscription_9.offset_slots_2,
    offset_letter_slots=inscription_9.offset_letter_slots_2,
    loop=inscription_9.loops_3,
    stones=inscription_9.stones_2)  # -> _3d_preview_3, left_connection_2, right_connection_2
enable_3d_chain_2 = GetBoolean(enable_3d_chain, AtLeast=1, AtMost=1, FalseValue="False", TreeAccess=False, TrueValue="True")

right_connections = Geometry([_3d_preview_3.right_connection_2, _3d_preview_4.right_connection_2, _3d_preview_5.right_connection_2, _3d_preview_6.right_connection_2, _3d_preview_7.right_connection_2])
left_connections = Geometry([_3d_preview_3.left_connection_2, _3d_preview_4.left_connection_2, _3d_preview_5.left_connection_2, _3d_preview_6.left_connection_2, _3d_preview_7.left_connection_2])
previews = Geometry([_3d_preview_3._3d_preview_3, _3d_preview_4._3d_preview_3, _3d_preview_5._3d_preview_3, _3d_preview_6._3d_preview_3, _3d_preview_7._3d_preview_3])
stones = Geometry([inscription.stones_2, inscription_6.stones_2, inscription_8.stones_2, inscription_7.stones_2, inscription_9.stones_2])

diamond_gap = Slider(3, range=0..10)

# ---- group: ignore
stone_socket_addition = Geometry()
stone_socket_addition_2 = Geometry(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)
stone_addition = Geometry(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)
stone_addition_2 = Geometry(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)
entwine_4 = Entwine(Branch00=stone_addition, Branch01=stone_socket_addition, FlattenInputs=True)
entwine_5 = Entwine(Branch00=stone_addition_2, Branch01=stone_socket_addition_2, FlattenInputs=True)
stream_filter = StreamFilter(Gate=inscriptions.stone_type, Stream1=entwine_4, Stream2=entwine_5)
explode_tree = ExplodeTree(Data=stream_filter)  # -> Branch0, Branch1
stone_socket_addition_3 = Geometry(explode_tree.Branch1)
stone_addition_3 = Geometry(explode_tree.Branch0)

# ----
diamond_gap_2 = Slider(3, range=0..10)
diamond_gap_3 = Slider(8.9, range=0..10)
heart_pendant = Geometry(flatten(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))

# ---- group: DIAMOND TYPE
diamond_type = Slider(4, range=1..4)
diamond_gap_4 = Slider(3, range=0..10)
diamond_a_small = Geometry([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])
diamond_a_big = Geometry([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])
diamond_b = Geometry([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])
filter = StreamFilter(Gate=diamond_type, Stream1=diamond_a_small, Stream2=diamond_a_big, Stream3=diamond_b, Stream4=heart_pendant)
filter_2 = StreamFilter(Gate=diamond_type, Stream1=diamond_gap_4, Stream2=diamond_gap, Stream3=diamond_gap_2, Stream4=diamond_gap_3)
enable_diamond = BooleanToggle(True)
diamond_geos = Geometry(filter)

# ----
not_null = Script(items=flatten(right_connections))  # -> items; inputs items: list of Point3d; same code as not_null
not_null_2 = Script(items=flatten(left_connections))  # -> items; inputs items: list of Point3d; same code as not_null

# ---- group: MULTI NAME (2 LOOPS) NECKLACE MAKER
single_name_addition_distance = Slider(20, range=0..100)
single_name_diamond_side = Slider(0, range=0..1)
allow_single_name_addition = BooleanToggle(True)

chain_lift_for_single_name = Slider(50, range=1..50)
necklace_depth = Slider(184, range=0..1000)
chain_length = Slider(276, range=0..1000)
chain_tail = Slider(30, range=0..50)
samples = Slider(100, range=0..500)
link_pitch = Slider(1.2, range=0..10)
name_count = Number(inscriptions.count)

# ----
chain_smoothness = Slider(1, range=0..3)
addition_weight = Slider(1, range=0..3)
gravitystrength = Slider(0.88, range=0..1)
iterations = Slider(44, range=0..100)
smooth_chain = BooleanToggle(True)
gravity = BooleanToggle(True)

# ---- group: MULTI NAME (2 LOOPS) NECKLACE MAKER
connection_link = Geometry(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)
chain_link = Geometry(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)

# ----
boolean = Boolean(inscriptions.multi_loop_flag)
link_geometry = Geometry(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)

# ---- group: MULTI NAME (SINGLE LOOP) NECKLACE MAKER
space_between_names = Slider(5, range=0..100)
chain_tail_2 = Slider(10, range=0..100)
chain_rise = Slider(20, range=0..50)
samples_2 = Slider(60, range=0..100)
link_pitch_2 = Slider(0.2, range=0.01..16)
loop_points = Point(not_null)
previews_2 = Geometry(previews)
multi_name_single_loop_necklace_maker = MULTINAMESINGLELOOPNECKLACEMAKER(
    enable=inscriptions.single_loop_flag,
    allow_3d=_3d_preview_2,
    enable_chain_generation=enable_3d_chain_2,
    previews=previews_2,
    looppoints=loop_points,
    namespacing=space_between_names,
    previewtaillength=chain_tail_2,
    chainrise=chain_rise,
    samples=samples_2,
    linkgeometry=link_geometry,
    linkpitch=link_pitch_2,
    connectionlinkgeometry=link_geometry)  # -> previews_4, chain_2

# ---- group: MULTI NAME (2 LOOPS) NECKLACE MAKER
multi_name_2_loops_necklace_maker = MULTINAME2LOOPSNECKLACEMAKER(
    enable=boolean,
    allow_3d=_3d_preview_2,
    enable_chain_generation=enable_3d_chain_2,
    preview_geos=previews,
    left_pivots=not_null_2,
    right_pivots=not_null,
    stones=stones,
    stone_addition=stone_addition_3,
    stone_socket_addition=stone_socket_addition_3,
    enable_diamond=enable_diamond,
    diamond_geo=diamond_geos,
    addition_gap=filter_2,
    connectionlinkgeometry=connection_link,
    linkgeometry=chain_link,
    gravity=gravity,
    gravitystrength=gravitystrength,
    iterations=iterations,
    addition_weight=addition_weight,
    smoothchain=smooth_chain,
    chainsmoothness=chain_smoothness,
    totallength=chain_length,
    chain_tail=chain_tail,
    chain_lift=chain_lift_for_single_name,
    namecount=name_count,
    linkpitch=link_pitch,
    necklace_depth=necklace_depth,
    necklace_samples=samples,
    allow_single_name_addition=allow_single_name_addition,
    single_name_diamond_side=single_name_diamond_side,
    single_name_addition_distance=single_name_addition_distance)  # -> name_geos_2, chain_geos_2, diamonds_preview_2, flatten(diamonds_sockets_preview_2)

# ---- group: COATING
coating = ValueList({"SR": 1, "GP": 2, "VMGP": 3, "RGP": 4, "VMRGP": 5}, selected="SR")
vmrgp = ColourSwatch(SwatchColor=RGB(235, 189, 168))
vmgp = ColourSwatch(SwatchColor=RGB(225, 219, 120))
rgp = ColourSwatch(SwatchColor=RGB(217, 148, 118))
gp = ColourSwatch(SwatchColor=RGB(255, 198, 94))
sr = ColourSwatch(SwatchColor=RGB(170, 170, 170))
filter_3 = StreamFilter(Gate=coating, Stream1=sr, Stream2=gp, Stream3=vmgp, Stream4=rgp, Stream5=vmrgp)

# ---- group: STONE COLOR
stone_color = ValueList({"JANUARY": 1, "FEBRUARY": 2, "MARCH": 3, "APRIL": 4, "MAY": 5, "JUNE": 6, "JULY": 7, "AUGUST": 8, "SEPTEMBER": 9, "OCTOBER": 10, "NOVEMBER": 11, "DECEMBER": 12, "DIAMOND": 13}, selected="DIAMOND")
november = ColourSwatch(SwatchColor=RGB(245, 201, 44))
september = ColourSwatch(SwatchColor=RGB(47, 60, 255))
december = ColourSwatch(SwatchColor=RGB(17, 171, 209))
february = ColourSwatch(SwatchColor=RGB(162, 27, 255))
diamond = ColourSwatch(SwatchColor=RGB(227, 227, 227))
october = ColourSwatch(SwatchColor=RGB(242, 61, 97))
january = ColourSwatch(SwatchColor=RGB(161, 18, 18))
august = ColourSwatch(SwatchColor=RGB(173, 230, 61))
march = ColourSwatch(SwatchColor=RGB(63, 119, 186))
april = ColourSwatch(SwatchColor=RGBA(230, 230, 230, 182))
june = ColourSwatch(SwatchColor=RGB(240, 175, 175))
may = ColourSwatch(SwatchColor=RGB(68, 199, 83))
july = ColourSwatch(SwatchColor=RGB(224, 52, 52))
filter_4 = StreamFilter(
    Gate=stone_color,
    Stream1=january,
    Stream2=february,
    Stream3=march,
    Stream4=april,
    Stream5=may,
    Stream6=june,
    Stream7=july,
    Stream8=august,
    Stream9=september,
    Stream10=october,
    Stream11=november,
    Stream12=december,
    Stream13=diamond)

# ---- group: METAL MATERIAL
roughness_factor = Slider(0.7, range=0.001..1)
metalic_factor = Slider(0.5, range=0.001..1)
value_list = ValueList({"OPAQUE", "BLEND", "MASK"}, selected="OPAQUE")
metallicroughnesstexture = Bitmap(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)
double_sided = BooleanToggle(True)
emissive_factor = ColourSwatch(SwatchColor=RGB(0, 0, 0))
basecolortexture = Bitmap(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)
normaltexture = Bitmap(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)
gltf_2_0_material = GlTF20Material(
    BaseColorFactor=filter_3,
    BaseColorTexture=basecolortexture,
    MetallicFactor=metalic_factor,
    RoughnessFactor=roughness_factor,
    MetallicRoughnessTexture=metallicroughnesstexture,
    NormalTexture=normaltexture,
    EmissiveFactor=emissive_factor,
    AlphaMode=value_list,
    AlphaCutoff=Slider(0.5, range=0.01..1),
    DoubleSided=double_sided)

# ---- group: STONE MATERIAL
roughness_factor_2 = Slider(0.001, range=0.001..1)
metalic_factor_2 = Slider(0.001, range=0.001..1)
value_list_2 = ValueList({"OPAQUE", "BLEND", "MASK"}, selected="BLEND")
double_sided_2 = BooleanToggle(False)
emissive_factor_2 = ColourSwatch(SwatchColor=RGB(54, 54, 54))
basecolortexture_2 = Bitmap(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)
normaltexture_2 = Bitmap(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)
gltf_2_0_material_2 = GlTF20Material(
    BaseColorFactor=filter_4,
    BaseColorTexture=basecolortexture_2,
    MetallicFactor=metalic_factor_2,
    RoughnessFactor=roughness_factor_2,
    NormalTexture=normaltexture_2,
    EmissiveFactor=emissive_factor_2,
    AlphaMode=value_list_2,
    AlphaCutoff=Slider(0.5, range=0.01..1),
    DoubleSided=double_sided_2)

# ----
colour_swatch = ColourSwatch(SwatchColor=RGB(255, 255, 255))
not_null_3 = Script(items=flatten([multi_name_2_loops_necklace_maker.diamonds_sockets_preview_2, multi_name_single_loop_necklace_maker.previews_4, multi_name_single_loop_necklace_maker.chain_2, multi_name_2_loops_necklace_maker.name_geos_2, multi_name_2_loops_necklace_maker.chain_geos_2]))  # -> items; inputs items: list; same code as not_null
not_null_4 = Script(items=flatten(multi_name_2_loops_necklace_maker.diamonds_preview_2))  # -> items; inputs items: list; same code as not_null
metal_display = GlTF20Display(Geometry=not_null_3, Material=gltf_2_0_material)
stone_display = GlTF20Display(Geometry=not_null_4, Material=gltf_2_0_material_2)

# ==== cluster INSCRIPTION
enable = ClusterInput()
text = ClusterInput()
curl_at_the_end = ClusterInput()
stone_on_first_letter = ClusterInput()
offset_slot = ClusterInput()
jsontext = ClusterInput()
height = ClusterInput()
alternativesfirst = ClusterInput()
alternativessecond = ClusterInput()
finites = ClusterInput()
curled = ClusterInput()
overridevalue = ClusterInput()
kerninggroups = ClusterInput()
missingwidth = ClusterInput()
missingcurve = ClusterInput()
fontjson = ClusterInput()
height_2 = ClusterInput()
stone_type = ClusterInput()
slotjson = ClusterInput()
combosfirst = ClusterInput()
combossecond = ClusterInput()
extension = ClusterInput()
offsetdistance = ClusterInput()
loop_json = ClusterInput()
loop_geo = ClusterInput()
loop_pivot = ClusterInput()
stone_json = ClusterInput()
stone_geo = ClusterInput()
stone_pivot = ClusterInput()
enable_2 = Boolean(enable)
stone_on_first_letter_2 = Boolean(stone_on_first_letter)
enable_3 = BooleanToggle(True)
curl_at_the_end_2 = Boolean(curl_at_the_end)
font_assembly = Script(
    Enable=enable_2,
    Curl=curl_at_the_end_2,
    StoneFirst=stone_on_first_letter_2,
    Text=text,
    JsonText=jsontext,
    Height=height,
    AlternativesFirst=alternativesfirst,
    AlternativesSecond=alternativessecond,
    Finites=finites,
    Curled=curled,
    OverrideValue=overridevalue,
    KerningGroups=kerninggroups,
    MissingWidth=missingwidth,
    MissingCurve=missingcurve)  # -> out, PivotPoints, Curves, Slots, Stones, Missing, GlyphNames, GlyphCurves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; inputs Enable: Boolean, Curl: Boolean, StoneFirst: Boolean, Text: String, JsonText: String, Height: Double, AlternativesFirst: list of String, AlternativesSecond: list of String, Finites: list of String, Curled: list of String, OverrideValue: Double, KerningGroups: list of String, MissingWidth: Double, MissingCurve: list of Curve
# ---------- font_assembly: Python ----------
import json

import Rhino.Geometry as rg
from Grasshopper import DataTree
from Grasshopper.Kernel.Data import GH_Path
import System


# ============================================================
# EXPECTED GRASSHOPPER INPUTS
# ============================================================
#
# Enable              : bool      Item
# Text                : str       Item
# JsonText            : str       Item
# Height              : float     Item
#
# AlternativesFirst   : str       List
# AlternativesSecond  : str       List
# Finites             : str       List
# Curled              : str       List
# Curl                : bool      Item
# StoneFirst          : bool      Item
#   Stone target priority: first i, otherwise first j, otherwise first glyph.
# KerningGroups       : str       List
#
# OverrideValue       : float     Item
#
# MissingCurve        : Curve     List
#   Internalized replacement geometry for missing glyphs.
#   Geometry must be drawn in SOURCE FONT units,
#   centered around X=0, with baseline Y=0.
#
# MissingWidth        : float     Item
#   Width in SOURCE FONT UNITS used when a glyph is missing.
#
#
# OUTPUTS
# ============================================================
#
# PivotPoints
# Curves
# Slots
# Stones
# Missing
# GlyphNames
# InheritanceNames
# GlyphCurves
# GlyphSlots
# GlyphStones
# Info
#
# ============================================================


Curves = []
Slots = []
Stones = []

GlyphCurves = DataTree[System.Object]()
GlyphSlots = DataTree[System.Object]()
GlyphStones = DataTree[System.Object]()

PivotPoints = []

Missing = []
GlyphNames = []
InheritanceNames = []

Info = ""


# ============================================================
# HELPERS
# ============================================================

def parse_json(value):

    if value is None:
        return None

    value = str(value).strip()

    if not value:
        return None

    return json.loads(value)


def parse_kerning_groups(value):

    if value is None:
        return {}

    if isinstance(value, str):
        raw_items = [value]
    else:
        try:
            raw_items = list(value)
        except:
            raw_items = [value]

    result = {}

    for item in raw_items:

        if item is None:
            continue

        text = str(item)
        text = text.replace("\r", "\n")

        for line in text.split("\n"):

            line = line.strip()

            if not line:
                continue

            if "=" not in line:
                continue

            main_char, variants = line.split(
                "=",
                1
            )

            main_char = main_char.strip()
            variants = variants.strip()

            if len(main_char) != 1:
                continue

            cleaned = []

            for ch in variants:

                if ch == main_char:
                    continue

                if ch not in cleaned:
                    cleaned.append(ch)

            result[main_char] = "".join(
                cleaned
            )

    return result


def resolve_live_kerning_groups(
    json_data,
    live_value,
):

    live_groups = parse_kerning_groups(
        live_value
    )

    if live_groups:
        return live_groups

    stored = json_data.get(
        "kerning_groups",
        {}
    )

    if isinstance(
        stored,
        dict
    ):
        return stored

    return {}


def normalize_tokens(value):

    if value is None:
        return set()

    if isinstance(value, str):

        text = value.replace(
            "\r",
            "\n"
        )

        text = text.replace(
            "\n",
            ","
        )

        raw_items = text.split(",")

    else:

        try:
            raw_items = list(value)
        except:
            raw_items = [value]

    result = set()

    for item in raw_items:

        if item is None:
            continue

        token = str(item).strip()

        token = token.replace(
            "\r",
            "\n"
        )

        token = token.replace(
            "\n",
            ","
        )

        for part in token.split(","):

            part = part.strip()

            if part:
                result.add(part)

    return result


def deserialize_nurbs_curve(data):

    points = data["points"]

    degree = int(
        data["degree"]
    )

    order = degree + 1

    rational = bool(
        data.get(
            "is_rational",
            False
        )
    )

    point_count = len(
        points
    )

    crv = rg.NurbsCurve(
        3,
        rational,
        order,
        point_count,
    )

    for i, item in enumerate(
        points
    ):

        point = rg.Point3d(
            float(item["x"]),
            float(item["y"]),
            float(
                item.get(
                    "z",
                    0.0
                )
            ),
        )

        weight = float(
            item.get(
                "weight",
                1.0
            )
        )

        crv.Points.SetPoint(
            i,
            point,
            weight,
        )

    knots = data["knots"]

    if len(knots) != crv.Knots.Count:

        raise RuntimeError(
            "Knot-count mismatch. JSON={} Rhino={}".format(
                len(knots),
                crv.Knots.Count,
            )
        )

    for i, value in enumerate(
        knots
    ):

        crv.Knots[i] = float(
            value
        )

    return crv


def transform_curve(
    curve,
    scale,
    pivot_x,
):

    crv = curve.DuplicateCurve()

    if abs(
        scale - 1.0
    ) > 1e-12:

        crv.Transform(
            rg.Transform.Scale(
                rg.Point3d.Origin,
                scale,
            )
        )

    crv.Transform(
        rg.Transform.Translation(
            float(pivot_x),
            0.0,
            0.0,
        )
    )

    return crv


def choose_glyph_names(
    text,
    characters,
    alternatives_first,
    alternatives_second,
    finites,
    curled,
    curl_enabled,
    stone_first,
):
    """
    Return two parallel lists:

        result
            Actual glyphs to DRAW.

        inheritance_names
            Glyph identities used as fallback for slots/stones
            and pair-based data.

    When StoneFirst is True, choose ONE stone glyph using:

        1. first "i" in the text
        2. otherwise first "j"
        3. otherwise the first character

    If that position used AlternativesFirst, use *_stone_alt.
    Otherwise use *_stone.

    The stone glyph inherits from whatever glyph would have been used
    at that position before the stone substitution.
    """

    if not text:
        return [], []

    result = [
        ch for ch in text
    ]

    used_alternative_first = [
        False for _ in text
    ]

    # --------------------------------------------------------
    # PAIR-DRIVEN ALTERNATES
    # --------------------------------------------------------

    for i in range(
        len(text) - 1
    ):

        left = text[i]
        right = text[i + 1]

        pair = (
            left
            + right
        )

        if pair in alternatives_first:

            candidate = (
                left
                + "1"
            )

            if candidate in characters:

                result[i] = candidate

                used_alternative_first[i] = True

        if pair in alternatives_second:

            candidate = (
                right
                + "1"
            )

            if candidate in characters:

                result[i + 1] = candidate

    # --------------------------------------------------------
    # LAST GLYPH
    #
    # CURL HAS PRIORITY OVER FINITE
    # --------------------------------------------------------

    last_index = (
        len(text)
        - 1
    )

    last_char = text[
        last_index
    ]

    curl_was_used = False

    if (
        curl_enabled
        and last_char in curled
    ):

        candidate = (
            last_char
            + "_curl"
        )

        if candidate in characters:

            result[
                last_index
            ] = candidate

            curl_was_used = True

    if (
        not curl_was_used
        and last_char in finites
    ):

        candidate = (
            "_"
            + last_char
        )

        if candidate in characters:

            result[
                last_index
            ] = candidate

    # --------------------------------------------------------
    # INHERITANCE SNAPSHOT
    # --------------------------------------------------------

    inheritance_names = list(
        result
    )

    # --------------------------------------------------------
    # STONE TARGET
    #
    # Priority:
    #   i -> j -> first character
    #
    # Stone is applied LAST so it has final priority at the
    # selected position.
    # --------------------------------------------------------

    if (
        stone_first
        and len(text) > 0
    ):

        stone_index = 0

        if "i" in text:

            stone_index = text.index(
                "i"
            )

        elif "j" in text:

            stone_index = text.index(
                "j"
            )

        stone_char = text[
            stone_index
        ]

        if used_alternative_first[
            stone_index
        ]:

            candidate = (
                stone_char
                + "_stone_alt"
            )

        else:

            candidate = (
                stone_char
                + "_stone"
            )

        if candidate in characters:

            result[
                stone_index
            ] = candidate

    return (
        result,
        inheritance_names
    )


def pair_key(
    left_id,
    right_id,
):
    """
    Backward-compatible kerning key.

    Normal one-character kerning identities keep the existing numeric
    Unicode key format, e.g. i+a -> "105|97".

    Named special glyph identities use readable keys, e.g.
    i+a_curl -> "i|a_curl".
    """

    left_id = str(left_id)
    right_id = str(right_id)

    if len(left_id) == 1 and len(right_id) == 1:
        return (
            str(ord(left_id))
            + "|"
            + str(ord(right_id))
        )

    return left_id + "|" + right_id


def get_kerning_groups(data):

    try:

        return resolve_live_kerning_groups(
            data,
            KerningGroups
        )

    except:

        stored = data.get(
            "kerning_groups",
            {}
        )

        return (
            stored
            if isinstance(
                stored,
                dict
            )
            else {}
        )


def get_canonical_char(
    data,
    ch,
):

    groups = get_kerning_groups(
        data
    )

    if ch in groups:
        return ch

    for main_char, variants in groups.items():

        if ch in str(
            variants
        ):
            return main_char

    return ch


def get_kerning_aliases(data):
    """
    Optional explicit named-glyph aliases stored in JSON.

    Example:
        "kerning_aliases": {
            "a1": "a"
        }

    The script also has the simple built-in conventions used by this
    font system:
        a1  -> a
        _o  -> o

    Named special variants such as a_curl / a_square are NOT aliased
    automatically, so they receive their own kerning identity.
    """

    aliases = data.get(
        "kerning_aliases",
        {}
    )

    return aliases if isinstance(
        aliases,
        dict
    ) else {}


def get_kerning_id(
    data,
    glyph_name,
    original_char=None,
):
    """
    Resolve the kerning identity for the ACTUAL glyph being drawn.

    Examples:
        a       -> a
        à       -> a          via KerningGroups
        a1      -> a          normal alternate
        à1      -> a          normal alternate + KerningGroups
        _o      -> o          finite/final variation
        a_curl  -> a_curl     unique kerning
        a_square-> a_square   unique kerning
    """

    name = str(
        glyph_name or ""
    )

    aliases = get_kerning_aliases(
        data
    )

    if name in aliases:
        alias = str(
            aliases[name]
        )

        if len(alias) == 1:
            return get_canonical_char(
                data,
                alias
            )

        return alias

    # Single Unicode glyph: use the existing character groups.
    if len(name) == 1:
        return get_canonical_char(
            data,
            name
        )

    # Normal pair alternate: a1 -> a, à1 -> a.
    if name.endswith("1") and len(name) > 1:
        base = name[:-1]

        if len(base) == 1:
            return get_canonical_char(
                data,
                base
            )

    # Finite/final form: _o -> o, _à -> a.
    if name.startswith("_") and len(name) > 1:
        base = name[1:]

        if len(base) == 1:
            return get_canonical_char(
                data,
                base
            )

    # Any other named glyph is intentionally unique.
    # a_curl, a_square, etc. land here.
    return name


def get_pair_spacing(
    data,
    left_glyph_name,
    right_glyph_name,
    left_original_char=None,
    right_original_char=None,
):
    """
    Resolve kerning from the ACTUAL selected glyphs.

    Normal variants collapse to their shared identity.
    Special named variants keep their own identity.

    Existing Unicode pairs remain fully backward compatible.
    """

    pairs = data.get(
        "pairs",
        {}
    )

    left_id = get_kerning_id(
        data,
        left_glyph_name,
        left_original_char
    )

    right_id = get_kerning_id(
        data,
        right_glyph_name,
        right_original_char
    )

    item = pairs.get(
        pair_key(
            left_id,
            right_id
        )
    )

    if item is not None:
        return float(
            item.get(
                "raw_spacing",
                0.0
            )
        )

    # Special named variants inherit the base pair only when NO
    # dedicated pair has been defined yet. This makes a newly-created
    # a_curl usable immediately, while allowing its own kerning later.
    #
    # For the base fallback we use the original input characters,
    # canonicalized by the existing Unicode KerningGroups.
    if (
        left_original_char is not None
        and right_original_char is not None
    ):
        base_left = get_canonical_char(
            data,
            str(left_original_char)
        )

        base_right = get_canonical_char(
            data,
            str(right_original_char)
        )

        base_item = pairs.get(
            pair_key(
                base_left,
                base_right
            )
        )

        if base_item is not None:
            return float(
                base_item.get(
                    "raw_spacing",
                    0.0
                )
            )

    return 0.0


def get_glyph_geometry_role(
    glyph,
    role,
):

    geometry = glyph.get(
        "geometry",
        {}
    )

    if not isinstance(
        geometry,
        dict
    ):
        return []

    values = geometry.get(
        role,
        []
    )

    return (
        values
        if isinstance(
            values,
            list
        )
        else []
    )


def get_glyph_geometry_role_with_fallback(
    glyph,
    fallback_glyph,
    role,
):
    """
    Exact glyph data wins whenever the role key exists.

    If the exact StoneFirst glyph does not define the role at all,
    inherit it from the non-stone glyph it replaced.

    An explicitly present empty list counts as an override and blocks
    inheritance.
    """

    geometry = glyph.get("geometry", {}) if isinstance(glyph, dict) else {}

    if isinstance(geometry, dict) and role in geometry:
        values = geometry.get(role, [])
        return values if isinstance(values, list) else []

    if fallback_glyph is not None:
        return get_glyph_geometry_role(fallback_glyph, role)

    return []


def add_geometry_role_to_outputs(
    curve_data_list,
    scale,
    pivot_x,
    flat_output,
    tree_output,
    glyph_path,
):

    for curve_data in curve_data_list:

        source_curve = deserialize_nurbs_curve(
            curve_data
        )

        placed = transform_curve(
            source_curve,
            scale,
            pivot_x,
        )

        flat_output.append(
            placed
        )

        tree_output.Add(
            placed,
            glyph_path
        )


def normalize_curve_input(value):

    if value is None:
        return []

    try:
        items = list(value)
    except:
        items = [value]

    curves = []

    for item in items:

        if isinstance(
            item,
            rg.Curve
        ):

            curves.append(
                item.DuplicateCurve()
            )

    if not curves:
        return []

    # --------------------------------------------------------
    # FIND COMBINED BOUNDING BOX
    # --------------------------------------------------------

    bbox = rg.BoundingBox.Unset

    for curve in curves:

        current = curve.GetBoundingBox(
            True
        )

        if not bbox.IsValid:
            bbox = current
        else:
            bbox.Union(
                current
            )

    if not bbox.IsValid:
        return curves

    # --------------------------------------------------------
    # NORMALIZE MISSING SYMBOL
    #
    # X:
    #   center geometry around X = 0
    #
    # Y:
    #   put bottom of geometry on baseline Y = 0
    # --------------------------------------------------------

    center_x = (
        float(bbox.Min.X)
        + float(bbox.Max.X)
    ) * 0.5

    bottom_y = float(
        bbox.Min.Y
    )

    transform = rg.Transform.Translation(
        -center_x,
        -bottom_y,
        0.0
    )

    result = []

    for curve in curves:

        curve.Transform(
            transform
        )

        result.append(
            curve
        )

    return result


def place_missing_geometry(
    curves,
    scale,
    pivot_x,
    flat_output,
    tree_output,
    glyph_path,
):
    """
    MissingCurve is stored in SOURCE FONT units.

    It is:
        1. scaled exactly like normal glyph geometry
        2. translated to the missing-character pivot
    """

    scale_transform = rg.Transform.Scale(
        rg.Point3d.Origin,
        float(scale)
    )

    move_transform = rg.Transform.Translation(
        float(pivot_x),
        0.0,
        0.0
    )

    for curve in curves:

        dup = curve.DuplicateCurve()

        if abs(
            scale - 1.0
        ) > 1e-12:

            dup.Transform(
                scale_transform
            )

        dup.Transform(
            move_transform
        )

        flat_output.append(
            dup
        )

        tree_output.Add(
            dup,
            glyph_path
        )


# ============================================================
# MAIN
# ============================================================

if not Enable:

    Info = "Set Enable = True."


elif not JsonText:

    Info = "JsonText is empty."


elif Text is None:

    Info = "Text is None."


elif Height is None or Height <= 0:

    Info = (
        "Height must be greater than 0."
    )


else:

    try:

        # ----------------------------------------------------
        # LOAD FONT
        # ----------------------------------------------------

        data = parse_json(
            JsonText
        )

        if data is None:

            raise RuntimeError(
                "Could not parse JsonText."
            )

        if data.get(
            "format"
        ) != "rhino-curve-font-v2":

            raise RuntimeError(
                "Expected rhino-curve-font-v2 JSON."
            )

        characters = data.get(
            "characters",
            {}
        )

        missing_curves = normalize_curve_input(
            MissingCurve
        )

        # ----------------------------------------------------
        # SETTINGS
        # ----------------------------------------------------

        alternatives_first = normalize_tokens(
            AlternativesFirst
        )

        alternatives_second = normalize_tokens(
            AlternativesSecond
        )

        finites = normalize_tokens(
            Finites
        )

        curled = normalize_tokens(
            Curled
            )

        # ----------------------------------------------------
        # SCALE
        # ----------------------------------------------------

        source_reference_height = float(
            data[
                "font"
            ][
                "source_reference_height"
            ]
        )

        scale = (
            float(Height)
            / source_reference_height
        )

        # ----------------------------------------------------
        # OVERRIDE VALUE
        # ----------------------------------------------------

        try:

            override_value = float(
                OverrideValue
            )

        except:

            override_value = float(
                data[
                    "font"
                ].get(
                    "override_value",
                    1.0
                )
            )

        # ----------------------------------------------------
        # MISSING CHARACTER WIDTH
        # ----------------------------------------------------

        try:

            missing_width = float(
                MissingWidth
            )

            if missing_width < 0:
                missing_width = 0.0

        except:

            missing_width = (
                source_reference_height
                * 0.5
            )

        # ----------------------------------------------------
        # RESOLVE ACTUAL GLYPH NAMES
        # ----------------------------------------------------

        GlyphNames, InheritanceNames = choose_glyph_names(
            Text,
            characters,
            alternatives_first,
            alternatives_second,
            finites,
            curled,
            Curl,
            StoneFirst,
        )

        # ----------------------------------------------------
        # STONE TARGET INFO
        # ----------------------------------------------------

        stone_target_index = None
        stone_target_char = None

        if (
            bool(StoneFirst)
            and Text
        ):

            if "i" in Text:

                stone_target_index = Text.index(
                    "i"
                )

            elif "j" in Text:

                stone_target_index = Text.index(
                    "j"
                )

            else:

                stone_target_index = 0

            stone_target_char = Text[
                stone_target_index
            ]

        # ----------------------------------------------------
        # BUILD LAYOUT
        # ----------------------------------------------------

        layout = []

        for glyph_index, glyph_name in enumerate(GlyphNames):

            glyph = characters.get(
                glyph_name
            )

            inheritance_name = InheritanceNames[glyph_index]
            fallback_glyph = characters.get(inheritance_name)

            if glyph is None:

                if glyph_name not in Missing:

                    Missing.append(
                        glyph_name
                    )

                layout.append({
                    "glyph": None,
                    "fallback_glyph": fallback_glyph,
                    "width": missing_width,
                    "missing": True,
                })

            else:

                layout.append({
                    "glyph": glyph,
                    "fallback_glyph": fallback_glyph,
                    "width": float(
                        glyph["width"]
                    ),
                    "missing": False,
                })

        # ----------------------------------------------------
        # PLACE GLYPHS
        # ----------------------------------------------------

        pivot_x = 0.0

        placed_count = 0
        missing_count = 0

        for i, item in enumerate(
            layout
        ):

            glyph = item[
                "glyph"
            ]

            fallback_glyph = item.get(
                "fallback_glyph"
            )

            is_missing = item[
                "missing"
            ]

            # ------------------------------------------------
            # PIVOT
            # ------------------------------------------------

            PivotPoints.append(
                rg.Point3d(
                    float(pivot_x),
                    0.0,
                    0.0
                )
            )

            glyph_path = GH_Path(
                i
            )

            # ------------------------------------------------
            # DRAW GLYPH / MISSING MARKER
            # ------------------------------------------------

            if not is_missing:

                add_geometry_role_to_outputs(
                    get_glyph_geometry_role(
                        glyph,
                        "base"
                    ),
                    scale,
                    pivot_x,
                    Curves,
                    GlyphCurves,
                    glyph_path,
                )

                add_geometry_role_to_outputs(
                    get_glyph_geometry_role_with_fallback(
                        glyph,
                        fallback_glyph,
                        "_slots"
                    ),
                    scale,
                    pivot_x,
                    Slots,
                    GlyphSlots,
                    glyph_path,
                )

                add_geometry_role_to_outputs(
                    get_glyph_geometry_role_with_fallback(
                        glyph,
                        fallback_glyph,
                        "_stones"
                    ),
                    scale,
                    pivot_x,
                    Stones,
                    GlyphStones,
                    glyph_path,
                )

                placed_count += 1

            else:

                missing_count += 1

                place_missing_geometry(
                    missing_curves,
                    scale,
                    pivot_x,
                    Curves,
                    GlyphCurves,
                    glyph_path,
                )

            # ------------------------------------------------
            # MOVE TO NEXT GLYPH
            # ------------------------------------------------

            if i >= len(
                layout
            ) - 1:

                continue

            next_item = layout[
                i + 1
            ]

            current_width = float(
                item["width"]
            )

            next_width = float(
                next_item["width"]
            )

            # ------------------------------------------------
            # KERNING
            #
            # Missing glyph behaves like a space:
            # no pair kerning on either side.
            # ------------------------------------------------

            if (
                item["missing"]
                or next_item["missing"]
            ):

                raw_spacing = 0.0

            else:

                raw_spacing = get_pair_spacing(
                    data,
                    GlyphNames[i],
                    GlyphNames[i + 1],
                    Text[i],
                    Text[i + 1],
                )

            pivot_x += (
                (
                    current_width * 0.5
                    + raw_spacing * override_value
                    + next_width * 0.5
                )
                * scale
            )

        # ----------------------------------------------------
        # INFO
        # ----------------------------------------------------

        Info = (
            "TEXT: {}\n"
            "GLYPHS: {}\n"
            "INHERITANCE GLYPHS: {}\n"
            "HEIGHT: {}\n"
            "SOURCE REFERENCE HEIGHT: {}\n"
            "SCALE: {}\n"
            "MISSING WIDTH: {}\n"
            "MISSING CURVES: {}\n"
            "PLACED GLYPHS: {}\n"
            "MISSING GLYPHS: {}\n"
            "CURVES: {}\n"
            "SLOTS: {}\n"
            "STONES: {}\n"
            "MISSING: {}\n"
            "ALTERNATIVES FIRST: {}\n"
            "ALTERNATIVES SECOND: {}\n"
            "FINITES: {}\n"
            "CURLED: {}\n"
            "CURL ENABLED: {}\n"
            "STONE FIRST: {}\n"
            "STONE TARGET INDEX: {}\n"
            "STONE TARGET CHAR: {}\n"
            "KERNING GROUPS: {}"
        ).format(
            Text,
            ", ".join(
                GlyphNames
            ),
            ", ".join(
                InheritanceNames
            ),
            Height,
            source_reference_height,
            scale,
            missing_width,
            len(missing_curves),
            placed_count,
            missing_count,
            len(Curves),
            len(Slots),
            len(Stones),
            repr(Missing),
            sorted(
                alternatives_first
            ),
            sorted(
                alternatives_second
            ),
            sorted(
                finites
            ),
            sorted(
                curled
            ),
            bool(Curl),
            bool(StoneFirst),
            stone_target_index,
            stone_target_char,
            get_kerning_groups(
                data
            ),
        )

    except Exception as ex:

        print(ex)

        Info = (
            "ERROR:\n{}"
        ).format(
            ex
        )
# ---------- end font_assembly ----------
flip_curve = FlipCurve(Curve=font_assembly.GlyphCurves, Guide=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)  # -> Curve, Flag
min_area = Slider(0.2, range=0.0001..5)
inner_outer = Script(crvs=flatten(flip_curve.Curve))  # -> out, flatten(inner), flatten(outer); inputs crvs: list of Curve
# ---------- inner_outer: Python ----------
import Rhino.Geometry as rg


if not crvs:
    crvs = []

inner = []
outer = []

tol = 0.001


for i, crv_a in enumerate(crvs):

    is_inner = False

    for j, crv_b in enumerate(crvs):

        if i == j:
            continue

        relation = rg.Curve.PlanarClosedCurveRelationship(
            crv_a,
            crv_b,
            rg.Plane.WorldXY,
            tol
        )

        # crv_a is inside crv_b
        if relation == rg.RegionContainment.AInsideB:
            is_inner = True
            break

    if is_inner:
        inner.append(crv_a)
    else:
        outer.append(crv_a)
# ---------- end inner_outer ----------

enable_4 = BooleanToggle(True)
offset_slot_2 = Boolean(offset_slot)
pair_slots = Script(
    Enable=enable_2,
    LetterSlots=font_assembly.GlyphSlots,
    FontJson=fontjson,
    SlotJson=slotjson,
    OffsetSlot=offset_slot_2,
    CombosFirst=combosfirst,
    CombosSecond=combossecond,
    Extension=extension,
    Tolerance=0.01,
    OffsetDistance=offsetdistance,
    Outlines=inner_outer.outer,
    GlyphNames=font_assembly.GlyphNames,
    InheritanceNames=font_assembly.InheritanceNames)  # -> out, GlyphSlots, OffsetSlots, OffsetLetterSlots, Info; inputs Enable: Boolean, LetterSlots: list of Curve, FontJson: String, SlotJson: String, OffsetSlot: Boolean, CombosFirst: list of String, CombosSecond: list of String, Extension: Double, OffsetDistance: Double, Outlines: list of Curve, GlyphNames: list of String, InheritanceNames: list of String
# ---------- pair_slots: Python ----------
import json

import Rhino.Geometry as rg
import Rhino.Geometry.Intersect as rgi

from Grasshopper import DataTree
from Grasshopper.Kernel.Data import GH_Path
import System


# ============================================================
# INPUTS
# ============================================================
#
# Enable            : bool  Item
# OffsetSlot        : bool  Item
# CombosFirst       : str   List
# CombosSecond      : str   List
# Extension         : float Item
# Tolerance         : float Item
# OffsetDistance    : float Item
# Outlines          : Curve List
# LetterSlots       : Curve List
# GlyphNames        : str   List
# InheritanceNames  : str   List
#   Same length/order as GlyphNames.
#   Used as fallback pair identities.
#
# Pair naming:
#   f + i        -> fi
#   f + i_curl   -> f|i_curl
#   A_stone + b  -> A_stone|b
#
# FontJson          : str   Item
# SlotJson          : str   Item
#
# OUTPUTS
# ============================================================
# GlyphSlots     : follows OffsetSlot
# OffsetSlots    : pair slots only, always offset
# OffsetLetterSlots : incoming LetterSlots only, always offset
# SlotPairs
# SlotOwners
# Info
# ============================================================


GlyphSlots = DataTree[rg.Curve]()
OffsetSlots = DataTree[rg.Curve]()
OffsetLetterSlots = DataTree[rg.Curve]()
SlotPairs = []
SlotOwners = []
Info = ""


# ============================================================
# BASIC HELPERS
# ============================================================

def parse_json(value):
    if value is None:
        return None
    text = str(value).strip()
    if not text:
        return None
    return json.loads(text)


def normalize_strings(value):
    if value is None:
        return set()

    if isinstance(value, str):
        raw_items = [value]
    else:
        try:
            raw_items = list(value)
        except:
            raw_items = [value]

    result = set()

    for item in raw_items:
        if item is None:
            continue
        text = str(item).replace("\r", "\n").replace("\n", ",")
        for part in text.split(","):
            part = part.strip()
            if part:
                result.add(part)

    return result


def clean_curves(value):
    if value is None:
        return []
    try:
        items = list(value)
    except:
        items = [value]
    return [x for x in items if isinstance(x, rg.Curve)]


def clean_names(value):
    if value is None:
        return []
    try:
        items = list(value)
    except:
        items = [value]
    return [str(x) for x in items]


def clean_letter_slots_preserve_indices(value):
    """
    Return LetterSlots as a flat list WITHOUT removing empty items.

    Index alignment is important:
        LetterSlots[i] belongs to GlyphNames[i].

    Any non-curve item becomes None instead of being removed.
    """
    if value is None:
        return []

    try:
        items = list(value)
    except:
        items = [value]

    result = []

    for item in items:
        if isinstance(item, rg.Curve):
            result.append(item)
            continue

        try:
            unwrapped = item.Value
        except:
            unwrapped = None

        if isinstance(unwrapped, rg.Curve):
            result.append(unwrapped)
        else:
            result.append(None)

    return result


def make_pair_name(left_name, right_name):
    """
    Pair key convention shared with SLOT DESIGNER.

    Ordinary one-character glyphs keep the old compact form:
        f + i -> fi

    Named glyphs use an explicit separator:
        f + i_curl   -> f|i_curl
        A_stone + b  -> A_stone|b
    """

    left_name = str(left_name)
    right_name = str(right_name)

    if (
        len(left_name) == 1
        and len(right_name) == 1
    ):
        return left_name + right_name

    return left_name + "|" + right_name


def get_manual_pairs(slot_data):
    if not isinstance(slot_data, dict):
        return {}
    if slot_data.get("format") != "pair-slot-overrides-v1":
        return {}
    pairs = slot_data.get("pairs", {})
    return pairs if isinstance(pairs, dict) else {}


# ============================================================
# MANUAL SLOT DESERIALIZATION / PLACEMENT
# ============================================================

def deserialize_slot_curve(data):
    points = data["points"]
    degree = int(data["degree"])
    rational = bool(data.get("is_rational", False))

    curve = rg.NurbsCurve(
        3,
        rational,
        degree + 1,
        len(points)
    )

    for i, item in enumerate(points):
        point = rg.Point3d(
            float(item["x"]),
            float(item["y"]),
            float(item.get("z", 0.0))
        )
        weight = float(item.get("weight", 1.0))
        curve.Points.SetPoint(i, point, weight)

    knots = data["knots"]

    if len(knots) != curve.Knots.Count:
        raise RuntimeError("Manual slot knot-count mismatch.")

    for i, value in enumerate(knots):
        curve.Knots[i] = float(value)

    return curve


def get_outline_pivot_x(outline):
    bbox = outline.GetBoundingBox(True)
    if not bbox.IsValid:
        raise RuntimeError("Could not calculate outline bounding box.")
    return (float(bbox.Min.X) + float(bbox.Max.X)) * 0.5


def get_current_glyph_scale(
    outline,
    source_glyph_name,
    font_characters,
):
    """
    source_glyph_name is deliberately the glyph from which the saved
    slot was inherited.  Example:

        actual owner outline = A_stone
        saved slot source    = A

    This is what lets A_stone inherit a slot saved for A.
    """

    glyph = font_characters.get(source_glyph_name)

    if glyph is None:
        raise RuntimeError(
            "Source glyph '{}' is not in FontJson.".format(source_glyph_name)
        )

    source_width = float(glyph.get("width", 0.0))

    if source_width <= 1e-12:
        raise RuntimeError(
            "Source glyph '{}' has invalid width.".format(source_glyph_name)
        )

    bbox = outline.GetBoundingBox(True)

    if not bbox.IsValid:
        raise RuntimeError("Could not calculate placed outline bbox.")

    placed_width = float(bbox.Max.X - bbox.Min.X)

    return placed_width / source_width


def stored_slot_to_world(
    curve_data,
    owner_outline,
    source_owner_name,
    font_characters,
):
    curve = deserialize_slot_curve(curve_data)

    scale = get_current_glyph_scale(
        owner_outline,
        source_owner_name,
        font_characters
    )

    pivot_x = get_outline_pivot_x(owner_outline)

    if abs(scale - 1.0) > 1e-12:
        curve.Transform(
            rg.Transform.Scale(
                rg.Point3d.Origin,
                scale
            )
        )

    curve.Transform(
        rg.Transform.Translation(
            pivot_x,
            0.0,
            0.0
        )
    )

    return curve


# ============================================================
# INTERSECTION HELPERS
# ============================================================

def unique_parameters(values, tolerance):
    if not values:
        return []

    values = sorted(values)
    result = [values[0]]

    for value in values[1:]:
        if abs(value - result[-1]) > tolerance:
            result.append(value)

    return result


def point_inside_curve(point, closed_curve, tolerance):
    containment = closed_curve.Contains(
        point,
        rg.Plane.WorldXY,
        tolerance
    )

    return (
        containment == rg.PointContainment.Inside
        or containment == rg.PointContainment.Coincident
    )


def get_inside_segments(owner, other, tolerance):
    events = rgi.Intersection.CurveCurve(
        owner,
        other,
        tolerance,
        tolerance
    )

    if events is None:
        return []

    parameters = []

    for event in events:
        if event.IsPoint:
            parameters.append(float(event.ParameterA))
        elif event.IsOverlap:
            parameters.append(float(event.OverlapA.T0))
            parameters.append(float(event.OverlapA.T1))

    parameters = unique_parameters(parameters, tolerance * 0.1)

    if len(parameters) < 2:
        return []

    try:
        segments = owner.Split(parameters)
    except:
        return []

    if not segments:
        return []

    result = []

    for segment in segments:
        if segment is None:
            continue

        domain = segment.Domain
        midpoint = segment.PointAt(
            (float(domain.T0) + float(domain.T1)) * 0.5
        )

        if point_inside_curve(midpoint, other, tolerance):
            result.append(segment)

    return result


def get_longest_curve(curves):
    if not curves:
        return None

    longest = None
    longest_length = -1.0

    for curve in curves:
        try:
            length = float(curve.GetLength())
        except:
            continue

        if length > longest_length:
            longest_length = length
            longest = curve

    return longest


# ============================================================
# ARC-LENGTH EXTENSION
# ============================================================

def get_arc_length_to_parameter(curve, parameter):
    domain = curve.Domain

    if parameter <= domain.T0:
        return 0.0

    if parameter >= domain.T1:
        return float(curve.GetLength())

    part = curve.Trim(domain.T0, parameter)
    return 0.0 if part is None else float(part.GetLength())


def parameter_at_arc_length(curve, length):
    total = float(curve.GetLength())
    length = max(0.0, min(float(length), total))

    success, parameter = curve.LengthParameter(length)
    return float(parameter) if success else None


def extend_slot_along_owner(owner, segment, extension, tolerance):
    if segment is None:
        return None

    extension = max(0.0, float(extension))

    if extension <= tolerance:
        return segment.DuplicateCurve()

    success_start, t_start = owner.ClosestPoint(segment.PointAtStart)
    success_end, t_end = owner.ClosestPoint(segment.PointAtEnd)

    if not success_start or not success_end:
        return segment.DuplicateCurve()

    t_start = float(t_start)
    t_end = float(t_end)
    total_length = float(owner.GetLength())

    length_start = get_arc_length_to_parameter(owner, t_start)
    length_end = get_arc_length_to_parameter(owner, t_end)

    if owner.IsClosed:
        segment_length = float(segment.GetLength())
        direct_length = abs(length_end - length_start)
        wrapped_length = total_length - direct_length

        use_wrapped = (
            abs(wrapped_length - segment_length)
            < abs(direct_length - segment_length)
        )

        if use_wrapped:
            if length_start < length_end:
                length_start += total_length
            else:
                length_end += total_length

    forward = length_end >= length_start

    if forward:
        new_start_length = length_start - extension
        new_end_length = length_end + extension
    else:
        new_start_length = length_start + extension
        new_end_length = length_end - extension

    if owner.IsClosed:
        new_start_length %= total_length
        new_end_length %= total_length
    else:
        new_start_length = max(0.0, min(new_start_length, total_length))
        new_end_length = max(0.0, min(new_end_length, total_length))

    new_t_start = parameter_at_arc_length(owner, new_start_length)
    new_t_end = parameter_at_arc_length(owner, new_end_length)

    if new_t_start is None or new_t_end is None:
        return segment.DuplicateCurve()

    if not owner.IsClosed:
        if new_t_start > new_t_end:
            new_t_start, new_t_end = new_t_end, new_t_start

        result = owner.Trim(new_t_start, new_t_end)
        return result if result is not None else segment.DuplicateCurve()

    if new_t_start <= new_t_end:
        result = owner.Trim(new_t_start, new_t_end)
        return result if result is not None else segment.DuplicateCurve()

    part_a = owner.Trim(new_t_start, owner.Domain.T1)
    part_b = owner.Trim(owner.Domain.T0, new_t_end)

    if part_a is None or part_b is None:
        return segment.DuplicateCurve()

    joined = rg.Curve.JoinCurves([part_a, part_b], tolerance)

    if joined and len(joined) > 0:
        return joined[0]

    return segment.DuplicateCurve()


def make_pair_slot(owner, other, extension, tolerance):
    inside_segments = get_inside_segments(owner, other, tolerance)
    segment = get_longest_curve(inside_segments)

    if segment is None:
        return None

    return extend_slot_along_owner(
        owner,
        segment,
        extension,
        tolerance
    )


# ============================================================
# CLOSED ONE-SIDED OFFSET
# ============================================================

def choose_offset_curve(curves):
    if not curves:
        return None

    longest = None
    longest_length = -1.0

    for curve in curves:
        if curve is None:
            continue
        try:
            length = float(curve.GetLength())
        except:
            continue
        if length > longest_length:
            longest_length = length
            longest = curve

    return longest


def align_offset_direction(base_curve, offset_curve):
    if offset_curve is None:
        return None

    result = offset_curve.DuplicateCurve()

    normal_distance = (
        base_curve.PointAtStart.DistanceTo(result.PointAtStart)
        + base_curve.PointAtEnd.DistanceTo(result.PointAtEnd)
    )

    reversed_distance = (
        base_curve.PointAtStart.DistanceTo(result.PointAtEnd)
        + base_curve.PointAtEnd.DistanceTo(result.PointAtStart)
    )

    if reversed_distance < normal_distance:
        result.Reverse()

    return result


def make_round_cap(point_a, point_b, tangent, outward_sign):
    center = rg.Point3d(
        (point_a.X + point_b.X) * 0.5,
        (point_a.Y + point_b.Y) * 0.5,
        (point_a.Z + point_b.Z) * 0.5,
    )

    radius = point_a.DistanceTo(point_b) * 0.5

    if radius <= 1e-12:
        return None

    tangent = rg.Vector3d(tangent)
    tangent.Z = 0.0

    if not tangent.Unitize():
        return None

    middle = center + tangent * radius * float(outward_sign)

    try:
        arc = rg.Arc(point_a, middle, point_b)
        return rg.ArcCurve(arc) if arc.IsValid else None
    except:
        return None


def make_closed_offset_slot(slot_curve, offset_distance, side, tolerance):
    if slot_curve is None:
        return None

    distance = abs(float(offset_distance))

    if distance <= tolerance:
        return slot_curve.DuplicateCurve()

    positive = choose_offset_curve(
        slot_curve.Offset(
            rg.Plane.WorldXY,
            distance,
            tolerance,
            rg.CurveOffsetCornerStyle.Round
        )
    )

    negative = choose_offset_curve(
        slot_curve.Offset(
            rg.Plane.WorldXY,
            -distance,
            tolerance,
            rg.CurveOffsetCornerStyle.Round
        )
    )

    candidates = [c for c in (positive, negative) if c is not None]

    if not candidates:
        return slot_curve.DuplicateCurve()

    success, t = slot_curve.NormalizedLengthParameter(0.5)

    if not success:
        return slot_curve.DuplicateCurve()

    base_point = slot_curve.PointAt(t)
    tangent = slot_curve.TangentAt(t)
    tangent.Z = 0.0

    if not tangent.Unitize():
        return slot_curve.DuplicateCurve()

    left_candidate = None
    right_candidate = None
    left_score = None
    right_score = None

    for candidate in candidates:
        success_cp, candidate_t = candidate.ClosestPoint(base_point)

        if not success_cp:
            continue

        candidate_point = candidate.PointAt(candidate_t)
        vector = candidate_point - base_point
        vector.Z = 0.0

        cross_z = tangent.X * vector.Y - tangent.Y * vector.X

        if cross_z > 0:
            if left_candidate is None or cross_z > left_score:
                left_candidate = candidate
                left_score = cross_z

        elif cross_z < 0:
            if right_candidate is None or cross_z < right_score:
                right_candidate = candidate
                right_score = cross_z

    side = str(side or "right").strip().lower()
    offset_curve = left_candidate if side == "left" else right_candidate

    if offset_curve is None:
        return slot_curve.DuplicateCurve()

    offset_curve = align_offset_direction(slot_curve, offset_curve)

    end_cap = make_round_cap(
        slot_curve.PointAtEnd,
        offset_curve.PointAtEnd,
        slot_curve.TangentAtEnd,
        1.0
    )

    start_cap = make_round_cap(
        offset_curve.PointAtStart,
        slot_curve.PointAtStart,
        slot_curve.TangentAtStart,
        -1.0
    )

    if end_cap is None or start_cap is None:
        return slot_curve.DuplicateCurve()

    reverse_offset = offset_curve.DuplicateCurve()
    reverse_offset.Reverse()

    joined = rg.Curve.JoinCurves(
        [
            slot_curve.DuplicateCurve(),
            end_cap,
            reverse_offset,
            start_cap,
        ],
        tolerance
    )

    if joined and len(joined) > 0:
        return joined[0]

    return slot_curve.DuplicateCurve()


# ============================================================
# PAIR INHERITANCE
# ============================================================

def resolve_lookup_pair(
    actual_first,
    actual_second,
    inherit_first,
    inherit_second,
    manual_pairs,
    combos_first,
    combos_second,
):
    """
    Priority:

      1. Exact manual pair
      2. Inherited manual pair
      3. Exact automatic combo
      4. Inherited automatic combo

    Returns:
        mode, lookup_pair, owner_label, inherited
    """

    actual_pair = make_pair_name(
        actual_first,
        actual_second
    )

    inherited_pair = make_pair_name(
        inherit_first,
        inherit_second
    )

    if isinstance(manual_pairs.get(actual_pair), dict):
        owner = str(manual_pairs[actual_pair].get("owner", "")).lower()
        return "manual", actual_pair, owner, False

    if (
        inherited_pair != actual_pair
        and isinstance(manual_pairs.get(inherited_pair), dict)
    ):
        owner = str(manual_pairs[inherited_pair].get("owner", "")).lower()
        return "manual", inherited_pair, owner, True

    if actual_pair in combos_first:
        return "auto", actual_pair, "first", False

    if actual_pair in combos_second:
        return "auto", actual_pair, "second", False

    if inherited_pair != actual_pair:
        if inherited_pair in combos_first:
            return "auto", inherited_pair, "first", True
        if inherited_pair in combos_second:
            return "auto", inherited_pair, "second", True

    return None, None, None, False


# ============================================================
# AUTOMATIC LETTER SLOT OFFSET SIDE
# ============================================================

def detect_letter_slot_side(slot_curve, outline, tolerance):
    """
    Automatically choose which side of an open standalone LetterSlot
    should be offset.

    We test both closed offset results and choose the one whose
    offset boundary lies more inside the glyph outline.

    This avoids a manual left/right input.
    """

    if slot_curve is None or outline is None:
        return "right"

    distance_test = max(
        float(tolerance) * 5.0,
        0.001
    )

    candidates = {}

    for side in ("left", "right"):
        try:
            closed = make_closed_offset_slot(
                slot_curve,
                distance_test,
                side,
                tolerance
            )
        except:
            closed = None

        if closed is None:
            continue

        try:
            success, t = closed.NormalizedLengthParameter(0.5)
            if not success:
                continue

            p = closed.PointAt(t)

            containment = outline.Contains(
                p,
                rg.Plane.WorldXY,
                tolerance
            )

            # Prefer the side whose offset lies inside/coincident
            # with the glyph outline.
            score = 0

            if containment == rg.PointContainment.Inside:
                score = 2
            elif containment == rg.PointContainment.Coincident:
                score = 1

            candidates[side] = score

        except:
            continue

    if not candidates:
        return "right"

    left_score = candidates.get("left", -1)
    right_score = candidates.get("right", -1)

    return "left" if left_score > right_score else "right"


# ============================================================
# MAIN
# ============================================================

if not Enable:
    Info = "Set Enable = True."

else:
    try:
        outlines = clean_curves(Outlines)
        glyph_names = clean_names(GlyphNames)
        inheritance_names = clean_names(InheritanceNames)
        letter_slots = clean_letter_slots_preserve_indices(
            LetterSlots
        )

        combos_first = normalize_strings(CombosFirst)
        combos_second = normalize_strings(CombosSecond)

        font_data = parse_json(FontJson)

        if font_data is None:
            raise RuntimeError("FontJson is empty.")

        if font_data.get("format") != "rhino-curve-font-v2":
            raise RuntimeError("FontJson must be rhino-curve-font-v2.")

        font_characters = font_data.get("characters", {})

        slot_data = parse_json(SlotJson)
        manual_pairs = get_manual_pairs(slot_data)

        if len(outlines) != len(glyph_names):
            raise RuntimeError(
                "Outlines / GlyphNames count mismatch.\n"
                "Outlines: {}\nGlyphNames: {}".format(
                    len(outlines),
                    len(glyph_names)
                )
            )

        # Backward compatibility: if the new input is unconnected,
        # simply behave exactly like the old script.
        if not inheritance_names:
            inheritance_names = list(glyph_names)

        if len(inheritance_names) != len(glyph_names):
            raise RuntimeError(
                "InheritanceNames / GlyphNames count mismatch.\n"
                "InheritanceNames: {}\nGlyphNames: {}".format(
                    len(inheritance_names),
                    len(glyph_names)
                )
            )

        for i, outline in enumerate(outlines):
            if not outline.IsClosed:
                raise RuntimeError(
                    "Outline {} ('{}') is not closed.".format(
                        i,
                        glyph_names[i]
                    )
                )

        try:
            tolerance = float(Tolerance)
            if tolerance <= 0:
                raise ValueError()
        except:
            tolerance = 0.001

        try:
            extension = max(0.0, float(Extension))
        except:
            extension = 0.0

        try:
            offset_distance = max(0.0, float(OffsetDistance))
        except:
            offset_distance = 0.0

        use_offset = bool(OffsetSlot)

        # ====================================================
        # EXISTING LETTER SLOTS
        # ====================================================
        # LetterSlots is a flat list aligned with GlyphNames.
        # Empty items are preserved so indices do not shift.
        # Existing letter slots are copied into GlyphSlots first;
        # generated pair slots are then added to the same branches.
        # ====================================================

        letter_slot_count = 0

        for i, slot in enumerate(letter_slots):
            if i >= len(glyph_names):
                break

            if slot is None:
                continue

            # Automatically determine the correct offset side
            # from the slot relative to its glyph outline.
            auto_letter_side = detect_letter_slot_side(
                slot,
                outlines[i],
                tolerance
            )

            # Build the actual offset version of the incoming
            # standalone letter slot.
            offset_letter_slot = make_closed_offset_slot(
                slot,
                offset_distance,
                auto_letter_side,
                tolerance
            )

            if offset_letter_slot is None:
                continue

            # GlyphSlots follows OffsetSlot, exactly like pair slots.
            glyph_letter_slot = (
                offset_letter_slot.DuplicateCurve()
                if use_offset
                else slot.DuplicateCurve()
            )

            GlyphSlots.Add(
                glyph_letter_slot,
                GH_Path(i)
            )

            # OffsetLetterSlots contains ONLY incoming standalone
            # LetterSlots, always as the offset version.
            OffsetLetterSlots.Add(
                offset_letter_slot.DuplicateCurve(),
                GH_Path(i)
            )

            letter_slot_count += 1

        checked_pairs = 0
        requested_pairs = 0
        manual_pair_count = 0
        manual_slot_count = 0
        automatic_slot_count = 0
        inherited_pair_count = 0
        no_intersection_pairs = []
        inheritance_log = []

        for i in range(len(glyph_names) - 1):
            actual_first = glyph_names[i]
            actual_second = glyph_names[i + 1]
            inherit_first = inheritance_names[i]
            inherit_second = inheritance_names[i + 1]

            actual_pair = make_pair_name(
                actual_first,
                actual_second
            )

            checked_pairs += 1

            mode, lookup_pair, owner_label, inherited = resolve_lookup_pair(
                actual_first,
                actual_second,
                inherit_first,
                inherit_second,
                manual_pairs,
                combos_first,
                combos_second,
            )

            if mode is None:
                continue

            requested_pairs += 1

            if inherited:
                inherited_pair_count += 1
                inheritance_log.append(
                    "{} <- {}".format(actual_pair, lookup_pair)
                )

            if owner_label == "first":
                owner_index = i
                owner_outline = outlines[i]
                other_outline = outlines[i + 1]
                source_owner_name = (
                    inherit_first if inherited else actual_first
                )
                automatic_side = "right"

            elif owner_label == "second":
                owner_index = i + 1
                owner_outline = outlines[i + 1]
                other_outline = outlines[i]
                source_owner_name = (
                    inherit_second if inherited else actual_second
                )
                automatic_side = "left"

            else:
                raise RuntimeError(
                    "Pair '{}' has invalid owner '{}'.".format(
                        lookup_pair,
                        owner_label
                    )
                )

            # =================================================
            # MANUAL SLOT DESIGNER DATA
            # =================================================
            if mode == "manual":
                manual = manual_pairs[lookup_pair]
                stored_slots = manual.get("slots", [])

                if not isinstance(stored_slots, list):
                    stored_slots = []

                manual_pair_count += 1

                for slot_item in stored_slots:
                    # v5 format:
                    # {
                    #   "flip_offset": bool,
                    #   "curve": {...}
                    # }
                    #
                    # Older versions are still accepted.
                    if isinstance(slot_item, dict) and "curve" in slot_item:
                        curve_data = slot_item["curve"]
                        flip_offset = bool(slot_item.get("flip_offset", False))

                        legacy_side = str(
                            slot_item.get("offset_side", "auto")
                        ).strip().lower()
                    else:
                        curve_data = slot_item
                        flip_offset = False
                        legacy_side = "auto"

                    slot = stored_slot_to_world(
                        curve_data,
                        owner_outline,
                        source_owner_name,
                        font_characters
                    )

                    actual_side = automatic_side

                    # Old JSON with explicit offset_side still works.
                    if legacy_side in ("left", "right"):
                        actual_side = legacy_side
                    elif flip_offset:
                        actual_side = (
                            "left"
                            if automatic_side == "right"
                            else "right"
                        )

                    if slot is None:
                        continue

                    # Always build the offset version.
                    offset_slot = make_closed_offset_slot(
                        slot,
                        offset_distance,
                        actual_side,
                        tolerance
                    )

                    if offset_slot is None:
                        continue

                    # GlyphSlots follows the OffsetSlot input.
                    glyph_slot = (
                        offset_slot.DuplicateCurve()
                        if use_offset
                        else slot.DuplicateCurve()
                    )

                    GlyphSlots.Add(
                        glyph_slot,
                        GH_Path(owner_index)
                    )

                    # OffsetSlots is ALWAYS offset.
                    OffsetSlots.Add(
                        offset_slot.DuplicateCurve(),
                        GH_Path(owner_index)
                    )

                    SlotPairs.append(actual_pair)
                    SlotOwners.append(owner_index)
                    manual_slot_count += 1

                continue

            # =================================================
            # AUTOMATIC FALLBACK
            # =================================================
            slot = make_pair_slot(
                owner_outline,
                other_outline,
                extension,
                tolerance
            )

            if slot is None:
                no_intersection_pairs.append(actual_pair)
                continue

            # Always build the offset version.
            offset_slot = make_closed_offset_slot(
                slot,
                offset_distance,
                automatic_side,
                tolerance
            )

            if offset_slot is None:
                continue

            # GlyphSlots follows the OffsetSlot input.
            glyph_slot = (
                offset_slot.DuplicateCurve()
                if use_offset
                else slot.DuplicateCurve()
            )

            GlyphSlots.Add(
                glyph_slot,
                GH_Path(owner_index)
            )

            # OffsetSlots is ALWAYS offset.
            OffsetSlots.Add(
                offset_slot.DuplicateCurve(),
                GH_Path(owner_index)
            )

            SlotPairs.append(actual_pair)
            SlotOwners.append(owner_index)
            automatic_slot_count += 1

        Info = (
            "GLYPHS: {}\n"
            "INHERITANCE GLYPHS: {}\n"
            "ADJACENT PAIRS CHECKED: {}\n"
            "REQUESTED SLOT PAIRS: {}\n"
            "INPUT LETTER SLOTS: {}\n"
            "PASSED-THROUGH LETTER SLOTS (BOTH OUTPUTS): {}\n"
            "GENERATED GLYPH SLOTS: {}\n"
            "GENERATED PAIR OFFSET SLOTS: {}\n"
            "GENERATED LETTER OFFSET SLOTS: {}\n"
            "INHERITED PAIRS USED: {}\n"
            "INHERITANCE: {}\n"
            "\n"
            "MANUAL OVERRIDE PAIRS USED: {}\n"
            "MANUAL SLOTS GENERATED: {}\n"
            "AUTOMATIC SLOTS GENERATED: {}\n"
            "\n"
            "EXTENSION (AUTO ONLY): {}\n"
            "OFFSET SLOT: {}\n"
            "OFFSET DISTANCE: {}\n"
            "TOLERANCE: {}\n"
            "\n"
            "AVAILABLE MANUAL PAIRS: {}\n"
            "COMBOS FIRST / RIGHT: {}\n"
            "COMBOS SECOND / LEFT: {}\n"
            "\n"
            "SLOT PAIRS: {}\n"
            "SLOT OWNERS: {}\n"
            "AUTO REQUESTED BUT NO VALID INTERSECTION: {}"
        ).format(
            glyph_names,
            inheritance_names,
            checked_pairs,
            requested_pairs,
            len(letter_slots),
            letter_slot_count,
            GlyphSlots.DataCount,
            OffsetSlots.DataCount,
            OffsetLetterSlots.DataCount,
            inherited_pair_count,
            inheritance_log,
            manual_pair_count,
            manual_slot_count,
            automatic_slot_count,
            extension,
            use_offset,
            offset_distance,
            tolerance,
            sorted(manual_pairs.keys()),
            sorted(combos_first),
            sorted(combos_second),
            SlotPairs,
            SlotOwners,
            no_intersection_pairs,
        )

    except Exception as ex:
        print(ex)
        Info = "ERROR:\n{}".format(ex)
# ---------- end pair_slots ----------

stone_pivot_2 = Geometry(stone_pivot)
stone_json_2 = Text(stone_json)
loop_pivot_2 = Geometry(loop_pivot)
stone_geo_2 = Geometry(stone_geo)
loop_json_2 = Text(loop_json)
loop_geo_2 = Geometry(loop_geo)

embedded_stones_on = BooleanToggle(True)
stream_filter = StreamFilter(Gate=enable_2, Stream1=flatten(font_assembly.GlyphStones))

loops = Script(
    Run=enable_2,
    FontJson=fontjson,
    GlyphNames=font_assembly.GlyphNames,
    InheritanceNames=font_assembly.InheritanceNames,
    PivotPoints=font_assembly.PivotPoints,
    Height=height_2,
    AnchorsJson=loop_json_2,
    AdditionGeo=loop_geo_2,
    AdditionPivot=loop_pivot_2)  # -> out, Additions, AdditionTree, AnchorPoints, Roles, UsedGlyphs, Missing, Info, diagnostics; inputs Run: Boolean, FontJson: String, GlyphNames: list of String, InheritanceNames: list of String, PivotPoints: list of Point3d, Height: Double, AnchorsJson: String, AdditionGeo: list of GeometryBase, AdditionPivot: Point3d
# ---------- loops: Python ----------
import json
import traceback

import Rhino.Geometry as rg
from Grasshopper import DataTree
from Grasshopper.Kernel.Data import GH_Path
import System


# ============================================================
# GRASSHOPPER INPUTS
# ============================================================
#
# Run
#   Type Hint : bool
#   Access    : Item
#
# FontJson
#   Type Hint : str
#   Access    : Item
#
# AnchorsJson
#   Type Hint : str
#   Access    : Item
#
# GlyphNames
#   Type Hint : str
#   Access    : List
#   Actual glyphs from Font Assembly.
#
# InheritanceNames
#   Type Hint : str
#   Access    : List
#   Inheritance glyphs from Font Assembly.
#
# PivotPoints
#   Type Hint : Point3d
#   Access    : List
#
# Height
#   Type Hint : float
#   Access    : Item
#
# AdditionGeo
#   Type Hint : No Type Hint
#   Access    : List
#
# AdditionPivot
#   Type Hint : Point3d
#   Access    : Item
#
#
# ============================================================
# OUTPUTS
# ============================================================
#
# out
# Additions
# AdditionTree
# AnchorPoints
# Roles
# UsedGlyphs
# Missing
# Info
#
# ============================================================


out = None

Additions = []
AdditionTree = DataTree[System.Object]()
AnchorPoints = []
Roles = []
UsedGlyphs = []
Missing = []
Info = ""


# ============================================================
# HELPERS
# ============================================================

def parse_json(value):

    if value is None:
        return None

    text = str(value).strip()

    if not text:
        return None

    return json.loads(text)


def normalize_list(value):

    if value is None:
        return []

    if isinstance(value, str):
        return [value]

    try:
        return list(value)
    except:
        return [value]


def duplicate_geometry(geo):

    if geo is None:
        return None

    try:
        return geo.Duplicate()
    except:
        pass

    try:
        return geo.DuplicateGeometry()
    except:
        pass

    return geo


def get_anchor(
    anchor_data,
    glyph_name,
    role,
):

    return (
        anchor_data
        .get("anchors", {})
        .get(glyph_name, {})
        .get(role)
    )


def resolve_anchor(
    anchor_data,
    glyph_name,
    inheritance_name,
    role,
):
    """
    Lookup priority:

        1. Exact displayed glyph
        2. Inheritance glyph
        3. Missing

    Example:
        GlyphName        = S_stone
        InheritanceName  = S

        Try:
            S_stone / FIRST

        then:
            S / FIRST
    """

    exact = get_anchor(
        anchor_data,
        glyph_name,
        role,
    )

    if exact is not None:

        return (
            exact,
            glyph_name,
            False,
        )

    if (
        inheritance_name
        and inheritance_name != glyph_name
    ):

        inherited = get_anchor(
            anchor_data,
            inheritance_name,
            role,
        )

        if inherited is not None:

            return (
                inherited,
                inheritance_name,
                True,
            )

    return (
        None,
        None,
        False,
    )


def place_addition(
    geometry,
    addition_pivot,
    target_point,
):
    """
    Translate fixed-size addition geometry so AdditionPivot
    coincides with target_point.

    No scaling is applied to AdditionGeo.
    """

    result = []

    source = rg.Point3d(
        float(addition_pivot.X),
        float(addition_pivot.Y),
        float(addition_pivot.Z),
    )

    target = rg.Point3d(
        float(target_point.X),
        float(target_point.Y),
        float(target_point.Z),
    )

    transform = rg.Transform.Translation(
        target - source
    )

    for item in normalize_list(
        geometry
    ):

        dup = duplicate_geometry(
            item
        )

        if dup is None:
            continue

        try:

            dup.Transform(
                transform
            )

            result.append(
                dup
            )

        except:
            pass

    return result


def compute_world_anchor(
    local_anchor,
    glyph_pivot,
    scale,
):
    """
    AnchorsJson stores coordinates in SOURCE FONT coordinates,
    local to the glyph pivot.

    world anchor =
        glyph pivot
        + local anchor * font scale
    """

    local_x = float(
        local_anchor["x"]
    )

    local_y = float(
        local_anchor["y"]
    )

    return rg.Point3d(
        float(glyph_pivot.X)
        + local_x * scale,

        float(glyph_pivot.Y)
        + local_y * scale,

        float(glyph_pivot.Z),
    )


# ============================================================
# MAIN
# ============================================================

if not Run:

    Info = "Set Run = True."

else:

    try:

        # ----------------------------------------------------
        # FONT JSON
        # ----------------------------------------------------

        font_data = parse_json(
            FontJson
        )

        if font_data is None:

            raise RuntimeError(
                "FontJson is empty."
            )

        if font_data.get(
            "format"
        ) != "rhino-curve-font-v2":

            raise RuntimeError(
                "FontJson must be rhino-curve-font-v2."
            )

        # ----------------------------------------------------
        # ADDITION ANCHORS JSON
        # ----------------------------------------------------

        anchor_data = parse_json(
            AnchorsJson
        )

        if anchor_data is None:

            raise RuntimeError(
                "AnchorsJson is empty."
            )

        if anchor_data.get(
            "format"
        ) != "addition-anchors-v2":

            raise RuntimeError(
                "AnchorsJson must be addition-anchors-v2."
            )

        # ----------------------------------------------------
        # INPUT LISTS
        # ----------------------------------------------------

        glyph_names = normalize_list(
            GlyphNames
        )

        inheritance_names = normalize_list(
            InheritanceNames
        )

        pivot_points = normalize_list(
            PivotPoints
        )

        if not glyph_names:

            raise RuntimeError(
                "GlyphNames is empty."
            )

        if not inheritance_names:

            raise RuntimeError(
                "InheritanceNames is empty."
            )

        if not pivot_points:

            raise RuntimeError(
                "PivotPoints is empty."
            )

        if len(glyph_names) != len(pivot_points):

            raise RuntimeError(
                "GlyphNames count ({}) does not match "
                "PivotPoints count ({}).".format(
                    len(glyph_names),
                    len(pivot_points),
                )
            )

        if len(inheritance_names) != len(glyph_names):

            raise RuntimeError(
                "InheritanceNames count ({}) does not match "
                "GlyphNames count ({}).".format(
                    len(inheritance_names),
                    len(glyph_names),
                )
            )

        if AdditionPivot is None:

            raise RuntimeError(
                "AdditionPivot is required."
            )

        if Height is None or float(
            Height
        ) <= 0:

            raise RuntimeError(
                "Height must be greater than 0."
            )

        # ----------------------------------------------------
        # SCALE
        # ----------------------------------------------------

        source_reference_height = float(
            font_data[
                "font"
            ][
                "source_reference_height"
            ]
        )

        scale = (
            float(Height)
            / source_reference_height
        )

        # ----------------------------------------------------
        # FIRST / LAST REQUESTS
        # ----------------------------------------------------

        placement_requests = [
            (
                "FIRST",
                0,
            ),
            (
                "LAST",
                len(glyph_names) - 1,
            ),
        ]

        branch_index = 0
        resolution_log = []

        for role, glyph_index in placement_requests:

            glyph_name = str(
                glyph_names[
                    glyph_index
                ]
            )

            inheritance_name = str(
                inheritance_names[
                    glyph_index
                ]
            )

            glyph_pivot = pivot_points[
                glyph_index
            ]

            # ------------------------------------------------
            # EXACT -> INHERITED LOOKUP
            # ------------------------------------------------

            anchor, source_glyph, inherited = resolve_anchor(
                anchor_data,
                glyph_name,
                inheritance_name,
                role,
            )

            if anchor is None:

                if inheritance_name != glyph_name:

                    Missing.append(
                        "{} / {} "
                        "(inheritance: {})".format(
                            glyph_name,
                            role,
                            inheritance_name,
                        )
                    )

                else:

                    Missing.append(
                        "{} / {}".format(
                            glyph_name,
                            role,
                        )
                    )

                resolution_log.append(
                    "{}: {} -> MISSING".format(
                        role,
                        glyph_name,
                    )
                )

                continue

            # ------------------------------------------------
            # WORLD ANCHOR
            # ------------------------------------------------

            world_anchor = compute_world_anchor(
                anchor,
                glyph_pivot,
                scale,
            )

            # ------------------------------------------------
            # PLACE ADDITION
            # ------------------------------------------------

            placed_geometry = place_addition(
                AdditionGeo,
                AdditionPivot,
                world_anchor,
            )

            path = GH_Path(
                branch_index
            )

            for geo in placed_geometry:

                Additions.append(
                    geo
                )

                AdditionTree.Add(
                    geo,
                    path,
                )

            AnchorPoints.append(
                world_anchor
            )

            Roles.append(
                role
            )

            UsedGlyphs.append(
                glyph_name
            )

            if inherited:

                resolution_log.append(
                    "{}: {} -> inherited from {}".format(
                        role,
                        glyph_name,
                        source_glyph,
                    )
                )

            else:

                resolution_log.append(
                    "{}: {} -> exact".format(
                        role,
                        glyph_name,
                    )
                )

            branch_index += 1

        # ----------------------------------------------------
        # OUTPUT
        # ----------------------------------------------------

        out = Additions

        # ----------------------------------------------------
        # INFO
        # ----------------------------------------------------

        Info = (
            "SCHEME: {}\n"
            "FORMAT: {}\n"
            "FONT: {}\n"
            "HEIGHT: {}\n"
            "SCALE: {}\n"
            "GLYPH COUNT: {}\n"
            "INHERITANCE COUNT: {}\n"
            "PLACED ADDITIONS: {}\n"
            "ROLES: {}\n"
            "USED GLYPHS: {}\n"
            "MISSING: {}\n"
            "\n"
            "ANCHOR RESOLUTION:\n{}"
        ).format(
            anchor_data.get(
                "name",
                ""
            ),
            anchor_data.get(
                "format",
                ""
            ),
            font_data.get(
                "font",
                {}
            ).get(
                "name",
                ""
            ),
            Height,
            scale,
            len(
                glyph_names
            ),
            len(
                inheritance_names
            ),
            len(
                Roles
            ),
            repr(
                Roles
            ),
            repr(
                UsedGlyphs
            ),
            repr(
                Missing
            ),
            "\n".join(
                resolution_log
            ),
        )

    except Exception as ex:

        print(ex)
        traceback.print_exc()

        Info = (
            "ERROR:\n{}"
        ).format(
            ex
        )

diagnostics = (
    "Run: {}\n"
    "FontJson: {}\n"
    "AnchorsJson: {}\n"
    "GlyphNames: {}\n"
    "InheritanceNames: {}\n"
    "PivotPoints: {}\n"
    "AdditionGeo: {}\n"
    "AdditionPivot: {}\n"
    "Height: {}\n"
    "Additions: {}\n"
    "Info:\n{}"
).format(
    Run,
    "OK" if FontJson else "EMPTY",
    "OK" if AnchorsJson else "EMPTY",
    len(GlyphNames) if GlyphNames else 0,
    len(InheritanceNames) if InheritanceNames else 0,
    len(PivotPoints) if PivotPoints else 0,
    len(AdditionGeo) if AdditionGeo else 0,
    "OK" if AdditionPivot is not None else "NONE",
    Height,
    len(Additions),
    Info
)
# ---------- end loops ----------
square_stone_finite = Script(
    Run=enable_2,
    FontJson=fontjson,
    GlyphNames=font_assembly.GlyphNames,
    InheritanceNames=font_assembly.InheritanceNames,
    PivotPoints=font_assembly.PivotPoints,
    Height=height_2,
    AnchorsJson=stone_json_2,
    AdditionGeo=stone_geo_2,
    AdditionPivot=stone_pivot_2)  # -> out, Additions, AdditionTree, AnchorPoints, Roles, UsedGlyphs, Missing, Info; inputs Run: Boolean, FontJson: String, GlyphNames: list of String, InheritanceNames: list of String, PivotPoints: list of Point3d, Height: Double, AnchorsJson: String, AdditionGeo: list of GeometryBase, AdditionPivot: Point3d
# ---------- square_stone_finite: Python ----------
import json
import traceback

import Rhino.Geometry as rg
from Grasshopper import DataTree
from Grasshopper.Kernel.Data import GH_Path
import System


# ============================================================
# GRASSHOPPER INPUTS
# ============================================================
#
# Run
#   Type Hint : bool
#   Access    : Item
#
# FontJson
#   Type Hint : str
#   Access    : Item
#
# AnchorsJson
#   Type Hint : str
#   Access    : Item
#
# GlyphNames
#   Type Hint : str
#   Access    : List
#   Actual glyphs from Font Assembly.
#
# InheritanceNames
#   Type Hint : str
#   Access    : List
#   Inheritance glyphs from Font Assembly.
#
# PivotPoints
#   Type Hint : Point3d
#   Access    : List
#
# Height
#   Type Hint : float
#   Access    : Item
#
# AdditionGeo
#   Type Hint : No Type Hint
#   Access    : List
#
# AdditionPivot
#   Type Hint : Point3d
#   Access    : Item
#
#
# ============================================================
# OUTPUTS
# ============================================================
#
# out
# Additions
# AdditionTree
# AnchorPoints
# Roles
# UsedGlyphs
# Missing
# Info
#
# ============================================================


out = None

Additions = []
AdditionTree = DataTree[System.Object]()
AnchorPoints = []
Roles = []
UsedGlyphs = []
Missing = []
Info = ""


# ============================================================
# HELPERS
# ============================================================

def parse_json(value):

    if value is None:
        return None

    text = str(value).strip()

    if not text:
        return None

    return json.loads(text)


def normalize_list(value):

    if value is None:
        return []

    if isinstance(value, str):
        return [value]

    try:
        return list(value)
    except:
        return [value]


def duplicate_geometry(geo):

    if geo is None:
        return None

    try:
        return geo.Duplicate()
    except:
        pass

    try:
        return geo.DuplicateGeometry()
    except:
        pass

    return geo


def get_anchor(
    anchor_data,
    glyph_name,
    role,
):

    return (
        anchor_data
        .get("anchors", {})
        .get(glyph_name, {})
        .get(role)
    )


def resolve_anchor(
    anchor_data,
    glyph_name,
    inheritance_name,
    role,
):
    """
    Lookup priority:

        1. Exact displayed glyph
        2. Inheritance glyph
        3. Missing

    Example:
        GlyphName        = S_stone
        InheritanceName  = S

        Try:
            S_stone / FIRST

        then:
            S / FIRST
    """

    exact = get_anchor(
        anchor_data,
        glyph_name,
        role,
    )

    if exact is not None:

        return (
            exact,
            glyph_name,
            False,
        )

    if (
        inheritance_name
        and inheritance_name != glyph_name
    ):

        inherited = get_anchor(
            anchor_data,
            inheritance_name,
            role,
        )

        if inherited is not None:

            return (
                inherited,
                inheritance_name,
                True,
            )

    return (
        None,
        None,
        False,
    )


def place_addition(
    geometry,
    addition_pivot,
    target_point,
):
    """
    Translate fixed-size addition geometry so AdditionPivot
    coincides with target_point.

    No scaling is applied to AdditionGeo.
    """

    result = []

    source = rg.Point3d(
        float(addition_pivot.X),
        float(addition_pivot.Y),
        float(addition_pivot.Z),
    )

    target = rg.Point3d(
        float(target_point.X),
        float(target_point.Y),
        float(target_point.Z),
    )

    transform = rg.Transform.Translation(
        target - source
    )

    for item in normalize_list(
        geometry
    ):

        dup = duplicate_geometry(
            item
        )

        if dup is None:
            continue

        try:

            dup.Transform(
                transform
            )

            result.append(
                dup
            )

        except:
            pass

    return result


def compute_world_anchor(
    local_anchor,
    glyph_pivot,
    scale,
):
    """
    AnchorsJson stores coordinates in SOURCE FONT coordinates,
    local to the glyph pivot.

    world anchor =
        glyph pivot
        + local anchor * font scale
    """

    local_x = float(
        local_anchor["x"]
    )

    local_y = float(
        local_anchor["y"]
    )

    return rg.Point3d(
        float(glyph_pivot.X)
        + local_x * scale,

        float(glyph_pivot.Y)
        + local_y * scale,

        float(glyph_pivot.Z),
    )


# ============================================================
# MAIN
# ============================================================

if not Run:

    Info = "Set Run = True."

else:

    try:

        # ----------------------------------------------------
        # FONT JSON
        # ----------------------------------------------------

        font_data = parse_json(
            FontJson
        )

        if font_data is None:

            raise RuntimeError(
                "FontJson is empty."
            )

        if font_data.get(
            "format"
        ) != "rhino-curve-font-v2":

            raise RuntimeError(
                "FontJson must be rhino-curve-font-v2."
            )

        # ----------------------------------------------------
        # ADDITION ANCHORS JSON
        # ----------------------------------------------------

        anchor_data = parse_json(
            AnchorsJson
        )

        if anchor_data is None:

            raise RuntimeError(
                "AnchorsJson is empty."
            )

        if anchor_data.get(
            "format"
        ) != "addition-anchors-v2":

            raise RuntimeError(
                "AnchorsJson must be addition-anchors-v2."
            )

        # ----------------------------------------------------
        # INPUT LISTS
        # ----------------------------------------------------

        glyph_names = normalize_list(
            GlyphNames
        )

        inheritance_names = normalize_list(
            InheritanceNames
        )

        pivot_points = normalize_list(
            PivotPoints
        )

        if not glyph_names:

            raise RuntimeError(
                "GlyphNames is empty."
            )

        if not inheritance_names:

            raise RuntimeError(
                "InheritanceNames is empty."
            )

        if not pivot_points:

            raise RuntimeError(
                "PivotPoints is empty."
            )

        if len(glyph_names) != len(pivot_points):

            raise RuntimeError(
                "GlyphNames count ({}) does not match "
                "PivotPoints count ({}).".format(
                    len(glyph_names),
                    len(pivot_points),
                )
            )

        if len(inheritance_names) != len(glyph_names):

            raise RuntimeError(
                "InheritanceNames count ({}) does not match "
                "GlyphNames count ({}).".format(
                    len(inheritance_names),
                    len(glyph_names),
                )
            )

        if AdditionPivot is None:

            raise RuntimeError(
                "AdditionPivot is required."
            )

        if Height is None or float(
            Height
        ) <= 0:

            raise RuntimeError(
                "Height must be greater than 0."
            )

        # ----------------------------------------------------
        # SCALE
        # ----------------------------------------------------

        source_reference_height = float(
            font_data[
                "font"
            ][
                "source_reference_height"
            ]
        )

        scale = (
            float(Height)
            / source_reference_height
        )

        # ----------------------------------------------------
        # FIRST / LAST REQUESTS
        # ----------------------------------------------------

        placement_requests = [
            (
                "FIRST",
                0,
            ),
            (
                "LAST",
                len(glyph_names) - 1,
            ),
        ]

        branch_index = 0
        resolution_log = []

        for role, glyph_index in placement_requests:

            glyph_name = str(
                glyph_names[
                    glyph_index
                ]
            )

            inheritance_name = str(
                inheritance_names[
                    glyph_index
                ]
            )

            glyph_pivot = pivot_points[
                glyph_index
            ]

            # ------------------------------------------------
            # EXACT -> INHERITED LOOKUP
            # ------------------------------------------------

            anchor, source_glyph, inherited = resolve_anchor(
                anchor_data,
                glyph_name,
                inheritance_name,
                role,
            )

            if anchor is None:

                if inheritance_name != glyph_name:

                    Missing.append(
                        "{} / {} "
                        "(inheritance: {})".format(
                            glyph_name,
                            role,
                            inheritance_name,
                        )
                    )

                else:

                    Missing.append(
                        "{} / {}".format(
                            glyph_name,
                            role,
                        )
                    )

                resolution_log.append(
                    "{}: {} -> MISSING".format(
                        role,
                        glyph_name,
                    )
                )

                continue

            # ------------------------------------------------
            # WORLD ANCHOR
            # ------------------------------------------------

            world_anchor = compute_world_anchor(
                anchor,
                glyph_pivot,
                scale,
            )

            # ------------------------------------------------
            # PLACE ADDITION
            # ------------------------------------------------

            placed_geometry = place_addition(
                AdditionGeo,
                AdditionPivot,
                world_anchor,
            )

            path = GH_Path(
                branch_index
            )

            for geo in placed_geometry:

                Additions.append(
                    geo
                )

                AdditionTree.Add(
                    geo,
                    path,
                )

            AnchorPoints.append(
                world_anchor
            )

            Roles.append(
                role
            )

            UsedGlyphs.append(
                glyph_name
            )

            if inherited:

                resolution_log.append(
                    "{}: {} -> inherited from {}".format(
                        role,
                        glyph_name,
                        source_glyph,
                    )
                )

            else:

                resolution_log.append(
                    "{}: {} -> exact".format(
                        role,
                        glyph_name,
                    )
                )

            branch_index += 1

        # ----------------------------------------------------
        # OUTPUT
        # ----------------------------------------------------

        out = Additions

        # ----------------------------------------------------
        # INFO
        # ----------------------------------------------------

        Info = (
            "SCHEME: {}\n"
            "FORMAT: {}\n"
            "FONT: {}\n"
            "HEIGHT: {}\n"
            "SCALE: {}\n"
            "GLYPH COUNT: {}\n"
            "INHERITANCE COUNT: {}\n"
            "PLACED ADDITIONS: {}\n"
            "ROLES: {}\n"
            "USED GLYPHS: {}\n"
            "MISSING: {}\n"
            "\n"
            "ANCHOR RESOLUTION:\n{}"
        ).format(
            anchor_data.get(
                "name",
                ""
            ),
            anchor_data.get(
                "format",
                ""
            ),
            font_data.get(
                "font",
                {}
            ).get(
                "name",
                ""
            ),
            Height,
            scale,
            len(
                glyph_names
            ),
            len(
                inheritance_names
            ),
            len(
                Roles
            ),
            repr(
                Roles
            ),
            repr(
                UsedGlyphs
            ),
            repr(
                Missing
            ),
            "\n".join(
                resolution_log
            ),
        )

    except Exception as ex:

        print(ex)
        traceback.print_exc()

        Info = (
            "ERROR:\n{}"
        ).format(
            ex
        )
# ---------- end square_stone_finite ----------
inner_outer_2 = Script(crvs=flatten(square_stone_finite.Additions))  # -> out, flatten(inner), flatten(outer); inputs crvs: list of Curve; same code as inner_outer
clean_shape = Script(
    breps=flatten(inner_outer.outer),
    min_area=min_area,
    loops=flatten(loops.Additions),
    sockets=flatten(inner_outer_2.outer))  # -> out, success, center, brep_shape, inner_crvs, outer_crvs; inputs breps: list of Brep, loops: list of Curve, sockets: list of Curve
# ---------- clean_shape: Python ----------
import Rhino.Geometry as rg


if not breps:
    breps = []

if not loops:
    loops = []

if not sockets:
    sockets = []


plane = rg.Plane.WorldXY
tolerance = 0.001


#-------------------------------------------------------------------------------------
# FUNCTIONS
#-------------------------------------------------------------------------------------

def get_outer_curve(brep):

    edges = [
        edge.DuplicateCurve()
        for edge in brep.Edges
    ]

    joined = rg.Curve.JoinCurves(
        edges,
        tolerance
    )

    if not joined:
        return None

    if len(joined) == 1:
        return joined[0]

    closed = [
        c
        for c in joined
        if c.IsClosed
    ]

    if not closed:
        return None

    return max(
        closed,
        key=lambda c: rg.AreaMassProperties.Compute(c).Area
    )


def to_list(item):

    if item is None:
        return []

    if isinstance(item, (list, tuple)):
        return list(item)

    try:
        return list(item)

    except TypeError:
        return [item]


def get_center(geos):

    bbox = rg.BoundingBox.Empty

    for geo in geos:

        if geo is None:
            continue

        bbox.Union(
            geo.GetBoundingBox(True)
        )

    return bbox.Center


def get_biggest_surface(srfs):

    if not srfs:
        return None

    return max(
        srfs,
        key=rg.Brep.GetArea
    )


def curve_relationship(curve_a, curve_b):
    """
    Pure RhinoCommon planar containment test.

    Returns:
        rg.RegionContainment
    """

    if curve_a is None or curve_b is None:
        return None

    if not curve_a.IsClosed or not curve_b.IsClosed:
        return None

    try:

        return rg.Curve.PlanarClosedCurveRelationship(
            curve_a,
            curve_b,
            plane,
            tolerance
        )

    except:
        return None


def curve_is_inside(curve_a, curve_b):
    """
    True when curve_a is inside curve_b.
    """

    rel = curve_relationship(
        curve_a,
        curve_b
    )

    return (
        rel == rg.RegionContainment.AInsideB
    )

"""
def step_split(breps):
    '''
    Split each brep by the next one and return
    cleaned breps without leftovers.
    '''

    result = []

    if not breps:
        return []

    if len(breps) == 1:
        return breps[0]


    for i in range(
        0,
        len(breps) - 1
    ):

        a_crv = get_outer_curve(
            breps[i]
        )

        b_crv = get_outer_curve(
            breps[i + 1]
        )

        rel = curve_relationship(
            a_crv,
            b_crv
        )

        print(
            "CURVE RELATION:",
            rel
        )


        success, curves, points = (
            rg.Intersect.Intersection.BrepBrep(
                breps[i],
                breps[i + 1],
                tolerance
            )
        )


        splits = rg.Brep.Split(
            breps[i],
            breps[i + 1],
            tolerance
        )


        print(
            "PAIR:",
            i,
            i + 1
        )

        print(
            "INTERSECTION:",
            success
        )

        print(
            "INTERSECTION CURVES:",
            len(curves)
            if curves
            else 0
        )

        print(
            "INTERSECTION POINTS:",
            len(points)
            if points
            else 0
        )

        print(
            "SPLITS COUNT:",
            len(splits)
            if splits
            else 0
        )


        shape = get_biggest_surface(
            splits
        )

        print(
            "SHAPE:",
            shape
        )

        if shape:
            result.append(
                shape
            )


    last_shape = breps[-1]

    if last_shape:
        result.append(
            last_shape
        )

    return result
"""

def step_split(breps):
    """
    Split each Brep by the next one.
    Keep the largest piece after splitting.
    Preserve the original if no usable result is returned.
    Always return a list.
    """

    if not breps:
        return []

    result = []

    for i in range(len(breps) - 1):
        current = breps[i]
        cutter = breps[i + 1]

        splits = current.Split(
            cutter,
            tolerance
        )

        count = len(splits) if splits else 0

        print("PAIR: {} -> {}".format(i, i + 1))
        print("SPLITS COUNT: {}".format(count))

        shape = None

        if count == 1:
            shape = splits[0]

        elif count > 1:
            shape = get_biggest_surface(splits)

        if shape is None:
            print("Keeping original Brep: {}".format(i))
            shape = current

        result.append(shape)

    result.append(breps[-1])

    return result

def join_breps(breps):
    """
    Join a list of breps.
    """

    breps = [
        b
        for b in breps
        if b
    ]

    if not breps:
        return None

    if len(breps) == 1:
        return breps[0]

    joined = rg.Brep.JoinBreps(
        breps,
        tolerance
    )

    if not joined:
        return None

    if len(joined) == 1:
        return joined[0]

    return None


def merge_faces(brep):

    if brep:
        brep.MergeCoplanarFaces(
            tolerance
        )


def inner_outer(crvs):
    """
    Separate curves into:

    inner:
        curve is inside at least one other curve

    outer:
        curve is not inside any other curve

    Pure RhinoCommon implementation.
    """

    inner = []
    outer = []

    crvs = [
        c
        for c in crvs
        if c is not None
    ]


    for i, curve_a in enumerate(crvs):

        is_inner = False

        for j, curve_b in enumerate(crvs):

            if i == j:
                continue

            if curve_is_inside(
                curve_a,
                curve_b
            ):

                is_inner = True
                break


        if is_inner:

            inner.append(
                curve_a
            )

        else:

            outer.append(
                curve_a
            )


    return (
        inner,
        outer
    )


#-------------------------------------------------------------------------------------
# MAIN
#-------------------------------------------------------------------------------------

clean_breps = step_split(
    breps
)


clean_breps = to_list(
    clean_breps
)

clean_breps = [
    c
    for c in clean_breps
    if c
]


print(
    "CLEANED:",
    clean_breps
)


brep_shape = join_breps(
    clean_breps
)


success = bool(
    brep_shape
)

if success:

    merge_faces(
        brep_shape
    )


    center = get_center(
        clean_breps
    )


    # Create curves from brep
    crvs = to_list(
        rg.Brep.CreateContourCurves(
            brep_shape,
            plane
        )
    )


    loops = to_list(
        loops
    )


    # Separate inner and outer curves
    inner_crvs, outer_crvs = inner_outer(
        crvs + loops
    )

    # Filter small inner curves
    filtered_inner = []

    for c in inner_crvs:

        amp = rg.AreaMassProperties.Compute(
            c
        )

        if amp and amp.Area > min_area:

            filtered_inner.append(
                c
            )


    inner_crvs = filtered_inner


    # Add sockets to outer curves
    if sockets:

        outer_crvs.extend(
            to_list(sockets)
        )


    # Boolean union
    union_result = rg.Curve.CreateBooleanUnion(
        outer_crvs
    )

    outer_crvs = to_list(
        union_result
    )


else:
    loops = to_list(loops)


    # Separate inner and outer curves
    inner_crvs, outer_crvs = inner_outer(
        loops
    )
# ---------- end clean_shape ----------
check_successful_cleanup = StreamFilter(
    Gate=clean_shape.success,
    Stream0=[inner_outer.outer, inner_outer.inner, clean_shape.inner_crvs, clean_shape.outer_crvs],
    Stream1=flatten([inner_outer.inner, clean_shape.inner_crvs, clean_shape.outer_crvs]))
boundary_surfaces = BoundarySurfaces(Edges=flatten(check_successful_cleanup), UseTasks=True)
merge_faces = MergeFaces(Brep=flatten(boundary_surfaces))  # -> Breps, Before, After
diamond = Geometry(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)
square = Geometry(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)
brep_edges = BrepEdges(Brep=merge_faces.Breps)  # -> Naked, Interior, NonManifold
stone_preview = Script(stone_type=stone_type, stone_markers=flatten([stream_filter, inner_outer_2.inner]), SQUARE=square, DIAMOND=diamond)  # -> out, Stones; inputs stone_type: String, stone_markers: list of GeometryBase, SQUARE: GeometryBase, DIAMOND: GeometryBase
# ---------- stone_preview: Python ----------
import Rhino.Geometry as rg


def get_center(geo):
    """Return bounding-box center of geometry."""
    bbox = geo.GetBoundingBox(True)
    return bbox.Center


def move_to_marker(geo, marker):
    """Duplicate geometry and move its center to marker center."""
    
    if geo is None or marker is None:
        return None

    source_center = get_center(geo)
    target_center = get_center(marker)

    vector = target_center - source_center

    moved = geo.Duplicate()
    moved.Transform(rg.Transform.Translation(vector))

    return moved


# --------------------------------------------------
# Choose stone geometry
# --------------------------------------------------

stone_geo = None

if stone_type:
    stone_type_clean = stone_type.strip().upper()

    if stone_type_clean == "SQUARE":
        stone_geo = SQUARE

    elif stone_type_clean == "DIAMOND":
        stone_geo = DIAMOND


# --------------------------------------------------
# Place stones
# --------------------------------------------------

Stones = []

if stone_geo is not None and stone_markers:
    for marker in stone_markers:
        moved = move_to_marker(stone_geo, marker)

        if moved is not None:
            Stones.append(moved)
# ---------- end stone_preview ----------
join_curves = JoinCurves(Curves=brep_edges.Naked, Preserve=False)
not_null = Script(items=stone_preview.Stones)  # -> out, items; inputs items: list of GeometryBase
# ---------- not_null: Python ----------
items = [i for i in items if i]
# ---------- end not_null ----------
inner_outer_3 = Script(crvs=flatten(join_curves))  # -> out, flatten(inner), flatten(outer); inputs crvs: list of Curve; same code as inner_outer
offset_letter_slots = Geometry(pair_slots.OffsetLetterSlots)
region_union = RegionUnion(Curves=inner_outer_3.outer)
offset_slots = Geometry(pair_slots.OffsetSlots)
glyph_slots = Geometry(pair_slots.GlyphSlots)
loops_info = Data(loops.diagnostics)
loops_2 = Geometry(loops.Additions)
stones = Geometry(not_null.items)
loops_info_2 = ClusterOutput(loops_info)
glyph_slots_2 = ClusterOutput(glyph_slots)
offset_slots_2 = ClusterOutput(offset_slots)
offset_letter_slots_2 = ClusterOutput(offset_letter_slots)
loops_3 = ClusterOutput(loops_2)
breps = ClusterOutput(merge_faces.Breps)
glyphnames = ClusterOutput(font_assembly.GlyphNames)
stones_2 = ClusterOutput(stones)
inner = Geometry(inner_outer_3.inner)
outer = Geometry(region_union)
inner_2 = ClusterOutput(inner)
outer_2 = ClusterOutput(outer)

# ==== cluster _3DPREVIEW
enable = ClusterInput()
offset_letter_slots = ClusterInput()
inner_crvs = ClusterInput()
outline_crv = ClusterInput()
offset_slots = ClusterInput()
flat = ClusterInput()
loop = ClusterInput()
stones = ClusterInput()

# ---- group: SLIGHT SLOT MOVEMENT
offset_slots_2 = Geometry(offset_slots)
construct_point = ConstructPoint(XCoordinate=Slider(0.02, range=0.001..5), YCoordinate=0, ZCoordinate=0)
move = Move(Geometry=offset_slots_2, Motion=construct_point)  # -> Geometry, Transform

offset_letter_slots_2 = Geometry(offset_letter_slots)
construct_point_2 = ConstructPoint(XCoordinate=0, YCoordinate=Slider(-0.01, range=-2..5), ZCoordinate=0)
move_2 = Move(Geometry=offset_letter_slots_2, Motion=construct_point_2)  # -> Geometry, Transform

# ----
loop_2 = Geometry(loop)
stones_2 = Geometry(stones)
inner_crvs_2 = Geometry(inner_crvs)
outline_crv_2 = Geometry(outline_crv)
enable_2 = Boolean(enable)
inner_outer = Script(crvs=flatten(loop_2))  # -> out, flatten(inner), flatten(outer); inputs crvs: list of Curve; same code as inner_outer
loops = Geometry(inner_outer.outer)

# ---- group: BUILD 3D
thickness = Number(expr("-X", Slider(1.1, range=0.001..3)))
bs = BoundarySurfaces(Edges=flatten([outline_crv_2, inner_crvs_2]))
flip = Flip(Surface=flatten([move.Geometry, move_2.Geometry]), Guide=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)  # -> Surface, Result
flip_2 = Flip(Surface=stones_2, Guide=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)  # -> Surface, Result
flat_2 = Boolean(flat)
unit_z = UnitZ(Factor=thickness)
filter = StreamFilter(Gate=flat_2, Stream0=bs)
extrude = Extrude(Base=filter, Direction=unit_z)
ilter = StreamFilter(Gate=flat_2, Stream0=extrude, Stream1=bs)

# ----
addition_inset = Number(expr("x *0.15", thickness))
unit_z_2 = UnitZ(Factor=expr("0.5*X", thickness))
move_3 = Move(Geometry=loops, Motion=unit_z_2)  # -> Geometry, Transform
area = Area(Geometry=move_3.Geometry)  # -> Area, Centroid
list_item = ListItem(List=area.Centroid, Index=1, Wrap=True)
list_item_2 = ListItem(List=area.Centroid, Index=0, Wrap=True)
left_connection = Geometry(list_item_2)
right_connection = Geometry(list_item)
left_connection_2 = ClusterOutput(left_connection)
right_connection_2 = ClusterOutput(right_connection)

# ---- group: BUILD 3D (continued)
unit_z_3 = UnitZ(Factor=addition_inset)
slot_solid = Extrude(Base=flip.Surface, Direction=unit_z_3)
stone_solid = Extrude(Base=flip_2.Surface, Direction=unit_z_3)
move_4 = Move(Geometry=slot_solid, Motion=Vector(0, 0, 0.01))  # -> Geometry, Transform

# ----
mesh_brep = MeshBrep(
    Brep=move_4.Geometry,
    Settings={GridMaxCount=0, GridMinCount=16, JaggedSeams=False, MaxEdgeLength=0, MinEdgeLength=0.0001, MinTolerance=0, Refine=True, RefineAngle=0, RelativeTolerance=0.65, SimplePlanes=True, Tolerance=0})

# ---- group: BUILD 3D (continued)
mesh_diff = Script(A=ilter, B=mesh_brep)  # -> out, result; inputs A: list of Mesh, B: list of Mesh
# ---------- mesh_diff: Python ----------
import Rhino.Geometry as rg


A = [mesh for mesh in A if mesh] if A else []
B = [mesh for mesh in B if mesh] if B else []


if not A:
    result = []

elif not B:
    result = A

else:
    diff = rg.Mesh.CreateBooleanDifference(
        A,
        B
    )

    result = list(diff) if diff else []
# ---------- end mesh_diff ----------
mesh_diff_2 = Script(A=mesh_diff.result, B=stone_solid)  # -> out, result; inputs A: list of Mesh, B: list of Mesh; same code as mesh_diff

# ----
_3d_preview = Geometry(mesh_diff_2.result)
stream_filter = StreamFilter(Gate=enable_2, Stream0=bs, Stream1=_3d_preview)
_3d_preview_2 = Geometry(stream_filter)
_3d_preview_3 = ClusterOutput(_3d_preview_2)

# ==== cluster MULTINAME2LOOPSNECKLACEMAKER
allow_single_name_addition = ClusterInput()
single_name_diamond_side = ClusterInput()
single_name_addition_distance = ClusterInput()
allow_3d = ClusterInput()
enable_chain_generation = ClusterInput()
enable = ClusterInput()
left_pivots = ClusterInput()
right_pivots = ClusterInput()
connectionlinkgeometry = ClusterInput()
linkgeometry = ClusterInput()
preview_geos = ClusterInput()
stones = ClusterInput()
gravity = ClusterInput()
addition_weight = ClusterInput()
smoothchain = ClusterInput()
iterations = ClusterInput()
gravitystrength = ClusterInput()
chainsmoothness = ClusterInput()
stone_addition = ClusterInput()
stone_socket_addition = ClusterInput()
chain_tail = ClusterInput()
necklace_depth = ClusterInput()
necklace_samples = ClusterInput()
addition_gap = ClusterInput()
namecount = ClusterInput()
linkpitch = ClusterInput()
diamond_geo = ClusterInput()
totallength = ClusterInput()
chain_lift = ClusterInput()
enable_diamond = ClusterInput()
enable_2 = Boolean(enable)
left_pivots_2 = Point(left_pivots)
right_pivots_2 = Point(right_pivots)
preview_geos_2 = Geometry(preview_geos)
name_positions = Script(TotalLength=totallength, NameCount=namecount)  # -> out, Positions; inputs TotalLength: Double, NameCount: Int32
# ---------- name_positions: Python ----------
count = max(1, min(5, int(NameCount)))
length = float(TotalLength)

Positions = []

for i in range(count):
    x = length * float(i + 1) / float(count + 1)
    Positions.append(x)
# ---------- end name_positions ----------
inscription_placer = Script(
    Enable=enable_2,
    Geometry=flatten(preview_geos_2),
    LeftConnections=flatten(left_pivots_2),
    RightConnections=flatten(right_pivots_2),
    Positions=flatten(name_positions.Positions))  # -> out, Transforms, MovedGeometry, MovedLeft, MovedRight, Debug; inputs Enable: Boolean, Geometry: list of GeometryBase, LeftConnections: list of Point3d, RightConnections: list of Point3d, Positions: list of Double
# ---------- inscription_placer: Python ----------
import Rhino.Geometry as rg


MovedGeometry = []
MovedLeft = []
MovedRight = []
Transforms = []
MoveVectors = []

Debug = []


if Enable:

    count = min(
        len(Geometry),
        len(LeftConnections),
        len(RightConnections),
        len(Positions)
    )

    Debug.append("COUNT = {}".format(count))


    for i in range(count):

        geo = Geometry[i]
        left = LeftConnections[i]
        right = RightConnections[i]
        target_x = float(Positions[i])


        if geo is None:
            Debug.append("{}: GEO NONE".format(i))
            continue

        if left is None:
            Debug.append("{}: LEFT NONE".format(i))
            continue

        if right is None:
            Debug.append("{}: RIGHT NONE".format(i))
            continue


        Debug.append(
            "{}: TYPE = {}".format(
                i,
                geo.GetType().FullName
            )
        )


        # --------------------------------------------
        # CURRENT CENTER
        # --------------------------------------------

        center = rg.Point3d(
            (left.X + right.X) * 0.5,
            (left.Y + right.Y) * 0.5,
            (left.Z + right.Z) * 0.5
        )


        # --------------------------------------------
        # TARGET
        # --------------------------------------------

        target = rg.Point3d(
            target_x,
            0.0,
            0.0
        )


        move = rg.Vector3d(
            target.X - center.X,
            target.Y - center.Y,
            target.Z - center.Z
        )


        xform = rg.Transform.Translation(
            move
        )


        # --------------------------------------------
        # EXPLICIT DUPLICATION
        # --------------------------------------------

        moved_geo = None

        if isinstance(geo, rg.Mesh):

            moved_geo = geo.DuplicateMesh()

        elif isinstance(geo, rg.Brep):

            moved_geo = geo.DuplicateBrep()

        elif isinstance(geo, rg.Curve):

            moved_geo = geo.DuplicateCurve()

        elif isinstance(geo, rg.Extrusion):

            moved_geo = geo.Duplicate()

        else:

            try:
                moved_geo = geo.DuplicateGeometry()
            except Exception as ex:
                Debug.append(
                    "{}: DUPLICATE FAILED: {}".format(
                        i,
                        str(ex)
                    )
                )


        if moved_geo is None:

            Debug.append(
                "{}: DUPLICATE RETURNED NONE".format(i)
            )

            continue


        # --------------------------------------------
        # TRANSFORM
        # --------------------------------------------

        success = moved_geo.Transform(
            xform
        )

        Debug.append(
            "{}: TRANSFORM = {}".format(
                i,
                success
            )
        )


        moved_left = rg.Point3d(
            left
        )

        moved_right = rg.Point3d(
            right
        )

        moved_left.Transform(
            xform
        )

        moved_right.Transform(
            xform
        )


        # --------------------------------------------
        # OUTPUT
        # --------------------------------------------

        MovedGeometry.append(
            moved_geo
        )

        MovedLeft.append(
            moved_left
        )

        MovedRight.append(
            moved_right
        )

        Transforms.append(
            xform
        )

        MoveVectors.append(
            move
        )


else:

    Debug.append(
        "ENABLE = FALSE"
    )

Debug = "\n".join(Debug)
# ---------- end inscription_placer ----------
necklace_depth_2 = Number(necklace_depth)
necklace_samples_2 = Number(necklace_samples)
chain_centerlines = Script(
    LeftPoints=flatten(inscription_placer.MovedLeft),
    RightPoints=flatten(inscription_placer.MovedRight),
    TotalLength=totallength)  # -> out, ChainLines, ChainLengths, StartPoint, EndPoint; inputs LeftPoints: list of Point3d, RightPoints: list of Point3d, TotalLength: Double
# ---------- chain_centerlines: Python ----------
import Rhino.Geometry as rg


length = float(TotalLength)

StartPoint = rg.Point3d(0, 0, 0)
EndPoint = rg.Point3d(length, 0, 0)

ChainLines = []
ChainLengths = []

count = min(len(LeftPoints), len(RightPoints))

if count > 0:

    # Start -> first inscription
    line = rg.LineCurve(
        StartPoint,
        LeftPoints[0]
    )

    ChainLines.append(line)
    ChainLengths.append(line.GetLength())

    # Between inscriptions
    for i in range(count - 1):

        line = rg.LineCurve(
            RightPoints[i],
            LeftPoints[i + 1]
        )

        ChainLines.append(line)
        ChainLengths.append(line.GetLength())

    # Last inscription -> end
    line = rg.LineCurve(
        RightPoints[count - 1],
        EndPoint
    )

    ChainLines.append(line)
    ChainLengths.append(line.GetLength())
# ---------- end chain_centerlines ----------
necklace_guide = Script(TotalLength=totallength, Depth=necklace_depth_2, Samples=necklace_samples_2)  # -> out, GuideCurve, GuidePoints, ActualLength; inputs TotalLength: Double, Depth: Double, Samples: Int32
# ---------- necklace_guide: Python ----------
import Rhino.Geometry as rg


GuideCurve = None
GuidePoints = []
ActualLength = 0.0


# ------------------------------------------------------------
# INPUTS
# ------------------------------------------------------------

length = max(1.0, float(TotalLength))
depth = max(0.0, float(Depth))
samples = max(10, int(Samples))


# ------------------------------------------------------------
# GUIDE POINTS
# ------------------------------------------------------------

points = []

for i in range(samples + 1):

    u = float(i) / float(samples)

    x_norm = u * 2.0 - 1.0

    x = u * length
    y = depth * x_norm * x_norm

    points.append(
        rg.Point3d(x, y, 0.0)
    )


# ------------------------------------------------------------
# CREATE NURBS CURVE
# ------------------------------------------------------------

curve = rg.NurbsCurve.Create(
    False,      # periodic
    3,          # degree
    points
)


# ------------------------------------------------------------
# SCALE TO EXACT CURVE LENGTH
# ------------------------------------------------------------

if curve is not None and curve.IsValid:

    current_length = curve.GetLength()

    if current_length > 1e-9:

        scale = length / current_length

        xform = rg.Transform.Scale(
            rg.Point3d.Origin,
            scale
        )

        curve.Transform(xform)


    # --------------------------------------------------------
    # OUTPUT
    # --------------------------------------------------------

    if curve.IsValid:

        GuideCurve = curve
        ActualLength = curve.GetLength()

        parameters = curve.DivideByCount(
            samples,
            True
        )

        if parameters:
            GuidePoints = [
                curve.PointAt(t)
                for t in parameters
            ]
# ---------- end necklace_guide ----------
name_layout = Script(
    TotalLength=totallength,
    LeftConnections=inscription_placer.MovedLeft,
    RightConnections=inscription_placer.MovedRight,
    Geometry=inscription_placer.MovedGeometry,
    Positions=name_positions.Positions,
    GuideCurve=necklace_guide.GuideCurve)  # -> out, Geometry, MovedLeft, MovedRight, Transforms, Points; inputs TotalLength: Double, LeftConnections: list of Point3d, RightConnections: list of Point3d, Geometry: list of GeometryBase, Positions: list of Double, GuideCurve: Curve
# ---------- name_layout: Python ----------
import Rhino.Geometry as rg
import math


GeometryOut = []
Transforms = []
Points = []
MovedLeft = []
MovedRight = []


if GuideCurve:

    count = min(
        len(Geometry),
        len(LeftConnections),
        len(RightConnections),
        len(Positions)
    )

    for i in range(count):

        geo = Geometry[i]
        left = LeftConnections[i]
        right = RightConnections[i]
        x = float(Positions[i])

        if geo is None or left is None or right is None:
            continue


        # --------------------------------------------
        # POSITION ON GUIDE
        # --------------------------------------------

        u = x / float(TotalLength)

        u = max(
            0.0,
            min(1.0, u)
        )

        ok, t = GuideCurve.NormalizedLengthParameter(
            u
        )

        if not ok:
            continue

        target_point = GuideCurve.PointAt(t)

        tangent = GuideCurve.TangentAt(t)

        if not tangent.Unitize():
            continue


        # --------------------------------------------
        # ROTATION
        # --------------------------------------------

        angle = math.atan2(
            tangent.Y,
            tangent.X
        )

        source_center = rg.Point3d(
            x,
            0.0,
            0.0
        )

        rotation = rg.Transform.Rotation(
            angle,
            rg.Vector3d.ZAxis,
            source_center
        )


        # --------------------------------------------
        # TRANSLATION
        # --------------------------------------------

        rotated_center = rg.Point3d(
            source_center
        )

        rotated_center.Transform(
            rotation
        )

        move = (
            target_point -
            rotated_center
        )

        translation = rg.Transform.Translation(
            move
        )

        xform = (
            translation *
            rotation
        )


        # --------------------------------------------
        # NAME GEOMETRY
        # --------------------------------------------

        try:
            moved_geo = geo.Duplicate()

        except:
            try:
                moved_geo = geo.DuplicateGeometry()
            except:
                moved_geo = None

        if moved_geo is None:
            continue

        moved_geo.Transform(
            xform
        )


        # --------------------------------------------
        # CONNECTION POINTS
        # --------------------------------------------

        moved_left = rg.Point3d(
            left
        )

        moved_right = rg.Point3d(
            right
        )

        moved_left.Transform(
            xform
        )

        moved_right.Transform(
            xform
        )


        # --------------------------------------------
        # OUTPUTS
        # --------------------------------------------

        GeometryOut.append(
            moved_geo
        )

        MovedLeft.append(
            moved_left
        )

        MovedRight.append(
            moved_right
        )

        Transforms.append(
            xform
        )

        Points.append(
            target_point
        )


Geometry = GeometryOut
# ---------- end name_layout ----------
number_slider = Slider(0.88, range=0..1)
gravitystrength_2 = Number(gravitystrength)
iterations_2 = Number(iterations)
addition_weight_2 = Number(addition_weight)
addition_gap_2 = Number(addition_gap)
gravity_2 = Boolean(gravity)
gravity_layout = Script(
    Enabled=gravity_2,
    Geometry=name_layout.Geometry,
    MovedLeft=name_layout.MovedLeft,
    MovedRight=name_layout.MovedRight,
    GuideCurve=necklace_guide.GuideCurve,
    GravityStrength=gravitystrength_2,
    Iterations=iterations_2,
    AdditionWidth=addition_gap_2,
    AdditionWeight=addition_weight_2)  # -> out, Geometry, MovedLeft, MovedRight, Transforms, Points, AdditionPlanes, AdditionCenters, Info; inputs Enabled: Boolean, Geometry: list of GeometryBase, MovedLeft: list of Point3d, MovedRight: list of Point3d, ChainLengths: list of Double, GuideCurve: Curve, GravityStrength: Double, Iterations: Int32, AdditionWidth: Double, AdditionWeight: Double
# ---------- gravity_layout: Python ----------
import Rhino.Geometry as rg
import math

# GRAVITY LAYOUT v1 - 2D lightweight position-based relaxation
# ChainLengths must contain N+1 values in order:
# outer-left -> name0, name0 -> name1, ..., nameN-1 -> outer-right.
# This is a visual approximation, not a physical equilibrium solver.

GeometryOut = []
MovedLeftOut = []
MovedRightOut = []
Transforms = []
Points = []
Info = []
AdditionPlanes = []
AdditionCenters = []


def vec(a, b):
    return [b[0] - a[0], b[1] - a[1]]


def length(v):
    return math.hypot(v[0], v[1])


def unit(v, fallback=(1.0, 0.0)):
    d = length(v)
    if d < 1e-10:
        return [fallback[0], fallback[1]]
    return [v[0] / d, v[1] / d]


def rot(v, angle):
    c, s = math.cos(angle), math.sin(angle)
    return [c * v[0] - s * v[1], s * v[0] + c * v[1]]


def endpoint(i, side, centers, angles, offsets):
    o = rot(offsets[i][side], angles[i])
    return [centers[i][0] + o[0], centers[i][1] + o[1]]


def duplicate(g):
    try:
        return g.DuplicateGeometry()
    except:
        try:
            return g.Duplicate()
        except:
            return None


def make_output(geo, left, right, original_center, new_center, angle):
    pivot = rg.Point3d(original_center[0], original_center[1], original_center[2])
    rotation = rg.Transform.Rotation(angle, rg.Vector3d.ZAxis, pivot)
    translation = rg.Transform.Translation(
        new_center[0] - original_center[0],
        new_center[1] - original_center[1],
        0.0
    )
    xform = translation * rotation
    g = duplicate(geo)
    if g is None:
        return None
    g.Transform(xform)
    l = rg.Point3d(left)
    r = rg.Point3d(right)
    l.Transform(xform)
    r.Transform(xform)
    return g, l, r, xform


try:
    n = min(len(Geometry), len(MovedLeft), len(MovedRight))
except:
    n = 0

valid = n > 0 and GuideCurve is not None
if valid:
    for i in range(n):
        if Geometry[i] is None or MovedLeft[i] is None or MovedRight[i] is None:
            valid = False
            Info.append('Missing geometry or connection at name {}'.format(i))
            break

if valid:
    try:
        gravity = max(0.0, min(1.0, float(GravityStrength)))
    except:
        gravity = 0.5
    try:
        iterations = max(1, min(150, int(Iterations)))
    except:
        iterations = 30
    enabled = bool(Enabled)

    left_anchor = GuideCurve.PointAtStart
    right_anchor = GuideCurve.PointAtEnd
    anchor_l = [left_anchor.X, left_anchor.Y]
    anchor_r = [right_anchor.X, right_anchor.Y]

    original = []
    centers = []
    offsets = []
    angles = [0.0] * n
    for i in range(n):
        l = MovedLeft[i]
        r = MovedRight[i]
        center = [(l.X + r.X) * 0.5, (l.Y + r.Y) * 0.5, (l.Z + r.Z) * 0.5]
        original.append(center)
        centers.append([center[0], center[1]])
        offsets.append([
            [l.X - center[0], l.Y - center[1]],
            [r.X - center[0], r.Y - center[1]]
        ])

    # Build rigid objects: NAME, STONE, NAME, ... .
    # A stone is a lightweight rigid bar of AdditionWidth with two
    # connection points; no diamond meshes are simulated.
    try:
        widths_in = [max(0.0, float(v)) for v in AdditionWidth if v is not None]
    except:
        try:
            widths_in = [max(0.0, float(AdditionWidth))]
        except:
            widths_in = []
    widths = ([widths_in[0]] * (n - 1) if len(widths_in) == 1
              else [widths_in[i] if i < len(widths_in) else 0.0
                    for i in range(n - 1)])
    try:
        addition_weight = max(0.0, float(AdditionWeight))
    except:
        addition_weight = 0.3

    # Stone centers initially sit on the guide near the middle of
    # the two adjacent name connection points.
    objects = []
    for i in range(n):
        objects.append({
            'kind': 'name', 'index': i,
            'center': centers[i][:], 'angle': 0.0,
            'offsets': offsets[i], 'weight': 1.0
        })
        if i < n - 1 and widths[i] > 1e-8:
            midpoint = rg.Point3d(
                (MovedRight[i].X + MovedLeft[i + 1].X) * 0.5,
                (MovedRight[i].Y + MovedLeft[i + 1].Y) * 0.5, 0.0)
            ok, t = GuideCurve.ClosestPoint(midpoint)
            gp = GuideCurve.PointAt(t) if ok else midpoint
            tangent = GuideCurve.TangentAt(t) if ok else rg.Vector3d.XAxis
            angle = math.atan2(tangent.Y, tangent.X)
            half = widths[i] * 0.5
            objects.append({
                'kind': 'stone', 'index': i,
                'center': [gp.X, gp.Y], 'angle': angle,
                'offsets': [[-half, 0.0], [half, 0.0]],
                'weight': addition_weight
            })

    def obj_endpoint(j, side):
        obj = objects[j]
        o = rot(obj['offsets'][side], obj['angle'])
        return [obj['center'][0] + o[0], obj['center'][1] + o[1]]

    def span_points(k):
        a = anchor_l if k == 0 else obj_endpoint(k - 1, 1)
        b = anchor_r if k == len(objects) else obj_endpoint(k, 0)
        return a, b

    measured = [length(vec(*span_points(k)))
                for k in range(len(objects) + 1)]
    try:
        supplied = [float(x) for x in ChainLengths]
    except:
        supplied = []
    # N+1 lengths are the OLD unsplit spans; these do not map to
    # N+stones+1 chain spans. Do not add stone widths to them.
    # Preserve actual initial chain gaps for the joint solver.
    targets = measured[:]
    if len(objects) == n and len(supplied) == n + 1 and all(v > 0 for v in supplied):
        targets = supplied
        Info.append('Using supplied N+1 chain targets')
    else:
        Info.append('Using measured individual chain targets (stone-aware)')

    if enabled and gravity > 0.0:
        for iteration in range(iterations):
            for obj in objects:
                obj['center'][1] -= 0.12 * gravity * obj['weight']
            for sweep in range(3):
                for k in range(len(objects) + 1):
                    pa, pb = span_points(k)
                    d = vec(pa, pb)
                    dist = length(d)
                    if dist < 1e-9:
                        continue
                    err = dist - targets[k]
                    ux, uy = d[0] / dist, d[1] / dist
                    ai = k - 1 if k > 0 else None
                    bi = k if k < len(objects) else None
                    wa = objects[ai]['weight'] if ai is not None else 0.0
                    wb = objects[bi]['weight'] if bi is not None else 0.0
                    total = wa + wb
                    if total < 1e-9:
                        continue
                    # Mass-inspired inverse weights, fixed anchors.
                    ca = (1.0 / max(0.05, wa)) if ai is not None else 0.0
                    cb = (1.0 / max(0.05, wb)) if bi is not None else 0.0
                    denom = ca + cb
                    if denom < 1e-9:
                        continue
                    for j, side, sign, share in (
                        (ai, 1, 1.0, ca / denom),
                        (bi, 0, -1.0, cb / denom)
                    ):
                        if j is None:
                            continue
                        obj = objects[j]
                        step = 0.7 * err * share
                        obj['center'][0] += sign * step * ux
                        obj['center'][1] += sign * step * uy
                        arm = rot(obj['offsets'][side], obj['angle'])
                        torque = arm[0] * (sign * err * uy) - arm[1] * (sign * err * ux)
                        inertia = max(1.0, arm[0] ** 2 + arm[1] ** 2)
                        obj['angle'] += max(-0.035, min(0.035, 0.05 * torque / inertia))
            for obj in objects:
                if obj['kind'] == 'stone':
                    obj['angle'] *= 0.995

    # Copy relaxed name state back into the original output contract.
    for obj in objects:
        if obj['kind'] == 'name':
            i = obj['index']
            centers[i] = obj['center']
            angles[i] = obj['angle']
        else:
            i = obj['index']
            center = obj['center']
            angle = obj['angle']
            plane = rg.Plane(
                rg.Point3d(center[0], center[1], 0.0),
                rg.Vector3d.XAxis, rg.Vector3d.YAxis)
            plane.Rotate(angle, plane.ZAxis)
            AdditionPlanes.append(plane)
            AdditionCenters.append(plane.Origin)
    for i in range(n):
        item = make_output(Geometry[i], MovedLeft[i], MovedRight[i], original[i], centers[i], angles[i])
        if item is None:
            Info.append('Could not duplicate name {}'.format(i))
            continue
        g, l, r, xform = item
        GeometryOut.append(g)
        MovedLeftOut.append(l)
        MovedRightOut.append(r)
        Transforms.append(xform)
        Points.append(rg.Point3d(centers[i][0], centers[i][1], original[i][2]))

    residuals = [abs(length(vec(*span_points(k))) - targets[k]) for k in range(len(objects) + 1)]
    Info.append('Names: {}, Stones: {}'.format(n, len(AdditionPlanes)))
    Info.append('Iterations: {}'.format(iterations if enabled else 0))
    Info.append('Maximum chain length error: {:.4f}'.format(max(residuals)))
    Info.append('Mode: joint name+stone relaxation' if enabled else 'Mode: passthrough')
else:
    Info.append('Missing GuideCurve or name geometry/connection inputs')

# Alias to match the old NAME LAYOUT output convention.
Geometry = GeometryOut
MovedLeft = MovedLeftOut
MovedRight = MovedRightOut
# ---------- end gravity_layout ----------
samples = Slider(20, range=0..100)
single_name_addition_distance_2 = Number(single_name_addition_distance)
allow_single_name_addition_2 = Boolean(allow_single_name_addition)
single_name_diamond_side_2 = Integer(single_name_diamond_side)
enable_diamond_2 = Boolean(enable_diamond)
smoothchain_2 = Boolean(smoothchain)
chainsmoothness_2 = Number(chainsmoothness)
diamond_geo_2 = Geometry(diamond_geo)
chain_tail_2 = Number(chain_tail)
chain_lift_2 = Number(chain_lift)
necklace_layout = Script(
    SmoothChain=smoothchain_2,
    ChainSmoothness=Slider(1, range=0..1),
    TotalLength=totallength,
    PreviewTailLength=chain_tail_2,
    SingleNameLift=chain_lift_2,
    StraightChainLines=chain_centerlines.ChainLines,
    MovedLeft=gravity_layout.MovedLeft,
    MovedRight=gravity_layout.MovedRight,
    GuideCurve=necklace_guide.GuideCurve,
    Samples=samples,
    AdditionEnabled=enable_diamond_2,
    AdditionWidth=addition_gap_2,
    GravityAdditionPlanes=gravity_layout.AdditionPlanes,
    SingleNameAddition=allow_single_name_addition_2,
    SingleNameAdditionSide=single_name_diamond_side_2,
    SingleNameAdditionDistance=single_name_addition_distance_2)  # -> out, ChainLines, ChainLengths, AdditionPlanes, AdditionCenters, StartIsName, EndIsName, StartIsAddition, EndIsAddition; inputs SmoothChain: Boolean, ChainSmoothness: Double, TotalLength: Double, PreviewTailLength: Double, SingleNameLift: Double, StraightChainLines: list of Curve, MovedLeft: list of Point3d, MovedRight: list of Point3d, GuideCurve: Curve, Samples: Int32, AdditionEnabled: Boolean, AdditionWidth: list of Double, GravityAdditionPlanes: list of Plane, SingleNameAddition: Boolean, SingleNameAdditionSide: Int32, SingleNameAdditionDistance: Double
# ---------- necklace_layout: Python ----------
import Rhino.Geometry as rg
ChainLines = []
ChainLengths = []
AdditionPlanes = []
AdditionCenters = []
StartIsName = []
EndIsName = []
StartIsAddition = []
EndIsAddition = []
total_length = max(
    0.001,
    float(TotalLength)
)
samples = max(
    4,
    int(Samples)
)
# AdditionWidth is now a LIST:
# one width per internal addition / gap between names.
#
# Backward compatibility:
#   []        -> width 0.0
#   [0.8]     -> use 0.8 for every addition
#   [0.8,1.2] -> first addition uses 0.8, second uses 1.2, etc.
try:
    addition_widths = [
        max(0.0, float(w))
        for w in AdditionWidth
        if w is not None
    ]
except:
    try:
        addition_widths = [
            max(0.0, float(AdditionWidth))
        ]
    except:
        addition_widths = []
def get_addition_width(addition_index):
    if not addition_widths:
        return 0.0
    # One supplied value keeps the old behavior:
    # same width everywhere.
    if len(addition_widths) == 1:
        return addition_widths[0]
    # With multiple widths, match them by addition order.
    if 0 <= addition_index < len(addition_widths):
        return addition_widths[addition_index]
    # Missing width = no reserved addition space.
    return 0.0
preview_tail_length = max(
    0.001,
    float(PreviewTailLength)
)
single_name_lift = float(
    SingleNameLift
)
# --------------------------------------------------
# OPTIONAL ADDITION FOR SINGLE-NAME PRODUCTS
# --------------------------------------------------
# SingleNameAddition: bool, Item
# SingleNameAdditionSide: int, Item (0 = Left, 1 = Right)
# SingleNameAdditionDistance: float, Item
#
# AdditionWidth[0] is used for the single-name addition width.
try:
    single_name_addition = bool(SingleNameAddition)
except:
    single_name_addition = False
try:
    single_name_addition_side = int(SingleNameAdditionSide)
except:
    single_name_addition_side = 0
single_name_addition_side = 1 if single_name_addition_side == 1 else 0
try:
    single_name_addition_distance = max(
        0.0,
        float(SingleNameAdditionDistance)
    )
except:
    single_name_addition_distance = 0.0
# --------------------------------------------------
# HELPERS
# --------------------------------------------------
def guide_point_at_fraction(curve, u):
    u = max(
        0.0,
        min(1.0, u)
    )
    ok, t = curve.NormalizedLengthParameter(u)
    if not ok:
        return None
    return curve.PointAt(t)
def guide_plane_at_fraction(curve, u):
    u = max(
        0.0,
        min(1.0, u)
    )
    ok, t = curve.NormalizedLengthParameter(u)
    if not ok:
        return None
    point = curve.PointAt(t)
    tangent = curve.TangentAt(t)
    if not tangent.Unitize():
        return None
    x_axis = rg.Vector3d(
        tangent
    )
    y_axis = rg.Vector3d.CrossProduct(
        rg.Vector3d.ZAxis,
        x_axis
    )
    if not y_axis.Unitize():
        y_axis = rg.Vector3d.YAxis
    return rg.Plane(
        point,
        x_axis,
        y_axis
    )
def guide_fraction_at_point(
    curve,
    point
):
    if curve is None or point is None:
        return None
    ok, t = curve.ClosestPoint(
        point
    )
    if not ok:
        return None
    total = curve.GetLength()
    if total <= 1e-9:
        return None
    domain = curve.Domain
    if t <= domain.T0:
        return 0.0
    if t >= domain.T1:
        return 1.0
    partial = curve.GetLength(
        rg.Interval(
            domain.T0,
            t
        )
    )
    return (
        partial /
        total
    )
# Optional smoothing. Disconnected inputs preserve original behavior.
try:
    smooth_chain = bool(SmoothChain)
except (NameError, TypeError):
    smooth_chain = False
try:
    chain_smoothness = max(0.0, min(1.0, float(ChainSmoothness)))
except (NameError, TypeError, ValueError):
    chain_smoothness = 0.0

def build_segment(guide, u0, u1, start_point, end_point, sample_count):
    if start_point is None or end_point is None:
        return None
    n = max(4, int(sample_count))
    start_point = rg.Point3d(start_point)
    end_point = rg.Point3d(end_point)
    guide_start = guide_point_at_fraction(guide, u0)
    guide_end = guide_point_at_fraction(guide, u1)
    if guide_start is None or guide_end is None:
        return None
    start_delta = start_point - guide_start
    end_delta = end_point - guide_end
    points = []
    for i in range(n + 1):
        f = float(i) / n
        u = u0 + (u1 - u0) * f
        p = guide_point_at_fraction(guide, u)
        if p is None:
            return None
        if smooth_chain and chain_smoothness > 0.0:
            # Smoothstep blends endpoint displacement through the
            # segment, rather than creating sharp endpoint kinks.
            eased = f * f * (3.0 - 2.0 * f)
            start_weight = (1.0 - chain_smoothness) * (1.0 - f) ** 8 + chain_smoothness * (1.0 - eased)
            end_weight = (1.0 - chain_smoothness) * f ** 8 + chain_smoothness * eased
            p = p + start_delta * start_weight + end_delta * end_weight
        points.append(p)
    points[0] = start_point
    points[-1] = end_point
    try:
        return rg.Curve.CreateInterpolatedCurve(points, 3)
    except:
        return None

def build_straight_tail(
    start_point,
    end_point
):
    if (
        start_point is None
        or end_point is None
    ):
        return None
    if start_point.DistanceTo(
        end_point
    ) <= 1e-9:
        return None
    return rg.LineCurve(
        rg.Point3d(start_point),
        rg.Point3d(end_point)
    )
def straight_plane_at_point(point, direction):
    if point is None:
        return None
    x_axis = rg.Vector3d(direction)
    if not x_axis.Unitize():
        return None
    y_axis = rg.Vector3d.CrossProduct(
        rg.Vector3d.ZAxis,
        x_axis
    )
    if not y_axis.Unitize():
        y_axis = rg.Vector3d.YAxis
    return rg.Plane(
        rg.Point3d(point),
        x_axis,
        y_axis
    )
def add_chain_segment(
    curve,
    start_is_name,
    end_is_name,
    start_is_addition=False,
    end_is_addition=False
):
    if curve is None:
        return
    if curve.GetLength() <= 1e-9:
        return
    ChainLines.append(
        curve
    )
    ChainLengths.append(
        curve.GetLength()
    )
    StartIsName.append(
        bool(start_is_name)
    )
    EndIsName.append(
        bool(end_is_name)
    )
    StartIsAddition.append(
        bool(start_is_addition)
    )
    EndIsAddition.append(
        bool(end_is_addition)
    )
# --------------------------------------------------
# MAIN
# --------------------------------------------------
if (
    GuideCurve
    and StraightChainLines
    and MovedLeft
    and MovedRight
):
    count = len(
        StraightChainLines
    )
    name_count = min(
        len(MovedLeft),
        len(MovedRight)
    )
    guide_length = GuideCurve.GetLength()
    single_name = (
        name_count == 1
    )
    # ------------------------------------------------
    # FIND FIRST / LAST NAME LOCATION ON GUIDE
    # ------------------------------------------------
    first_name_u = guide_fraction_at_point(
        GuideCurve,
        MovedLeft[0]
    )
    last_name_u = guide_fraction_at_point(
        GuideCurve,
        MovedRight[name_count - 1]
    )
    # Fallbacks
    if first_name_u is None:
        first_name_u = 0.0
    if last_name_u is None:
        last_name_u = 1.0
    # ------------------------------------------------
    # PREVIEW TAIL LIMITS
    # ------------------------------------------------
    if guide_length > 1e-9:
        tail_u = (
            preview_tail_length /
            guide_length
        )
    else:
        tail_u = 0.0
    preview_start_u = max(
        0.0,
        first_name_u - tail_u
    )
    preview_end_u = min(
        1.0,
        last_name_u + tail_u
    )
    # ------------------------------------------------
    # PROCESS ORIGINAL CHAIN SECTIONS
    # ------------------------------------------------
    for i, straight_curve in enumerate(
        StraightChainLines
    ):
        if straight_curve is None:
            continue
        # ==========================================
        # FIRST OUTER CHAIN
        # preview start -> NAME
        # ==========================================
        if i == 0:
            name_point = MovedLeft[0]
            # --------------------------------------
            # ONE NAME:
            # straight / flatter chain tail
            # --------------------------------------
            if single_name:
                plane = guide_plane_at_fraction(
                    GuideCurve,
                    first_name_u
                )
                if plane is None:
                    continue
                direction = rg.Vector3d(
                    plane.XAxis
                )
                if not direction.Unitize():
                    continue
                # Move outward to the LEFT
                tail_start = (
                    rg.Point3d(name_point)
                    -
                    direction * preview_tail_length
                )
                # Slight upward angle for single-name preview
                tail_start.Y += single_name_lift
                use_single_addition_here = (
                    single_name_addition
                    and single_name_addition_side == 0
                    and AdditionEnabled
                    and get_addition_width(0) > 0.0
                )
                if use_single_addition_here:
                    addition_width = get_addition_width(0)
                    outward = (
                        rg.Point3d(tail_start)
                        - rg.Point3d(name_point)
                    )
                    available_length = outward.Length
                    if outward.Unitize() and available_length > addition_width:
                        half_width = addition_width * 0.5
                        center_distance = max(
                            half_width,
                            min(
                                single_name_addition_distance,
                                available_length - half_width
                            )
                        )
                        addition_center = (
                            rg.Point3d(name_point)
                            + outward * center_distance
                        )
                        outer_edge = (
                            addition_center
                            + outward * half_width
                        )
                        name_edge = (
                            addition_center
                            - outward * half_width
                        )
                        addition_plane = straight_plane_at_point(
                            addition_center,
                            -outward
                        )
                        if addition_plane is not None:
                            AdditionPlanes.append(addition_plane)
                            AdditionCenters.append(addition_plane.Origin)
                        # OUTER TAIL -> ADDITION
                        outer_curve = build_straight_tail(
                            tail_start,
                            outer_edge
                        )
                        add_chain_segment(
                            outer_curve,
                            False,
                            False,
                            False,
                            True
                        )
                        # ADDITION -> NAME
                        inner_curve = build_straight_tail(
                            name_edge,
                            name_point
                        )
                        add_chain_segment(
                            inner_curve,
                            False,
                            True,
                            True,
                            False
                        )
                        # Prevent the normal outer-chain call below
                        # from creating a duplicate full segment.
                        curve = None
                    else:
                        curve = build_straight_tail(
                            tail_start,
                            name_point
                        )
                else:
                    curve = build_straight_tail(
                        tail_start,
                        name_point
                    )
            # --------------------------------------
            # MULTIPLE NAMES:
            # follow existing necklace guide
            # --------------------------------------
            else:
                start_point = guide_point_at_fraction(
                    GuideCurve,
                    preview_start_u
                )
                curve = build_segment(
                    GuideCurve,
                    preview_start_u,
                    first_name_u,
                    start_point,
                    name_point,
                    samples
                )
            add_chain_segment(
                curve,
                False,
                True
            )
        # ==========================================
        # LAST OUTER CHAIN
        # NAME -> preview end
        # ==========================================
        elif i == count - 1:
            name_point = MovedRight[
                name_count - 1
            ]
            # --------------------------------------
            # ONE NAME:
            # straight / flatter chain tail
            # --------------------------------------
            if single_name:
                plane = guide_plane_at_fraction(
                    GuideCurve,
                    last_name_u
                )
                if plane is None:
                    continue
                direction = rg.Vector3d(
                    plane.XAxis
                )
                if not direction.Unitize():
                    continue
                # Move outward to the RIGHT
                tail_end = (
                    rg.Point3d(name_point)
                    +
                    direction * preview_tail_length
                )
                # Slight upward angle for single-name preview
                tail_end.Y += single_name_lift
                use_single_addition_here = (
                    single_name_addition
                    and single_name_addition_side == 1
                    and AdditionEnabled
                    and get_addition_width(0) > 0.0
                )
                if use_single_addition_here:
                    addition_width = get_addition_width(0)
                    outward = (
                        rg.Point3d(tail_end)
                        - rg.Point3d(name_point)
                    )
                    available_length = outward.Length
                    if outward.Unitize() and available_length > addition_width:
                        half_width = addition_width * 0.5
                        center_distance = max(
                            half_width,
                            min(
                                single_name_addition_distance,
                                available_length - half_width
                            )
                        )
                        addition_center = (
                            rg.Point3d(name_point)
                            + outward * center_distance
                        )
                        name_edge = (
                            addition_center
                            - outward * half_width
                        )
                        outer_edge = (
                            addition_center
                            + outward * half_width
                        )
                        addition_plane = straight_plane_at_point(
                            addition_center,
                            outward
                        )
                        if addition_plane is not None:
                            AdditionPlanes.append(addition_plane)
                            AdditionCenters.append(addition_plane.Origin)
                        # NAME -> ADDITION
                        inner_curve = build_straight_tail(
                            name_point,
                            name_edge
                        )
                        add_chain_segment(
                            inner_curve,
                            True,
                            False,
                            False,
                            True
                        )
                        # ADDITION -> OUTER TAIL
                        outer_curve = build_straight_tail(
                            outer_edge,
                            tail_end
                        )
                        add_chain_segment(
                            outer_curve,
                            False,
                            False,
                            True,
                            False
                        )
                        curve = None
                    else:
                        curve = build_straight_tail(
                            name_point,
                            tail_end
                        )
                else:
                    curve = build_straight_tail(
                        name_point,
                        tail_end
                    )
            # --------------------------------------
            # MULTIPLE NAMES:
            # follow existing necklace guide
            # --------------------------------------
            else:
                end_point = guide_point_at_fraction(
                    GuideCurve,
                    preview_end_u
                )
                curve = build_segment(
                    GuideCurve,
                    last_name_u,
                    preview_end_u,
                    name_point,
                    end_point,
                    samples
                )
            add_chain_segment(
                curve,
                True,
                False
            )
        # ==========================================
        # BETWEEN TWO NAMES
        # ==========================================
        else:
            # Internal segment index:
            # i = 1 -> addition 0
            # i = 2 -> addition 1
            # etc.
            addition_index = i - 1
            diamond_width = get_addition_width(
                addition_index
            )
            start_point = MovedRight[
                i - 1
            ]
            end_point = MovedLeft[
                i
            ]
            # --------------------------------------
            # ORIGINAL LOCATION OF INTERNAL SEGMENT
            # --------------------------------------
            start = straight_curve.PointAtStart
            end = straight_curve.PointAtEnd
            u0 = (
                start.X /
                total_length
            )
            u1 = (
                end.X /
                total_length
            )
            u0 = max(
                0.0,
                min(1.0, u0)
            )
            u1 = max(
                0.0,
                min(1.0, u1)
            )
            if u1 < u0:
                u0, u1 = u1, u0
            # --------------------------------------
            # NO DIAMOND
            # NAME -> NAME
            # --------------------------------------
            if (
                not AdditionEnabled
                or diamond_width <= 0.0
                or guide_length <= 1e-9
            ):
                curve = build_segment(
                    GuideCurve,
                    u0,
                    u1,
                    start_point,
                    end_point,
                    samples
                )
                add_chain_segment(
                    curve,
                    True,
                    True
                )
            # --------------------------------------
            # DIAMOND
            # --------------------------------------
            else:
                center_u = (
                    u0 + u1
                ) * 0.5
                half_u = (
                    diamond_width * 0.5 /
                    guide_length
                )
                left_u = (
                    center_u - half_u
                )
                right_u = (
                    center_u + half_u
                )
                left_u = max(
                    u0,
                    left_u
                )
                right_u = min(
                    u1,
                    right_u
                )
                diamond_left = guide_point_at_fraction(
                    GuideCurve,
                    left_u
                )
                diamond_right = guide_point_at_fraction(
                    GuideCurve,
                    right_u
                )
                diamond_plane = guide_plane_at_fraction(
                    GuideCurve,
                    center_u
                )
                # Optional solved stone plane from GRAVITY LAYOUT v3.
                # The plane controls BOTH visual placement and chain ends.
                try:
                    solved_plane = GravityAdditionPlanes[addition_index]
                    if solved_plane is not None:
                        diamond_plane = rg.Plane(solved_plane)
                        axis = rg.Vector3d(diamond_plane.XAxis)
                        axis.Unitize()
                        diamond_left = diamond_plane.Origin - axis * (diamond_width * 0.5)
                        diamond_right = diamond_plane.Origin + axis * (diamond_width * 0.5)
                        # Parameter values only control guide shape;
                        # final endpoint locations remain exact.
                        left_u_found = guide_fraction_at_point(GuideCurve, diamond_left)
                        right_u_found = guide_fraction_at_point(GuideCurve, diamond_right)
                        if left_u_found is not None:
                            left_u = max(u0, min(u1, left_u_found))
                        if right_u_found is not None:
                            right_u = max(u0, min(u1, right_u_found))
                except (NameError, IndexError, TypeError, AttributeError):
                    pass
                if diamond_plane is not None:
                    AdditionPlanes.append(
                        diamond_plane
                    )
                    AdditionCenters.append(
                        diamond_plane.Origin
                    )
                # ----------------------------------
                # NAME -> DIAMOND
                # ----------------------------------
                if diamond_left is not None:
                    left_curve = build_segment(
                        GuideCurve,
                        u0,
                        left_u,
                        start_point,
                        diamond_left,
                        samples
                    )
                    add_chain_segment(
                        left_curve,
                        True,
                        False,
                        False,
                        True
                    )
                # ----------------------------------
                # DIAMOND -> NAME
                # ----------------------------------
                if diamond_right is not None:
                    right_curve = build_segment(
                        GuideCurve,
                        right_u,
                        u1,
                        diamond_right,
                        end_point,
                        samples
                    )
                    add_chain_segment(
                        right_curve,
                        False,
                        True,
                        True,
                        False
                    )
# ---------- end necklace_layout ----------
diamond_placement = Script(Enabled=enable_diamond_2, DiamondGeometry=diamond_geo_2, DiamondPlanes=necklace_layout.AdditionPlanes)  # -> out, Diamonds, DiamondSockets; inputs Enabled: Boolean, DiamondGeometry: tree of GeometryBase, DiamondPlanes: list of Plane, DiamondIndices: list of Int32
# ---------- diamond_placement: Python ----------
import Rhino.Geometry as rg


DiamondSockets = []
Diamonds = []
Debug = []


# ============================================================
# HELPERS
# ============================================================

def duplicate_geometry(source_geo):
    if source_geo is None:
        return None

    try:
        return source_geo.DuplicateGeometry()
    except:
        pass

    try:
        return source_geo.Duplicate()
    except:
        pass

    return None


def get_branch(tree, branch_index):
    """
    Return one branch as a Python list.

    DiamondGeometry is expected as Tree access.
    Branch {0} = diamond type 0
    Branch {1} = diamond type 1
    etc.
    """

    if tree is None:
        return []

    try:
        branch_count = tree.BranchCount
    except:
        return []

    if branch_count <= 0:
        return []

    branch_index = int(branch_index)

    if branch_index < 0 or branch_index >= branch_count:
        return []

    try:
        return list(
            tree.Branch(branch_index)
        )
    except:
        return []


# ============================================================
# MAIN
# ============================================================

if Enabled and DiamondGeometry and DiamondPlanes:

    source_plane = rg.Plane.WorldXY

    try:
        branch_count = DiamondGeometry.BranchCount
    except:
        branch_count = 0


    Debug.append(
        "DIAMOND TYPES: {}".format(
            branch_count
        )
    )

    Debug.append(
        "PLACEMENTS: {}".format(
            len(DiamondPlanes)
        )
    )


    # --------------------------------------------------------
    # OPTIONAL INDICES
    # --------------------------------------------------------

    try:
        indices = list(DiamondIndices)
    except:
        indices = []


    if not indices:
        Debug.append(
            "DiamondIndices empty -> using branch 0 everywhere"
        )


    # ========================================================
    # PLACE EACH DIAMOND
    # ========================================================

    for plane_index, plane in enumerate(
        DiamondPlanes
    ):

        if plane is None:
            continue


        # ----------------------------------------------------
        # SELECT DIAMOND TYPE
        # ----------------------------------------------------

        if plane_index < len(indices):

            try:
                diamond_type = int(
                    indices[plane_index]
                )
            except:
                diamond_type = 0

        else:
            diamond_type = 0


        # Invalid index -> fallback to branch 0
        if (
            diamond_type < 0
            or
            diamond_type >= branch_count
        ):
            Debug.append(
                "Plane {}: invalid DiamondIndex {} -> using 0".format(
                    plane_index,
                    diamond_type
                )
            )

            diamond_type = 0


        geometry = get_branch(
            DiamondGeometry,
            diamond_type
        )


        if not geometry:
            Debug.append(
                "Plane {}: branch {} is empty".format(
                    plane_index,
                    diamond_type
                )
            )

            continue


        # Middle geometry = actual diamond
        diamond_index = len(geometry) // 2


        # ----------------------------------------------------
        # TRANSFORM
        # ----------------------------------------------------

        xform = rg.Transform.PlaneToPlane(
            source_plane,
            plane
        )


        for geo_index, source_geo in enumerate(
            geometry
        ):

            geo = duplicate_geometry(
                source_geo
            )

            if geo is None:
                continue


            geo.Transform(
                xform
            )


            # ------------------------------------------------
            # SORT OUTPUT
            # ------------------------------------------------

            if geo_index == 0:

                Diamonds.append(
                    geo
                )

            else:

                DiamondSockets.append(
                    geo
                )
# ---------- end diamond_placement ----------
enable_chain_generation_2 = Boolean(enable_chain_generation)
connectionlinkgeometry_2 = Geometry(connectionlinkgeometry)
names_geo = Geometry(gravity_layout.Geometry)
list_length = ListLength(List=flatten([diamond_placement.Diamonds, diamond_placement.DiamondSockets]))
chain_generator = Script(
    Enable=enable_chain_generation_2,
    ChainLines=necklace_layout.ChainLines,
    LinkGeometry=linkgeometry,
    LinkPitch=linkpitch,
    ConnectionLinkGeometry=connectionlinkgeometry_2,
    StartIsName=necklace_layout.StartIsName,
    EndIsName=necklace_layout.EndIsName,
    StartIsAddition=necklace_layout.StartIsAddition,
    EndIsAddition=necklace_layout.EndIsAddition)  # -> out, Links, LinkPoints, LinkPlanes, LinkCounts, ActualPitches; inputs Enable: Boolean, ChainLines: list of Curve, LinkGeometry: GeometryBase, LinkPitch: Double, ConnectionLinkGeometry: GeometryBase, StartIsName: list of Boolean, EndIsName: list of Boolean, StartIsAddition: list of Boolean, EndIsAddition: list of Boolean
# ---------- chain_generator: Python ----------
import Rhino.Geometry as rg
import math


Links = []
LinkPoints = []
LinkPlanes = []
LinkCounts = []
ActualPitches = []


pitch = max(
    0.001,
    float(LinkPitch)
)

source_plane = rg.Plane.WorldXY


# --------------------------------------------------
# KEEP EACH CURVE TOGETHER WITH ITS END TYPE
# --------------------------------------------------

segments = []

if Enable:

    for index, curve in enumerate(ChainLines):

        if curve is None:
            continue

        start_is_name = (
            bool(StartIsName[index])
            if index < len(StartIsName)
            else False
        )

        end_is_name = (
            bool(EndIsName[index])
            if index < len(EndIsName)
            else False
        )

        start_is_addition = (
            bool(StartIsAddition[index])
            if index < len(StartIsAddition)
            else False
        )

        end_is_addition = (
            bool(EndIsAddition[index])
            if index < len(EndIsAddition)
            else False
        )

        # Any object which needs the special connection link.
        start_is_connection = (
            start_is_name
            or start_is_addition
        )

        end_is_connection = (
            end_is_name
            or end_is_addition
        )

        segments.append(
            (
                curve,
                start_is_connection,
                end_is_connection
            )
        )


    segment_count = len(
        segments
    )


    # --------------------------------------------------
    # GENERATE LINKS
    # --------------------------------------------------

    for segment_index, data in enumerate(
        segments
    ):

        curve, start_is_connection, end_is_connection = data


        length = curve.GetLength()

        if length <= 1e-9:
            continue


        # --------------------------------------------
        # NUMBER OF SPACES
        # --------------------------------------------

        ideal_spaces = (
            length /
            pitch
        )

        spaces = max(
            2,
            int(round(ideal_spaces))
        )


        is_first_segment = (
            segment_index == 0
        )

        is_last_segment = (
            segment_index ==
            segment_count - 1
        )

        is_middle_segment = (
            not is_first_segment
            and not is_last_segment
        )


        # --------------------------------------------
        # MIDDLE SEGMENTS NEED EVEN PARITY
        # --------------------------------------------

        if (
            is_middle_segment
            and spaces % 2 != 0
        ):

            lower = spaces - 1
            upper = spaces + 1

            if lower < 2:

                spaces = upper

            else:

                lower_pitch = (
                    length /
                    float(lower)
                )

                upper_pitch = (
                    length /
                    float(upper)
                )

                lower_error = abs(
                    lower_pitch -
                    pitch
                )

                upper_error = abs(
                    upper_pitch -
                    pitch
                )

                spaces = (
                    lower
                    if lower_error <= upper_error
                    else upper
                )


        actual_pitch = (
            length /
            float(spaces)
        )


        LinkCounts.append(
            spaces - 1
        )

        ActualPitches.append(
            actual_pitch
        )


        # --------------------------------------------
        # CREATE LINKS
        # --------------------------------------------

        for i in range(
            1,
            spaces
        ):

            distance = (
                float(i) *
                actual_pitch
            )

            normalized = (
                distance /
                length
            )


            ok, t = curve.NormalizedLengthParameter(
                normalized
            )

            if not ok:
                continue


            point = curve.PointAt(
                t
            )

            tangent = curve.TangentAt(
                t
            )

            if not tangent.Unitize():
                continue


            # ----------------------------------------
            # PLANE FOLLOWS CHAIN CURVE
            # ----------------------------------------

            x_axis = rg.Vector3d(
                tangent
            )

            y_axis = rg.Vector3d.CrossProduct(
                rg.Vector3d.ZAxis,
                x_axis
            )

            if not y_axis.Unitize():
                y_axis = rg.Vector3d.YAxis


            plane = rg.Plane(
                point,
                x_axis,
                y_axis
            )


            # ----------------------------------------
            # LINK PARITY
            # ----------------------------------------

            if is_first_segment:

                rotate90 = (
                    (spaces - i) % 2 == 1
                )

            else:

                rotate90 = (
                    i % 2 == 1
                )


            if rotate90:

                plane.Rotate(
                    math.radians(90.0),
                    plane.XAxis
                )


            LinkPoints.append(
                point
            )

            LinkPlanes.append(
                plane
            )


            # ----------------------------------------
            # IS THIS LINK ATTACHED TO A CONNECTION?
            # NAME OR ADDITION
            # ----------------------------------------

            is_first_link = (
                i == 1
            )

            is_last_link = (
                i == spaces - 1
            )


            use_connection_link = (
                (
                    start_is_connection
                    and is_first_link
                )
                or
                (
                    end_is_connection
                    and is_last_link
                )
            )


            # ----------------------------------------
            # SELECT GEOMETRY
            # ----------------------------------------

            if (
                use_connection_link
                and ConnectionLinkGeometry is not None
            ):

                source_geo = ConnectionLinkGeometry

            else:

                source_geo = LinkGeometry


            if source_geo is None:
                continue


            # ----------------------------------------
            # DUPLICATE
            # ----------------------------------------

            try:

                geo = source_geo.Duplicate()

            except:

                try:

                    geo = source_geo.DuplicateGeometry()

                except:

                    geo = None


            if geo is None:
                continue


            # ----------------------------------------
            # PLACE GEOMETRY
            # ----------------------------------------

            xform = rg.Transform.PlaneToPlane(
                source_plane,
                plane
            )

            geo.Transform(
                xform
            )


            Links.append(
                geo
            )
# ---------- end chain_generator ----------
larger_than = LargerThan(FirstNumber=list_length, SecondNumber=1)  # -> LargerThan, OrEqualTo
allow_3d_2 = Boolean(allow_3d)
chain_geos = Geometry(chain_generator.Links)
stream_filter = StreamFilter(
    Gate=larger_than.LargerThan,
    Stream0=[diamond_placement.DiamondSockets, diamond_placement.Diamonds],
    Stream1=diamond_placement.DiamondSockets)
stream_filter_2 = StreamFilter(Gate=larger_than.LargerThan, Stream1=diamond_placement.Diamonds)
chain_geos_2 = ClusterOutput(chain_geos)
stream_filter_3 = StreamFilter(Gate=allow_3d_2, Stream1=names_geo)
name_geos = Geometry(stream_filter_3)
name_geos_2 = ClusterOutput(name_geos)

# ---- group: addition stones
stone_socket_addition_2 = Geometry(stone_socket_addition)
stone_addition_2 = Geometry(stone_addition)
stones_2 = Geometry(stones)
transform = Transform(Geometry=stones_2, Transform=inscription_placer.Transforms)
transform_2 = Transform(Geometry=transform, Transform=name_layout.Transforms)
point = Point(Point(0, 0, 0))

# ----
transform_3 = Transform(Geometry=transform_2, Transform=gravity_layout.Transforms)

# ---- group: addition stones (continued)
move_to = MOVETO(geo_1=point, geo_2=graft(transform_3))  # -> flatten(G_2)
move_to_point = MoveToPoint(Geometry=stone_socket_addition_2, PointA=point, PointB=move_to)  # -> Moved, Vector, Transform
move_to_point_2 = MoveToPoint(Geometry=stone_addition_2, PointA=point, PointB=move_to)  # -> Moved, Vector, Transform

# ----
diamonds_sockets_preview = Geometry(flatten([move_to_point.Moved, stream_filter]))
diamonds_preview = Geometry(flatten([move_to_point_2.Moved, stream_filter_2]))
diamonds_sockets_preview_2 = ClusterOutput(diamonds_sockets_preview)
diamonds_preview_2 = ClusterOutput(diamonds_preview)

# ==== cluster MULTINAMESINGLELOOPNECKLACEMAKER
enable = ClusterInput()
allow_3d = ClusterInput()
enable_chain_generation = ClusterInput()
previews = ClusterInput()
looppoints = ClusterInput()
namespacing = ClusterInput()
previewtaillength = ClusterInput()
chainrise = ClusterInput()
samples = ClusterInput()
linkgeometry = ClusterInput()
linkpitch = ClusterInput()
connectionlinkgeometry = ClusterInput()
enable_2 = Boolean(enable)
previews_2 = Geometry(previews)
single_loop_layout = Script(
    Enable=enable_2,
    LoopPoints=looppoints,
    NameSpacing=namespacing,
    PreviewTailLength=previewtaillength,
    ChainRise=chainrise,
    Samples=samples)  # -> out, ChainLine, TargetPoints, MoveVectors; inputs Enable: Boolean, LoopPoints: list of Point3d, NameSpacing: Double, PreviewTailLength: Double, ChainRise: Double, Samples: Int32
# ---------- single_loop_layout: Python ----------
import Rhino.Geometry as rg


ChainLine = None
TargetPoints = []
MoveVectors = []


spacing = max(
    0.001,
    float(NameSpacing)
)

tail = max(
    0.001,
    float(PreviewTailLength)
)

rise = max(
    0.0,
    float(ChainRise)
)

samples = max(
    10,
    int(Samples)
)


# --------------------------------------------------
# BASIC CHECK
# --------------------------------------------------

if Enable and LoopPoints:

    name_count = len(
        LoopPoints
    )


    # ------------------------------------------------
    # WIDTH OCCUPIED BY THE NAMES
    # ------------------------------------------------

    names_width = (
        float(name_count - 1)
        * spacing
    )


    total_width = (
        names_width
        +
        tail * 2.0
    )


    half_width = (
        total_width * 0.5
    )


    # ------------------------------------------------
    # CHAIN SHAPE
    #
    # Center = lowest point.
    # Ends rise upward by ChainRise.
    # ------------------------------------------------

    chain_points = []


    for i in range(
        samples + 1
    ):

        f = (
            float(i)
            /
            float(samples)
        )

        x = (
            -half_width
            +
            total_width * f
        )


        if half_width > 1e-9:

            normalized_x = (
                x / half_width
            )

        else:

            normalized_x = 0.0


        y = (
            rise
            *
            normalized_x
            *
            normalized_x
        )


        point = rg.Point3d(
            x,
            y,
            0.0
        )

        chain_points.append(
            point
        )


    # ------------------------------------------------
    # CREATE CONTINUOUS CHAIN CURVE
    # ------------------------------------------------

    if len(chain_points) >= 2:

        ChainLine = rg.Curve.CreateInterpolatedCurve(
            chain_points,
            3
        )


    # ------------------------------------------------
    # NAME ATTACHMENT POSITIONS
    # ------------------------------------------------

    if ChainLine is not None:

        first_name_x = (
            -names_width * 0.5
        )


        for i, loop_point in enumerate(
            LoopPoints
        ):

            if loop_point is None:
                continue


            target_x = (
                first_name_x
                +
                float(i) * spacing
            )


            # Find point on chain at this X.
            #
            # Because our chain is generated
            # analytically, calculate the same Y.

            if half_width > 1e-9:

                normalized_x = (
                    target_x /
                    half_width
                )

            else:

                normalized_x = 0.0


            target_y = (
                rise
                *
                normalized_x
                *
                normalized_x
            )


            target = rg.Point3d(
                target_x,
                target_y,
                0.0
            )


            TargetPoints.append(
                target
            )


            move = (
                target
                -
                loop_point
            )


            MoveVectors.append(
                move
            )
# ---------- end single_loop_layout ----------
target_points = Geometry(single_loop_layout.TargetPoints)
enable_chain_generation_2 = Boolean(enable_chain_generation)
boolean_toggle = BooleanToggle(False)
chain_generator = Script(
    Enable=enable_chain_generation_2,
    ChainLines=single_loop_layout.ChainLine,
    LinkGeometry=linkgeometry,
    LinkPitch=linkpitch,
    ConnectionLinkGeometry=connectionlinkgeometry,
    StartIsName=boolean_toggle,
    EndIsName=boolean_toggle)  # -> out, Links, LinkPoints, LinkPlanes, LinkCounts, ActualPitches; inputs Enable: Boolean, ChainLines: list of Curve, LinkGeometry: GeometryBase, LinkPitch: Double, ConnectionLinkGeometry: GeometryBase, StartIsName: list of Boolean, EndIsName: list of Boolean
# ---------- chain_generator: Python ----------
import Rhino.Geometry as rg
import math


Links = []
LinkPoints = []
LinkPlanes = []
LinkCounts = []
ActualPitches = []


pitch = max(
    0.001,
    float(LinkPitch)
)

source_plane = rg.Plane.WorldXY


# --------------------------------------------------
# KEEP EACH CURVE TOGETHER WITH ITS END TYPE
# --------------------------------------------------

segments = []

if Enable:

    for index, curve in enumerate(ChainLines):

        if curve is None:
            continue

        start_is_name = (
            bool(StartIsName[index])
            if index < len(StartIsName)
            else False
        )

        end_is_name = (
            bool(EndIsName[index])
            if index < len(EndIsName)
            else False
        )

        segments.append(
            (
                curve,
                start_is_name,
                end_is_name
            )
        )


    segment_count = len(
        segments
    )


    # --------------------------------------------------
    # GENERATE LINKS
    # --------------------------------------------------

    for segment_index, data in enumerate(
        segments
    ):

        curve, start_is_name, end_is_name = data


        length = curve.GetLength()

        if length <= 1e-9:
            continue


        # --------------------------------------------
        # NUMBER OF SPACES
        # --------------------------------------------

        ideal_spaces = (
            length /
            pitch
        )

        spaces = max(
            2,
            int(round(ideal_spaces))
        )


        is_first_segment = (
            segment_index == 0
        )

        is_last_segment = (
            segment_index ==
            segment_count - 1
        )

        is_middle_segment = (
            not is_first_segment
            and not is_last_segment
        )


        # --------------------------------------------
        # MIDDLE SEGMENTS NEED EVEN PARITY
        # --------------------------------------------

        if (
            is_middle_segment
            and spaces % 2 != 0
        ):

            lower = spaces - 1
            upper = spaces + 1

            if lower < 2:

                spaces = upper

            else:

                lower_pitch = (
                    length /
                    float(lower)
                )

                upper_pitch = (
                    length /
                    float(upper)
                )

                lower_error = abs(
                    lower_pitch -
                    pitch
                )

                upper_error = abs(
                    upper_pitch -
                    pitch
                )

                spaces = (
                    lower
                    if lower_error <= upper_error
                    else upper
                )


        actual_pitch = (
            length /
            float(spaces)
        )


        LinkCounts.append(
            spaces - 1
        )

        ActualPitches.append(
            actual_pitch
        )


        # --------------------------------------------
        # CREATE LINKS
        # --------------------------------------------

        for i in range(
            1,
            spaces
        ):

            distance = (
                float(i) *
                actual_pitch
            )

            normalized = (
                distance /
                length
            )


            ok, t = curve.NormalizedLengthParameter(
                normalized
            )

            if not ok:
                continue


            point = curve.PointAt(
                t
            )

            tangent = curve.TangentAt(
                t
            )

            if not tangent.Unitize():
                continue


            # ----------------------------------------
            # PLANE FOLLOWS CHAIN CURVE
            # ----------------------------------------

            x_axis = rg.Vector3d(
                tangent
            )

            y_axis = rg.Vector3d.CrossProduct(
                rg.Vector3d.ZAxis,
                x_axis
            )

            if not y_axis.Unitize():
                y_axis = rg.Vector3d.YAxis


            plane = rg.Plane(
                point,
                x_axis,
                y_axis
            )


            # ----------------------------------------
            # LINK PARITY
            # ----------------------------------------

            if is_first_segment:

                rotate90 = (
                    (spaces - i) % 2 == 1
                )

            else:

                rotate90 = (
                    i % 2 == 1
                )


            if rotate90:

                plane.Rotate(
                    math.radians(90.0),
                    plane.XAxis
                )


            LinkPoints.append(
                point
            )

            LinkPlanes.append(
                plane
            )


            # ----------------------------------------
            # IS THIS LINK ATTACHED TO A NAME?
            # ----------------------------------------

            is_first_link = (
                i == 1
            )

            is_last_link = (
                i == spaces - 1
            )


            use_connection_link = (
                (
                    start_is_name
                    and is_first_link
                )
                or
                (
                    end_is_name
                    and is_last_link
                )
            )


            # ----------------------------------------
            # SELECT GEOMETRY
            # ----------------------------------------

            if (
                use_connection_link
                and ConnectionLinkGeometry is not None
            ):

                source_geo = ConnectionLinkGeometry

            else:

                source_geo = LinkGeometry


            if source_geo is None:
                continue


            # ----------------------------------------
            # DUPLICATE
            # ----------------------------------------

            try:

                geo = source_geo.Duplicate()

            except:

                try:

                    geo = source_geo.DuplicateGeometry()

                except:

                    geo = None


            if geo is None:
                continue


            # ----------------------------------------
            # PLACE GEOMETRY
            # ----------------------------------------

            xform = rg.Transform.PlaneToPlane(
                source_plane,
                plane
            )

            geo.Transform(
                xform
            )


            Links.append(
                geo
            )
# ---------- end chain_generator ----------
rotation = ROTATION(geometry=previews_2, point_a=looppoints, point_b=single_loop_layout.TargetPoints, center=target_points)  # -> geometry_2, compound_2
allow_3d_2 = Boolean(allow_3d)
names_geo = Geometry(rotation.geometry_2)
stream_filter = StreamFilter(Gate=allow_3d_2, Stream1=names_geo)
previews_3 = Geometry(stream_filter)
chain = Geometry(chain_generator.Links)
previews_4 = ClusterOutput(previews_3)
chain_2 = ClusterOutput(chain)

# ==== cluster MOVETO
geo_2 = ClusterInput()
geo_1 = ClusterInput()
geo_2_2 = Geometry(geo_2)
geo_1_2 = Geometry(geo_1)
bounding_box = BoundingBox(Content=geo_1_2, Plane=PlaneXY(0, 0, 0), UnionBox=True)  # -> Box, Box_2
bounding_box_2 = BoundingBox(Content=geo_2_2, Plane=PlaneXY(0, 0, 0), UnionBox=True)  # -> Box, Box_2
area = Area(Geometry=bounding_box.Box)  # -> Area, Centroid
area_2 = Area(Geometry=bounding_box_2.Box)  # -> Area, Centroid
move_to_point = MoveToPoint(Geometry=geo_1_2, PointA=area.Centroid, PointB=area_2.Centroid)  # -> Moved, Vector, Transform
G = Geometry(move_to_point.Moved)
G_2 = ClusterOutput(G)

# ==== cluster ROTATION
geometry = ClusterInput()
point_a = ClusterInput()
point_b = ClusterInput()
center = ClusterInput()
move_to_point = MoveToPoint(Geometry=geometry, PointA=point_a, PointB=point_b)  # -> simplify(Moved), Vector, simplify(Transform)
item = ListItem(List=move_to_point.Transform, Index=0, Wrap=True)
rotate_3d = Rotate3D(Geometry=move_to_point.Moved, Angle=-1.570796327, Center=center, Axis=Vector(0, 0, 1))  # -> simplify(Geometry), simplify(Transform)
item_2 = ListItem(List=rotate_3d.Transform, Index=0, Wrap=True)
rotate_3d_2 = Rotate3D(Geometry=rotate_3d.Geometry, Angle=1.151, Center=center, Axis=Vector(0, 1, 0))  # -> simplify(Geometry), simplify(Transform)
item_3 = ListItem(List=rotate_3d_2.Transform, Index=0, Wrap=True)
rotate_3d_3 = Rotate3D(Geometry=rotate_3d_2.Geometry, Angle=0.2617993878, Center=center, Axis=Vector(1, 0, 0))  # -> simplify(Geometry), simplify(Transform)
item_4 = ListItem(List=rotate_3d_3.Transform, Index=0, Wrap=True)
geometry_2 = ClusterOutput(rotate_3d_3.Geometry)
compound = Compound(Transforms=[item_2, item_3, item_4, item])  # -> simplify(Compound)
compound_2 = ClusterOutput(compound)
